# Grasshopper definition updated slicer most recent.gh (Grasshopper 1.0.8)
# plug-ins: LunchBox

# ---- group: notes and side definitions to add
imager_smapler_directly_onto_surface = ImagerSmaplerDirectlyOntoSurface()
notes_extra_defintions_arron_gave_us = NotesExtraDefintionsArronGaveUs()

# ----
cluster = Cluster_9()
cluster_2 = Cluster_9()
cluster_3 = Cluster_9()
cluster_4 = Cluster_25()

# ---- group: notes and side definitions to add / basic curve to vase mode
cluster_5 = Cluster_3(crv=[<geometry referenced from the Rhino model> x6], B=1)

# ----
panel = Panel("layer hieght")
# to do list
# 1, omni vase mode, fixing the loft break shift curve parametric design, 90%
# 2, section mode(done), creating black sections and non blank sections, potentially each secion differnt textire(next part)
# 
# 4. surface mapping
# good start keep researching and adding
# 
# 3 random mode,
# random droops
number_slider = Slider(2, range=0..40)

# ----
# Welcome to the Chipotle of Grasshopper slicers!
# Just like building your favorite burrito bowl, you’ll start by choosing your base—whether it’s a single surface, a mesh, or another form. This slicer focuses on generating clean, smooth outer contours; internal walls are not part of the recipe here.
# 
# Working left to right through the definition:
# 
# Previewing Your Print:
# Click on the main cluster to see a live preview in Rhino. (Basic Grasshopper knowledge is recommended—pro tip: set your preview to “only show selected” for clarity.)
# 
# Planar vs. Non-Planar Printing:
# Your first major decision is whether you want standard flat (planar) layers or flowing (non-planar) ones that rise and fall with each slice. Each mode creates different surface effects.
# 
# Texture Sliders:
# Adjust sliders to create bumps, droops, and other surface distortions. For even more control, use attractors to apply textures based on external geometries.
# 
# Optional Texture Range Control (Blue Group):
# You can define specific layer ranges where textures are applied—mixing smooth and textured sections as desired.
# 
# Vase Mode or Not:
# You can enable vase mode for clean, continuous spirals (great for decorative prints). If your printer handles retractions well, you may opt for traditional layer-by-layer printing with visible seams.
# Note: Using vase mode with texture isn't officially supported—it might work, but expect odd results.
# 
# Finally, Exporting Your G-code (The Register):
# Choose your printer setup. These values are close to approximate but may need slight adjustment, this can be done by going into the cluster and finding the green section and adjusting values. Once your settings are locked in, copy the G-code from the final panel:
# 
# Right-click → "Copy Data Only"
# 
# Paste into a text editor (TextEdit on Mac, Notepad on Windows)
# 
# Save the file with a .gcode extension
# 
# Send to your printer and enjoy!
# enter ANY PIECE of geometry
# mesh polysureface surface etc.
# even if not using a the geometery command it needs a pieec of geomety in it
geo = Geometry(<brep referenced from the Rhino model>)

# ---- group: bottom layers / type of bottom layers
list = ValueList({"lines": 0, "conentric": 1}, selected="conentric")

# ----
# contour finds the curves in the surface, rebuilding is important to reduce the point count of the curve, for the image a higher point count makes more sense.
contour = Contour(Shape=geo, Point=Point(0, 0, 0), Direction=Vector(0, 0, 1), Distance=number_slider)
reb = RebuildCurve(Curve=contour, Count=Slider(50, range=0..100), Tangents=False)  # -> flatten(Curve)

# ---- group: bottom layers / nozzle width
number_slider_2 = Slider(3.5, range=0..10)

# ---- group: bottom layers / number of bottom layers
# this fucker works.
# 
# yeah not much i got here, only one pattern but idc
number_slider_3 = Slider(2, range=0..6)

# ---- group: bottom layers / wall offset, distance multiplier for between contour and wall
number_slider_4 = Slider(0.8, range=0..3)

# ----
cluster_6 = Cluster_56()
cluster_7 = Cluster_57()
geo_2 = Geometry([<curve referenced from the Rhino model> x182])
area = Area(Geometry=geo_2)
pdecon = Deconstruct(Point=area)  # -> XComponent, YComponent, ZComponent
sort = SortList(Keys=pdecon.ZComponent, ValuesA=geo_2)  # -> Keys, ValuesA
item = ListItem(List=sort.ValuesA, Index=0, Wrap=True)
flip = FlipCurve(Curve=sort.ValuesA, Guide=item)  # -> Curve, Flag

# ----
# planar or non planer
# 1/2/3 are work in progress as the currently void the overall shape of the geometry, that being said they still do some cool things, tey them and have fun
# 0 = planar curves
# 1= just rotated edge
# 2= custom top value
# 3 is currently null WIP
# 
# 4=custom values for everthything submit all your own curves quantity doesnt matter
# 
# 5= crazy shit, non planar loft, textures you name it
# 6= Mirror(Still WIP)
number_slider_5 = Slider(5, range=0..6)
gate = StreamGate(Stream=reb, Gate=number_slider_5)  # -> Target0, Target1, Target2, Target3, Target4, Target5, Target6

# ---- group: mirrored geometry WIP / threshold for curve elimination
number_slider_6 = Slider(45, range=0..100)

# ---- group: mirrored geometry WIP / activation toggle
toggle = BooleanToggle(True)

# ---- group: planar
geo_3 = Geometry(gate.Target0)

# ---- group: rim udjustment via rotation
# these 3 sliders change the relatie position of the last curve before finding the curves in between
yz_rotation = Slider(20, range=0..360)
xy_rotation = Slider(14, range=-50..360)
xz_rotation = Slider(5, range=0..360)

# ---- group: mirrored geometry WIP
cluster_8 = Cluster_55(G=geo, G_4=toggle, geo=gate.Target6, B=number_slider_6)  # -> G_2, G_3, _1

# ---- group: non loft non planar, creates more rigid shapes
crv = Curve([<curve referenced from the Rhino model> x4])
cluster_9 = Cluster_11(G=number_slider_5, C=crv, B=number_slider, C_2=crv)

# ---- group: rim udjustment via rotation
cluster_10 = Cluster_7(crv=gate.Target1, B=number_slider, A=degrees(xy_rotation), A_2=degrees(yz_rotation), A_3=degrees(xz_rotation))

# ---- group: mirrored geometry WIP / preview
geo_4 = Geometry([cluster_8.G_2, cluster_8.G_3])

# ---- group: planar or non planar secitions
# 0= planar sections
# 1= custom cross sections non planar
# 3 custom non planar surface
# #6
# 
# order of selecting the curves doesnt matter, planar or not nbd, anyhting should be aok
# 
# plus texture mapping with the planar or non planar crvues
# #6.5
# non planar surface
# this allows you to implement a non planar base surface
number_slider_7 = Slider(1, range=0..2)

# ---- group: #6 smooth loft cross sections / import curves here
crv_2 = Curve([<curve referenced from the Rhino model> x4])

# ---- group: set one surface here
srf = Surface(<surface referenced from the Rhino model>)

# ----
geo_5 = Geometry(gate.Target5)

# ---- group: seam ad
number_slider_8 = Slider(33, range=0..100)

# ----
cluster_11 = Cluster_41(
    G=number_slider_7,
    S_2=number_slider_8,
    geo_3=gate.Target5,
    int=number_slider_7,
    geo=crv_2,
    S=number_slider_8,
    B_2=number_slider,
    B=number_slider,
    geo_5=srf)  # -> s_1, s_1_3, s_1_2

panel_2 = Panel("seam alignment")
geo_6 = Geometry(cluster_11.s_1)

# ---- group: texture selection
# 0 = no texture
# 1 = waffle pattern
# 2=cells
# 3= diamonds
# 4=idek lets call this acorn
number_slider_9 = Slider(2, range=0..5)

gate_2 = StreamGate(Stream=cluster_11.s_1_2, Gate=number_slider_9)  # -> Target0, Target1
gate_3 = StreamGate(Stream=cluster_11.s_1_3, Gate=number_slider_9)  # -> Target0, Target1, Target2, Target3, Target4, Target5

# ----
srf_2 = Surface(reparameterize(gate_3.Target5))

# ---- group: waffle
panel_3 = Panel("extrusion distance ")
number_slider_10 = Slider(-4.1, range=-10..10)

panel_4 = Panel("scale of faces")
number_slider_11 = Slider(0.5, range=0..1)

# ---- group: diamonds
number_slider_12 = Slider(8, range=0..15)
cluster_12 = Cluster_26(srf=gate_3.Target3, U=Slider(8, range=0..15), V=number_slider_12, A=number_slider_12)

# ---- group: cells / keep these even
number_slider_13 = Slider(8, range=0..15)

# ---- group: cells
cluster_13 = Cluster_27(srf=gate_3.Target2, U=Slider(8, range=0..15), V=number_slider_13, A=number_slider_13)

# ---- group: waffle
# how many squares are present
number_slider_14 = Slider(5, range=0..30)
number_slider_15 = Slider(5, range=0..30)

# ---- group: acorn
tric = TrianglePanelsC(Surface=gate_3.Target4, UDivisions=Slider(5, range=0..15), VDivisions=Slider(5, range=0..15))
join = BrepJoin(Breps=tric)  # -> Breps, Closed

# ---- group: waffle
# offset distance for flats
number_slider_16 = Slider(2.28, range=0..5)

# ---- group: imput geometry
geo_7 = Geometry(<extrusion referenced from the Rhino model>)

# ---- group: degree of curve
number_slider_17 = Slider(1, range=0..3)

# ---- group: radius of pipe
number_slider_18 = Slider(3, range=0..10)

# ---- group: no texture
geo_8 = Geometry(gate_2.Target0)

# ----
panel_5 = Panel("""0
1""")

sdivide = DivideSurface(Surface=srf_2, UCount=Slider(18, range=0..100), VCount=Slider(14, range=0..100))  # -> Points, Normals, Parameters
panel_6 = Panel("""1
0""")
area_2 = Area(Geometry=geo_7)  # -> Area, Centroid
pl = PlaneNormal(Origin=sdivide.Points, ZAxis=sdivide.Normals)
orient = Orient(Geometry=geo_7, Source=area_2.Centroid, Target=pl)  # -> Geometry, Transform
shift = ShiftList(List=panel_6, Shift=panel_5, Wrap=True)
lng = ListLength(List=orient.Geometry)
lng_2 = ListLength(List=shift)
multiplication = Multiplication(A=shift, B=1)
lng_3 = ListLength(List=flatten(lng))  # -> expr("x*2", Length)
item_2 = ListItem(List=flatten(lng_2), Index=0, Wrap=True)
repeat = RepeatData(Data=flatten(multiplication), Length=lng_3)
partition = PartitionList(List=repeat, Size=item_2)
cap = CapHoles(Brep=srf_2)
panel_7 = Panel(partition)
dispatch = Dispatch(List=orient.Geometry, DispatchPattern=partition)  # -> flatten(ListA), ListB

# ---- group: waffle
# longterm make this so it does one postivie one negetive
# 
# outie versus innie
cluster_14 = Cluster_24(srf=gate_3.Target1, D=number_slider_16, U=number_slider_14, V=number_slider_15, F=number_slider_11, x=number_slider_10)

# ---- group: waffle / preview
geo_9 = Geometry(cluster_14)

# ----
geo_10 = Geometry([cap, dispatch.ListA])

# ----
# TURN THIS OFF AT ALL TIMES UNLESS ACTIVELY USING
toggle_2 = BooleanToggle(False)
cluster_15 = Cluster_37(
    G_2=number_slider_5,
    geo_3=geo_8,
    S=cluster_11.s_1_2,
    G=number_slider_9,
    bool=toggle_2,
    geo_5=[cluster_14, cluster_13, cluster_12, join.Breps])

number_slider_19 = Slider(1, range=0..1)
panel_8 = Panel("""1
0
0""")
repeat_2 = RepeatData(Data=0, Length=49)
repeat_3 = RepeatData(Data=panel_8, Length=600)
merge = Merge(Data1=repeat_2, Data2=repeat_3)
panel_9 = Panel(merge)

# ---- group: setting the dispatch for textured and non textured layers
# this changes how the layers for texture are affected:
# 
# for exapmle 1 in both sliders ie: 1,1 every 1 layer 1 get texture
# 
# 2,1 : every 2 layers 1 layer gets texture,
# 
# 1,2 every 1 normal layer 2 layers get texture
# this is kinda confusing so i recomend testing and it should make sense
panel_10 = Panel("layer switches")

panel_11 = Panel("basic layers")
number_slider_20 = Slider(2, range=0..5)
number_slider_21 = Slider(1, range=0..5)
panel_12 = Panel("textured layers ")

# ----
# kinda hard to explain, but layer A versus layer B changes, this assigns were the droopies are, so you can have certain quantities of droops on top of themsleves
# simply add to this panel
# 0= normal layers
# 1 = textured layer
panel_13 = Panel("""1
1
0
0
0
1
1
1""")

# ---- group: setting the dispatch for textured and non textured layers
# False: Uses the top presets
# 
# True: Uses the custom implemented values
toggle_3 = BooleanToggle(False)

# ----
# False: Uses the top presets
# 
# True: Uses the custom implemented values
toggle_4 = BooleanToggle(False)

# ----
# dispatch for textured layers
number_slider_22 = Slider(3, range=0..5)
number_slider_23 = Slider(3, range=0..5)
panel_14 = Panel("A layers")
panel_15 = Panel("B layers")
cluster_16 = Cluster_17(
    L_4=number_slider_22,
    G_2=toggle_4,
    L_2=number_slider_22,
    G=toggle_4,
    L_3=number_slider_23,
    _1=panel_13,
    L=number_slider_23,
    x=panel_13)  # -> s_0_2, s_0
panel_16 = Panel(cluster_16.s_0_2)
panel_17 = Panel(cluster_16.s_0)

# ---- group: setting the dispatch for textured and non textured layers
# incase you want a custom mix
# like 3 layers normal, 2 layers texture, 2 layers normal, 3 layers texture
# 
# simply add to this panel
# 0= normal layers
# 1 = textured layer
panel_18 = Panel(panel_9)

cluster_17 = Cluster_18(
    L_4=number_slider_20,
    G_2=toggle_3,
    L_2=number_slider_20,
    G=toggle_3,
    L_3=number_slider_21,
    _1=panel_18,
    L=number_slider_21,
    x=panel_18)  # -> s_0_2, s_0
panel_19 = Panel(cluster_17.s_0_2)
panel_20 = Panel(cluster_17.s_0)

# ---- group: custom rotation droopy pattern / scaling of droopies / false = all the same values true = custom values that repeat
toggle_5 = BooleanToggle(True)

# ---- group: custom rotation droopy pattern / scaling of droopies
panel_21 = Panel("""-4
4""")
cluster_18 = Cluster_16(G=toggle_5, _0=Slider(1.5, range=0..2), _1=panel_21)

# ----
panel_22 = Panel("""2
2
4
4
2
2
5
6
3
3
6
8
5
10
3
4""")
panel_23 = Panel("texture size")
panel_24 = Panel("""2
4
5
1
3
6
3
5
1
3
6
7
2
3
1
5
6
2
3""")

# ----
# lines to have texture
panel_25 = Panel("""1
3
5
8
9
12
15
22
37
26
39
54
58
59
61
63""")
panel_26 = Panel("""2
4
8
12
13
15
21
27
31
35
36
41
43
44
47
53
55
60
61""")

# ---- group: checkerboard
panel_27 = Panel("lines before shift ")
number_slider_24 = Slider(5, range=1..400)

panel_28 = Panel("""auto repeat 
exists """)

# ---- group: image attractor
panel_29 = Panel("attractor points ")
number_slider_25 = Slider(120, range=0..800)

dom = ConstructDomain(DomainStart=Slider(-1, range=-50..100), DomainEnd=Slider(5, range=-50..100))

# ---- group: cubicle
# keep this even, works better //16 sections= 8 sections of outwards
number_slider_26 = Slider(16, range=10..45)

# ---- group: cubicle / smaller value
number_slider_27 = Slider(-6, range=-10..10)

# ---- group: cubicle / bigger value
number_slider_28 = Slider(6.1, range=-10..10)

# ---- group: pt attractor
panel_30 = Panel("droopy or smooth ")
toggle_6 = BooleanToggle(False)

number_slider_29 = Slider(24, range=0..100)

# ---- group: checkerboard
panel_32 = Panel("direction ")
toggle_7 = BooleanToggle(False)

# ---- group: attractor crv
panel_33 = Panel("droopy or smoooth ")
toggle_8 = BooleanToggle(False)

# ---- group: pt attractor / apply attractor points here
attractor_pts = Point([<point referenced from the Rhino model> x3])

# ---- group: attractor crv
dom_2 = ConstructDomain(DomainStart=Slider(-10, range=-100..100), DomainEnd=Slider(25, range=-100..100))

# ----
# keep this even, it helps with data matching,
# if left odd it does some overlaping, could be cool if that the intention
# maybe put an align curves command in here so the points are alwasy nice
number_slider_30 = Slider(200, range=0..200)

# ---- group: pt attractor
dom_3 = ConstructDomain(DomainStart=Slider(22, range=-100..100), DomainEnd=Slider(-17, range=-100..100))

# ---- group: random / domain of the droops
dom_4 = ConstructDomain(DomainStart=Slider(3, range=-10..10), DomainEnd=Slider(10, range=-10..10))

# ---- group: attractor crv
# true=0 bumbs on the odd layers
toggle_9 = BooleanToggle(True)

# ---- group: checkerboard / scale for droopies
panel_34 = Panel("4")

# ---- group: checkerboard
# standard rotation
# false = values are rpeated
# 
# true eqauls each step is the number entered away from ther last so if the number is 5 the first is shifted 5 the second 10  etc
# you can add values to shift by, or use standard rotation, auto repeat is enabled, not sure what it will due but its cool
panel_35 = Panel("0")
toggle_10 = BooleanToggle(False)

# ---- group: attractor crv
# true=0 bumbs on the even layers
toggle_11 = BooleanToggle(True)

# ---- group: random / potenital amount of points
number_slider_31 = Slider(90, range=1..100)

# ---- group: attractor crv
# amount of atractor points
number_slider_32 = Slider(32, range=0..100)

# ---- group: pt attractor
# true=0 bumbs on the even layers
toggle_12 = BooleanToggle(True)

# ---- group: checkerboard / bumps per line
# keep control points per secition at least double highest value +1
panel_36 = Panel("""1
3
5
3
1""")

# ---- group: attractor crv / apply attractor crv here
crv_3 = Curve(<curve referenced from the Rhino model>)

# ---- group: image attractor
# smotth lines or drooppy
toggle_13 = BooleanToggle(False)

# ---- group: pt attractor
# true=0 bumbs on the odd layers
toggle_14 = BooleanToggle(True)

# ---- group: image attractor
# image alignment
# incerasing this slider effectivly changes where the image lines up to the surface
number_slider_33 = Slider(43, range=0..200)

# ---- group: checkerboard
control_points_per_section = Slider(30, range=0..50)
number_of_secitons = Slider(30, range=0..40)

# ---- group: custom rotation droopy pattern
# this is how you assign the patterns, by putting in 1 and 0' it chooses between points that are large or small creaitng a pattern
# 
# 
# trying to keep point count divisible by the pattern length creates better results
number_slider_34 = Slider(40, range=0..45)

# ---- group: custom rotation droopy pattern / input weave pattern here
panel_37 = Panel("""1
0
0
0
0
0
0
0
0
0
0
0
0
0
0
0
0
0
0
0
0
0
0
0
0""")

# ---- group: custom rotation droopy pattern / custom pattern for rotation
panel_38 = Panel("""0
1
3
7""")

# ---- group: custom rotation droopy pattern / step count for standard rotation
panel_39 = Panel("0")

# ---- group: custom rotation droopy pattern / custom rotation or standard
toggle_15 = BooleanToggle(True)

# ---- group: custom rotation droopy pattern / clock wise or conter close wise rotation
toggle_16 = BooleanToggle(False)

# ---- group: droopys
# size of droopys compared to initial line
number_slider_35 = Slider(6, range=-20..20)

# this chooses the amount of droopy elements amount of non
# notes
# keep this slider as even number for data matching
number_slider_36 = Slider(150, range=0..200)

# this changes the droops from being the insode and outside to jsut the outside
toggle_17 = BooleanToggle(False)

# ---- group: test vase modes
cluster_19 = Cluster_70(num=number_slider, P=cluster_17.s_0_2, A=number_slider_2, num_2=number_slider)

# ----
crv_4 = Curve([<curve referenced from the Rhino model> x3])
series = Series(Start=0, Step=Slider(1.5, range=0..2), Count=30)
srf_3 = Surface(<surface referenced from the Rhino model>)
Z = UnitZ(Factor=series)
move = Move(Geometry=crv_4, Motion=graft(Z))  # -> flatten(Geometry), Transform
edges = BrepEdges(Brep=srf_3)  # -> Naked, Interior, NonManifold
cp = ControlPoints(Curve=move.Geometry)  # -> Points, Weights, Knots
topoly = CurveToPolyline(Curve=edges.Naked, ToleranceDistance=Slider(0.1, range=0..0.1), ToleranceAngle=0)  # -> Polyline, Segments
item_3 = ListItem(List=cp.Points, Index=0, Wrap=True)
pdecon_2 = Deconstruct(Point=item_3)  # -> XComponent, YComponent, ZComponent
pcen = PolygonCenter(Polyline=topoly.Polyline)  # -> CenterV, CenterE, CenterA
sort_2 = SortList(Keys=flatten(pdecon_2.ZComponent), ValuesA=move.Geometry)  # -> Keys, ValuesA

# ----
# this is to make sure the nozzle doesnt drag into the print bed
number_slider_37 = Slider(150, range=0..400)

dispatch_2 = Dispatch(List=sort_2.ValuesA, DispatchPattern=[True, True, True, False, False, False])  # -> ListA, ListB
flip_2 = FlipCurve(Curve=dispatch_2.ListB)  # -> Curve, Flag
geo_11 = Geometry()
weave = Weave(Pattern=[0, 0, 0, 1, 1, 1], Stream0=dispatch_2.ListA, Stream1=flip_2.Curve, NullGaps=False)

# ---- group: potter bot / extrusion multiplier
number_slider_38 = Slider(0, range=0..2.1)

# ---- group: potter bot / z offset(drywall, etc)
panel_40 = Panel("0")

# ---- group: clay / extrusion multiplier
number_slider_39 = Slider(9, range=0..20)

# ---- group: clay / z offset(drywall, etc)
# printer 1
# -1 with slab underneath
# 
# 
# 
# printer 2
# 0
panel_41 = Panel("0")

# ----
path = DataPath()

# ---- group: bottom layers
# multiply actual nozzle width by a bit to acheive better bottom layers
addiotional_layer_seperation_for_base_la = Slider(0, range=0..4)  # "addiotional layer seperation for base layers"

# ----
# import altered curve here
# if you want a start altering the top crv
top_crv = Curve(<curve referenced from the Rhino model>)

# ---- group: user implemented non planar top curve
cluster_20 = Cluster_4(L_2=gate.Target2, B_2=top_crv, L=gate.Target2, B=number_slider, C=top_crv)  # -> T, i

# ----
# #4
# multiple curves tween'd together, like bryan, probably going to need some basic recusion
# 
# create a shifted list to cull the first value out of the original set of curves then tween between value 0 to 0 sinec the cull is offseting them
# 
# it does work!!!
# non planar or planar curves, cross sections can be used bassicaly voids the contour command
crv_5 = Curve(cluster_20.i)

# ----
# texture?
# 0=none
# 1= droopys/bump can be achieve by changing the scale value and quantity of  bumps
# 2 = weave
# 3 = pt attractors
# 4=crv attactors
# 5=image attraction
# 6=cubicles
# 7=checkerboard
# 8=custom sequenced drooppies
# 9 random
# 10 halfsies
# items to add:
# 
# random points and random distances
number_slider_40 = Slider(0, range=0..11)
cluster_21 = Cluster_42(i=number_slider_3, geo=[cluster_9, cluster_20.T, cluster_10, geo_3, cluster_15, cluster_8._1])  # -> A, B, C
gate_4 = StreamGate(Stream=cluster_21.C, Gate=number_slider_40)  # -> Target0, Target1, Target2, Target3, Target4, Target5, Target6, Target7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

# ---- group: bottom layers (continued)
cluster_22 = Cluster_54(
    D=number_slider_2,
    D_2=number_slider_2,
    geo=cluster_21.A,
    N=addiotional_layer_seperation_for_base_la,
    C=number_slider_3,
    A=number_slider_2,
    B=number_slider_4,
    G=list,
    relay=number_slider_2)

# ----
# starting from 0 to the number above(-1), that is the quantity of layers with texture.
# 
# in the upper panels (blue)specify the layers that will recieve textrue
# 
# in the lower panels(pink) specify the size of said layers
panel_42 = Panel("half 1 ")
panel_43 = Panel("half 2 ")
cluster_23 = Cluster_45(
    P=panel_19,
    crv=gate_4.Target10,
    P_2=panel_16,
    P_6=panel_20,
    int=Slider(68, range=0..100),
    P_5=panel_17,
    A_3=panel_25,
    A_4=panel_22,
    A=panel_26,
    A_2=panel_24,
    P_3=panel_16,
    P_4=panel_16)  # -> geo_2, L

# ---- group: quantity of lines
panel_44 = Panel(cluster_23.L)

# ---- group: droopys
# TEXTURE APPLICATION
image = ImageSampler(Filter="Colour", Interpolate=False, Umax=1, Umin=0, Vmax=1, Vmin=0, Wrap=1)
cluster_24 = Cluster_36(
    P_4=panel_20,
    P=panel_19,
    C=gate_4.Target1,
    P_2=panel_16,
    P_3=panel_17,
    relay_2=number_slider_36,
    relay=number_slider_35,
    bool=toggle_17)

# ---- group: no texture
geo_12 = Geometry(gate_4.Target0)

# ---- group: attractor crv
cluster_25 = Cluster_20(
    P_2=panel_19,
    P_4=panel_20,
    relay=gate_4.Target4,
    geo=crv_3,
    domain=dom_2,
    P_3=panel_17,
    relay_2=toggle_8,
    G=toggle_11,
    int=number_slider_32,
    G_2=toggle_9,
    P=panel_16)

# ---- group: cubicle
# by changing the scale factors above the way size of the cubicles can be adjsuted
# its kinda hard to eplain what cubeicle does but it creates boxes across layers, not the most food safe but dope af
# textured layers really matter here
cluster_26 = Cluster_60(
    P_4=panel_20,
    relay=gate_4.Target6,
    P=panel_19,
    int=number_slider_26,
    P_3=panel_17,
    P_2=panel_16,
    num_2=number_slider_27,
    num=number_slider_28)

# ---- group: image attractor
# if you want to change the image its kinda annoying but simply click into that cluster grab the image samplers and add the images you want ot sample
cluster_27 = Cluster_23(
    relay=gate_4.Target5,
    domain=dom,
    int=number_slider_25,
    bool=toggle_13,
    S=number_slider_33,
    P_2=panel_16,
    P=panel_19,
    P_3=panel_17,
    P_4=panel_20)

# ----
# the top 2 sliders and the bottom 2 sliders work together to change the size of the bumps, it is paramount that they overlap over the orginal line so the print will happen.
cluster_28 = Cluster_58(
    C=gate_4.Target2,
    N_3=number_slider_30,
    P=panel_19,
    A_4=Slider(4, range=-20..20),
    N=number_slider_30,
    P_4=panel_20,
    P_3=panel_17,
    A=Slider(-1, range=-20..20),
    P_2=panel_16,
    N_2=number_slider_30,
    A_3=Slider(-1, range=-20..20),
    A_2=Slider(4, range=-20..20))

# ---- group: pt attractor
cluster_29 = Cluster_19(
    P_4=panel_20,
    relay=gate_4.Target3,
    P=panel_19,
    C=attractor_pts,
    P_3=panel_17,
    domain=dom_3,
    int=number_slider_29,
    G=toggle_12,
    P_2=panel_16,
    relay_2=toggle_6,
    G_2=toggle_14,
    C_2=attractor_pts)

# ---- group: custom rotation droopy pattern
cluster_30 = Cluster_59(
    geo=gate_4.Target8,
    P=panel_19,
    relay=number_slider_34,
    P_2=panel_20,
    relay_2=panel_37,
    num=cluster_18,
    G_3=toggle_15,
    D=panel_38,
    N=panel_39,
    G=toggle_16,
    G_2=toggle_16)  # -> W, int_3

# ---- group: custom rotation droopy pattern / line count
panel_45 = Panel(cluster_30.int_3)

# ----
geo_13 = Geometry(cluster_24)

# ---- group: random
cluster_31 = Cluster_32(R_2=dom_4, geo=gate_4.Target9, P=panel_19, P_4=panel_20, int=number_slider_31, P_3=panel_17, P_2=panel_16, R=dom_4)

# ----
# needs an if statement, if x<4 double it and distpach out the extra values, because it needs the extra points,(+multiply the shift vlaues by 2 to compenstate
# 
# // end dispacth is done just needs the if statement, shoudl output a 1 or a zero depending on lenght
quantity_of_lines = Slider(12, range=0..15)
z_regions = Slider(16, range=0..25)
panel_46 = Panel("""1
0
1
0""")
int = Integer(quantity_of_lines)
clean = CleanTree(RemoveNulls=True, RemoveInvalid=True, RemoveEmpty=True, Tree=panel_46)
panel_47 = Panel(clean)
ipy2 = IronPython2Script(y=int)  # -> out, a
# ---------- ipy2: IronPython ----------
# y is the input
if y <= 10:
    a = y * 2
else:
    a = y
# ---------- end ipy2 ----------
multiplication_2 = Multiplication(A=clean, B=1)
panel_48 = Panel(ipy2.a)
sdivide_2 = DivideSurface(Surface=srf_2, UCount=z_regions, VCount=ipy2.a)  # -> Points, Normals, Parameters
repeat_4 = RepeatData(Data=multiplication_2, Length=expr("x+1", z_regions))
cullpt = CullDuplicates(Points=sdivide_2.Points, Tolerance=0.1, CullMode=3)  # -> Points, Indices, Valence
shift_2 = ShiftList(List=cullpt.Points, Shift=expr("-x", graft(repeat_4)), Wrap=True)
shift_3 = ShiftList(List=cullpt.Points, Shift=graft(repeat_4), Wrap=True)
panel_49 = Panel(cullpt.Points)
flip_3 = FlipMatrix(Data=shift_3)
flip_4 = FlipMatrix(Data=shift_2)
intcrv = Interpolate(Vertices=flip_4, Degree=number_slider_17, Periodic=False, KnotStyle=1)  # -> Curve, Length, Domain
intcrv_2 = Interpolate(Vertices=flip_3, Degree=number_slider_17, Periodic=False, KnotStyle=1)  # -> Curve, Length, Domain
panel_50 = Panel("""0
1""")
pipe = Pipe(Curve=intcrv_2.Curve, Radius=number_slider_18, Caps=1, FitRail=False)
pipe_2 = Pipe(Curve=intcrv.Curve, Radius=number_slider_18, Caps=1, FitRail=False)
cap_2 = CapHoles(Brep=srf_2)

ipy2_2 = IronPython2Script(y=int)  # -> out, a
# ---------- ipy2_2: IronPython ----------
if y <= 10:
    a = True
else:
    a = False
# ---------- end ipy2_2 ----------

filter = StreamFilter(Gate=ipy2_2.a, Stream0="1", Stream1=panel_50)
filter_2 = StreamFilter(Gate=ipy2_2.a, Stream0="1", Stream1=panel_50)
dispatch_3 = Dispatch(List=flatten(pipe), DispatchPattern=filter)  # -> ListA, ListB
dispatch_4 = Dispatch(List=flatten(pipe_2), DispatchPattern=filter_2)  # -> ListA, ListB
geo_14 = Geometry([dispatch_3.ListA, dispatch_4.ListA, cap_2])

list_2 = ValueList({"dispatched geomettry": 0, "pipes": 1, "null": 2}, selected="dispatched geomettry")
list_3 = ValueList({"clean for adjusting": 0, "gtg": 1}, selected="gtg")
filter_3 = StreamFilter(Gate=list_2, Stream0=geo_10, Stream1=geo_14)
filter_4 = StreamFilter(Gate=list_2, Stream0=cap, Stream1=cap_2)
number_slider_41 = Slider(2, range=0..10)
gate_5 = StreamGate(Stream=filter_3, Gate=list_3)  # -> Target0, Target1
bbox = BoundingBox(Content=filter_4, Plane=PlaneXY(0, 0, 0))  # -> Box, Box_2
scale_nu = ScaleNU(Geometry=bbox.Box_2, Plane=PlaneXY(0, 0, 0), ScaleX=number_slider_41, ScaleY=number_slider_41, ScaleZ=1)  # -> Geometry, Transform
sunion = SolidUnion()
debrep = DeconstructBrep(Brep=scale_nu.Geometry)  # -> Faces, Edges, Vertices
item_4 = ListItem(List=debrep.Faces, Index=4, Wrap=True)
item_5 = ListItem(List=debrep.Faces, Index=5, Wrap=True)
Z_2 = UnitZ(Factor=Slider(50, range=0..100))
extr = Extrude(Base=item_5, Direction=Z_2)
extr_2 = Extrude(Base=item_4, Direction=expr("-x", Z_2))
cap_3 = CapHoles(Brep=extr)
cap_4 = CapHoles(Brep=extr_2)
sdiff = SolidDifference(BrepsA=sunion, BrepsB=cap_3)
sdiff_2 = SolidDifference(BrepsA=sdiff, BrepsB=cap_4)

brep = Brep(gate_5.Target1)

panel_51 = Panel(brep)

ipy2_3 = IronPython2Script(G=flatten(brep), Tol=number_slider_19)  # -> U, B; inputs G: list
# ---------- ipy2_3: IronPython ----------
import System
import Rhino.Geometry as rg
import rhinoscriptsyntax as rs

breps = []
for x in G:
    if isinstance(x, System.Guid):
        x = rs.coercegeometry(x)

    if isinstance(x, rg.Extrusion):
        b = x.ToBrep(True)
    else:
        b = rs.coercebrep(x)

    if b: breps.append(b)

U = rg.Brep.JoinBreps(breps, Tol)
# ---------- end ipy2_3 ----------
brepjoin = BrepJoinProgression(Brep=flatten(brep), Tolerance=number_slider_19, Compact=True)
brepjoin_2 = BrepJoinWithTolerance(Brep=flatten(brep), Tolerance=number_slider_19)
join_2 = BrepJoin(Breps=flatten(brep))  # -> Breps, Closed
geo_15 = Geometry(sdiff_2)

# ---- group: checkerboard
# this needs to stay under 1000
point_count_for_basic_no_texture_areas = Slider(12, range=0..60)

cluster_32 = Cluster_47(
    P_2=panel_20,
    P=panel_19,
    relay_3=gate_4.Target7,
    T=panel_34,
    relay_2=number_of_secitons,
    int=control_points_per_section,
    relay=point_count_for_basic_no_texture_areas,
    D_2=panel_36,
    int_3=number_slider_24,
    D=panel_35,
    G_3=toggle_10,
    N=panel_35,
    G_2=toggle_7,
    G=toggle_7)  # -> W, R

panel_52 = Panel(cluster_32.R)

# ----
# vase mode options
# 0 normal single line wall
# 1 omni vase mode
# 2: 2 walls
# 	2.1 vase mode
# 	2.2 2 walls
number_slider_42 = Slider(1, range=0..4)
panel_53 = Panel("curves to vasemode?")
gate_6 = StreamGate(
    Stream=[cluster_29, cluster_25, cluster_27, geo_12, cluster_31, cluster_24, cluster_23.geo_2, cluster_32.W, cluster_28, cluster_30.W, cluster_26],
    Gate=number_slider_42)  # -> Target0, Target1, Target2, Target3

# ---- group: vase mode
cluster_33 = Cluster_62(int=number_slider, geo=gate_6.Target1, P=panel_19)

# ---- group: single wall no vase mode
geo_16 = Geometry(gate_6.Target0)

# ----
# true makes the curves smooth, false leaves them as jagged poly lines
geo_17 = Geometry([geo_16, cluster_33])
gate_7 = StreamGate(Stream=geo_17, Gate=Toggle(True))  # -> Target0, Target1

# ---- group: turning polylines to smooth interpolated curves
cluster_34 = Cluster_12(C=gate_7.Target1)  # -> flatten(T)

# ----
geo_18 = Geometry([cluster_34, gate_7.Target0])

merge_2 = Merge(Data1=flatten(cluster_22), Data2=flatten(geo_18))  # -> flatten(Result)
panel_54 = Panel(merge_2)

# ----
# alows to change the location based off printer,
# delta and potterbot auto locate the rest do not
cluster_35 = Cluster_33(relay=merge_2, F=number_slider, C=merge_2, X=number_slider_37, Y=Slider(150, range=0..400))

# ----
# 0 = prusa (.4 mm nozzle, .2 layer height)
# 1= ender (1.0mm nozzle, .5mm layer hieght)
# 2=delta clay printer(3.5mm nozzle)(auto zeros, but alows for z hieght for base material)
# 3=bambu p1s(.4mm nozzle,.2 layer hieght)
# 4= potter bot()
# 5=current null value to save time re generating code
number_slider_43 = Slider(2, range=0..10)
panel_55 = Panel("printer type")
gate_8 = StreamGate(Stream=merge_2, Gate=number_slider_43)  # -> Target0, Target1, Target2, Target3, Target4, Target5

# ---- group: series of curves or single curve prusa slicer
cluster_36 = Cluster(C=gate_8.Target0)
panel_56 = Panel(cluster_36)

# ---- group: ender 3 slicer
cluster_37 = Cluster_2(C=gate_8.Target1)

# ---- group: bambu / bambu p1s slicer not sur if its compatibel with other bambus
cluster_38 = Cluster_6(C=gate_8.Target3)

# ---- group: clay
cluster_39 = Cluster_13(crv=gate_8.Target2, num=number_slider, A=panel_41, B=number_slider_39)

# ---- group: potter bot
# the potter bot has a natral base layer of +2mm that is already included but if you put something on top you can adjsut it with this
cluster_40 = Cluster_15(crv=gate_8.Target4, F=number_slider, A=panel_40, B=number_slider, B_2=number_slider_38)

# ---- group: ender 3 slicer
panel_57 = Panel(cluster_37)

# ---- group: clay / clay 3d printer, auto centers around 0
# nozzle number, diameter, layerhieght, extrusion multiplier
# 
# 6,?,2,9
# 3,3,1.5,9(initial test super soft)
panel_58 = Panel(cluster_39)

# ---- group: potter bot / clay 3d printer, auto centers around 0
panel_59 = Panel(cluster_40)

# ---- group: bambu
panel_60 = Panel(cluster_38)

# ==== cluster Cluster
C = ClusterInput()
bbox = BoundingBox(Content=C, Plane=PlaneXY(0, 0, 0), UnionBox=True)  # -> Box, Box_2
debrep = DeconstructBrep(Brep=bbox.Box)  # -> Faces, Edges, Vertices
topoly = CurveToPolyline(Curve=C, ToleranceDistance=Slider(0.01, range=0..1), ToleranceAngle=0)  # -> Polyline, Segments
item = ListItem(List=debrep.Edges, Index=0, Wrap=True)  # -> Item, Item1
sort_pt = SortPoints(Points=debrep.Vertices)  # -> Points, Indices
len = Length(Curve=item.Item)
len_2 = Length(Curve=item.Item)
item_2 = ListItem(List=sort_pt.Points, Index=0, Wrap=True)  # -> Item, Item1
expression = Expression(
    x=item_2.Item,
    y=item_2.Item1,
    z=len,
    u=len_2,
    Expression="Format(\"M555 X{0} Y{1} W{2} H{3}\",round(x,4),round(y,4),round(z,4),round(u,4))")

extrusion_width = Slider(0.6, range=0..1)
layerhieght = Slider(0.2, range=0..1)
expression_2 = Expression(W=extrusion_width, H=layerhieght, Expression="(W - H) * H  + π * (H / 2)²")
num = Number(expression_2)

crv = Curve(topoly.Polyline)
mesh_bed_leveling = Panel("""; MBL
;
M84 E ; turn off E motor
G29 P1 ; invalidate mbl & probe print area
G29 P1 X0 Y0 W50 H20 C ; probe near purge place
G29 P3.2 ; interpolate mbl probes
G29 P3.13 ; extrapolate mbl outside probe area
G29 A ; activate mbl""")
prepare_to_purge = Panel("""; prepare for purge
M104 S230
G0 X0 Y-4 Z15 F4800 ; move away and ready for the purge
M109 S230

G92 E0
M569 S0 E ; set spreadcycle mode for extruder""")
st_print_temps_to_purge = Panel("""G90 ; use absolute coordinates
M83 ; extruder relative mode
M140 S60 ; set bed temp
M104 T0 S170 ; set extruder temp for bed leveling
M109 T0 R170 ; wait for temp
M84 E ; turn off E motor
G28 ; home all without mesh bed level
G1 X42 Y-4 Z5 F4800
M302 S160 ; lower cold extrusion limit to 160C
G1 E-2 F2400 ; retraction
M84 E ; turn off E motor
G29 P9 X10 Y-4 W32 H4
M106 S100
G0 Z40 F10000
M190 S60 ; wait for bed temp
M107""")
extrude_purgeline = Panel("""; Extrude purge line
;
G92 E0 ; reset extruder position
G1 E2 F2400 ; deretraction after the initial one before nozzle cleaning
G0 E7 X15 Z0.2 F500 ; purge
G0 X25 E4 F500 ; purge
G0 X35 E4 F650 ; purge
G0 X45 E4 F800 ; purge
G0 X48 Z0.05 F8000 ; wipe, move close to the bed
G0 X51 Z0.2 F8000 ; wipe, move quickly away from the bed""")
start_code = Panel("""G92 E0
M221 S100 ; set flow to 100%
G21 ; set units to millimeters
G90 ; use absolute coordinates
M83 ; use relative distances for extrusion""")
set_print_temp_to_205 = Panel(";M109 S205")
global_prusa_settings = Panel("""M201 X4000 Y4000 Z200 E2500 ; sets maximum accelerations, mm/sec^2
M203 X300 Y300 Z40 E100 ; sets maximum feedrates, mm / sec
M204 P4000 R1200 T4000 ; sets acceleration (P, T) and retract acceleration (R), mm/sec^2
M205 X8.00 Y8.00 Z2.00 E10.00 ; sets the jerk limits, mm/sec
M205 S0 T0 ; sets the minimum extruding and travel feed rate, mm/sec
M17 ; enable steppers""")
endocde = Panel("""G1 Z180 F720 ; Move print head up
M104 S0 ; turn off temperature
M140 S0 ; turn off heatbed
M107 ; turn off fan
G1 X241 Y170 F3600 ; park
G1 Z180 F300 ; Move print head up
G4 ; wait
M572 S0 ; reset PA


M84 X Y E ; disable motors""")
mbl_area = Panel(expression)
explode = Explode(Curve=crv, Recursive=True)  # -> Segments, Vertices
cp = ControlPoints(Curve=crv)  # -> Points, Weights, Knots
len_3 = Length(Curve=explode.Segments)
ins = InsertItems(List=len_3, Item="0", Indices="0", Wrap=True)
pdecon = Deconstruct(Point=cp.Points)  # -> XComponent, YComponent, ZComponent
addition = Addition(A=pdecon.ZComponent, B=layerhieght)
panel = Panel(addition)
item_3 = ListItem(List=addition, Index=0, Wrap=True)
panel_2 = Panel(item_3)
item_4 = ListItem(List=addition, Index=0, Wrap=True)
retraction_distance = Slider(0.1, range=0..1)
expression_3 = Expression(A=num, x=Slider(0.75, range=0..2), L=ins, d=Slider(1.75, range=0..10), Expression="(A * L * 4) / (π * d²* x)")
addition_2 = Addition(A=retraction_distance, B=item_3)
expression_4 = Expression(z=item_4, f=Slider(700, range=0..1000), Expression="Format(\"G1 Z{0} F{1}\", round(z,4), round(f,4))")
expression_5 = Expression(z=addition_2, f=Slider(1800, range=0..10000), Expression="Format(\"G1 Z{0} F{1}\", round(z,4), round(f,4))")
lng = ListLength(List=flatten(addition_2))
lng_2 = ListLength(List=flatten(item_4))
repeat = RepeatData(Data="G1 E -.07 F2100", Length=lng)
repeat_2 = RepeatData(Data="G1 E .07 F1500", Length=lng_2)
concat = Concatenate(
    FragmentA="G1 ",
    FragmentB="F800",
    FragmentC=" X",
    FragmentD=pdecon.XComponent,
    FragmentE=" Y",
    FragmentF=pdecon.YComponent,
    FragmentG=" Z",
    FragmentH=addition,
    FragmentI=" E",
    FragmentJ=expression_3)
merge = Merge(Data1=simplify(graft(repeat)), Data2=simplify(expression_5))
merge_2 = Merge(Data1=simplify(graft(repeat_2)), Data2=simplify(expression_4))
panel_3 = Panel("standard is 1200")
panel_4 = Panel(merge_2)
panel_5 = Panel(merge)
ins_2 = InsertItems(List=concat, Item=panel_5, Indices=1, Wrap=True)
panel_6 = Panel(ins_2)
ins_3 = InsertItems(List=ins_2, Item=panel_4, Indices=-1, Wrap=True)
panel_7 = Panel(ins_3)
merge_3 = Merge(
    Data1=flatten(global_prusa_settings),
    Data2=flatten(mbl_area),
    Data3=flatten(st_print_temps_to_purge),
    Data4=flatten(mesh_bed_leveling),
    Data5=flatten(prepare_to_purge),
    Data6=flatten(extrude_purgeline),
    Data7=flatten(start_code),
    Data8=flatten(set_print_temp_to_205),
    Data9=flatten(panel_7),
    Data10=flatten(endocde))
R = ClusterOutput(merge_3)

# ==== cluster Cluster_2
C = ClusterInput()
topoly = CurveToPolyline(Curve=C, ToleranceDistance=Slider(0.01, range=0..1), ToleranceAngle=0)  # -> Polyline, Segments

# ----
# endocde: G1 Z41 F720 ; Move print head up
# M104 S0 ; turn off temperature
# M140 S0 ; turn off heatbed
# M107 ; turn off fan
# G1 X241 Y170 F3600 ; park
# G1 Z63 F300 ; Move print head up
# G4 ; wait
# M572 S0 ; reset PA
# 
# 
# M84 X Y E ; disable motors
layerhieght = Slider(0.5, range=0..1)
extrusion_width = Slider(3, range=0..4)
expression = Expression(W=extrusion_width, H=layerhieght, Expression="(W - H) * H  + π * (H / 2)²")
num = Number(expression)

explode = Explode(Curve=topoly.Polyline, Recursive=True)  # -> Segments, Vertices
cp = ControlPoints(Curve=topoly.Polyline)  # -> Points, Weights, Knots
len = Length(Curve=explode.Segments)
pdecon = Deconstruct(Point=cp.Points)  # -> XComponent, YComponent, ZComponent
ins = InsertItems(List=len, Item="0", Indices="0", Wrap=True)
addition = Addition(A=pdecon.ZComponent, B=layerhieght)
panel = Panel(addition)
item = ListItem(List=addition, Index=0, Wrap=True)
panel_2 = Panel(item)
item_2 = ListItem(List=addition, Index=0, Wrap=True)
retraction_distance = Slider(0.1, range=0..1)
expression_2 = Expression(A=num, x=Slider(1.08, range=0..2), L=ins, d=Slider(1.75, range=0..10), Expression="(A * L * 4) / (π * d²* x)")
addition_2 = Addition(A=retraction_distance, B=item)
expression_3 = Expression(z=addition_2, f=Slider(1800, range=0..10000), Expression="Format(\"G1 Z{0} F{1}\", round(z,4), round(f,4))")
expression_4 = Expression(z=item_2, f=Slider(700, range=0..1000), Expression="Format(\"G1 Z{0} F{1}\", round(z,4), round(f,4))")
lng = ListLength(List=flatten(addition_2))
lng_2 = ListLength(List=flatten(item_2))
repeat = RepeatData(Data="G1 E -.07 F2100", Length=lng)
repeat_2 = RepeatData(Data="G1 E .07 F1500", Length=lng_2)
concat = Concatenate(
    FragmentA="G1 ",
    FragmentB="F750",
    FragmentC=" X",
    FragmentD=pdecon.XComponent,
    FragmentE=" Y",
    FragmentF=pdecon.YComponent,
    FragmentG=" Z",
    FragmentH=addition,
    FragmentI=" E",
    FragmentJ=expression_2)
merge = Merge(Data1=simplify(graft(repeat)), Data2=simplify(expression_3))
merge_2 = Merge(Data1=simplify(graft(repeat_2)), Data2=simplify(expression_4))
panel_3 = Panel(merge)
panel_4 = Panel(merge_2)
ins_2 = InsertItems(List=concat, Item=panel_3, Indices=1, Wrap=True)
panel_5 = Panel("""G1 F1500 E694.26767
M140 S0
M107
G91 ;Relative positioning
G1 E-2 F2700 ;Retract a bit
G1 E-2 Z0.2 F2400 ;Retract and raise Z
G1 X5 Y5 F3000 ;Wipe out
G1 Z10 ;Raise Z more
G90 ;Absolute positioning

G1 X0 Y300.0 ;Present print
M106 S0 ;Turn-off fan
M104 S0 ;Turn-off hotend
M140 S0 ;Turn-off bed

M84 X Y E ;Disable all steppers but Z

M82 ;absolute extrusion mode
M104 S0
;End of Gcode""")
panel_6 = Panel(ins_2)
ins_3 = InsertItems(List=ins_2, Item=panel_4, Indices=-1, Wrap=True)
enderslicer = Panel(ins_3)
panel_7 = Panel("""M140 S60
M105
M190 S60
M104 S220
M105
M109 S220
M83 ;relative extrusion mode
M413 S0
G92 E0
G92 E0
G1 F1500 E-6.5
;LAYER_COUNT:9
;LAYER:0
M107
G0 F6000 X127.7 Y123.277 Z0.32""")
merge_3 = Merge(Data1=flatten(panel_7), Data2=flatten(enderslicer), Data3=flatten(panel_5))
R = ClusterOutput(merge_3)

# ==== cluster Cluster_3
number_slider = Slider(27, range=0..40)
crv = ClusterInput()
B = ClusterInput()
crv_2 = Curve(crv)
lng = ListLength(List=crv_2)
cp = ControlPoints(Curve=crv_2)  # -> Points, Weights, Knots
dom = ConstructDomain(DomainStart=0, DomainEnd=B)
lng_2 = ListLength(List=cp.Points)  # -> flatten(Length)
item = ListItem(List=lng_2, Index=0, Wrap=True)
lng_3 = ListLength(List=cp.Points)
panel = Panel(cp.Points)
range = Range(Domain=dom, Steps=expr("x-1", number_slider))
panel_2 = Panel(lng_3)
Z = UnitZ(Factor=range)
subtraction = Subtraction(A=item, B=number_slider)
split = SplitList(List=cp.Points, Index=subtraction)  # -> ListA, ListB
cull_i = CullIndex(List=split.ListA, Indices=[0, 1, 2], Wrap=True)  # -> flatten(List)
lng_4 = ListLength(List=cull_i)
division = Division(A=lng_4, B=lng)
repeat = RepeatData(Data="true", Length=number_slider)
repeat_2 = RepeatData(Data="false", Length=division)
move = Move(Geometry=split.ListB, Motion=Z)  # -> flatten(Geometry), Transform
merge = Merge(Data1=repeat_2, Data2=repeat)
panel_3 = Panel(merge)
weave = Weave(Pattern=panel_3, Stream0=cull_i, Stream1=move.Geometry, NullGaps=False)
cullpt = CullDuplicates(Points=weave, Tolerance=0.1, CullMode=3)  # -> Points, Indices, Valence
nurbs = NurbsCurve(Vertices=cullpt.Points, Degree=3, Periodic=False)  # -> Curve, Length, Domain
geo = Geometry(nurbs.Curve)
C = ClusterOutput(nurbs.Curve)

# ==== cluster Cluster_4
L = ClusterInput()
L_2 = ClusterInput()
item = ListItem(List=L, Index=-1, Wrap=True)
item_2 = ListItem(List=L_2, Index=0, Wrap=True)
i = ClusterOutput(item)
bottom_crv = Curve(item_2)
C = ClusterInput()
topoly = CurveToPolyline(Curve=C, ToleranceDistance=Slider(0.1, range=0..0.1), ToleranceAngle=0)  # -> Polyline, Segments
pcen = PolygonCenter(Polyline=topoly.Polyline)  # -> CenterV, CenterE, CenterA
area = Area(Geometry=bottom_crv)  # -> Area, Centroid
pdecon = Deconstruct(Point=pcen.CenterE)  # -> XComponent, YComponent, ZComponent
pdecon_2 = Deconstruct(Point=area.Centroid)  # -> XComponent, YComponent, ZComponent
B = ClusterInput()
division = Division(A=pdecon.ZComponent, B=B)
range = Range(Domain=Domain(0, 1), Steps=expr("x-1", division))
B_2 = ClusterInput()
tweencrv = TweenCurve(CurveA=bottom_crv, CurveB=B_2, Factor=range, BlendType=0)
T = ClusterOutput(tweencrv)

# ==== cluster NotesExtraDefintionsArronGaveUs

# ---- group: droopys aaron definition, needs reformating to fit
pt = ConstructPoint(XCoordinate=Slider(126, range=0..220), YCoordinate=Slider(126, range=0..220), ZCoordinate=0)
cir = Circle(Plane=pt, Radius=Slider(35, range=0..100))
cir_2 = Circle(Plane=pt, Radius=Slider(48, range=0..100))
cir_3 = Circle(Plane=pt, Radius=Slider(35, range=0..100))
number_slider = Slider(45, range=0..100)
crv = Curve(cir)
crv_2 = Curve(cir_2)
crv_3 = Curve(cir_3)
number_slider_2 = Slider(10, range=0..10)
divide = DivideCurve(Curve=crv_2, Count=number_slider, Kinks=False)  # -> Points, Tangents, Parameters
divide_2 = DivideCurve(Curve=crv_3, Count=number_slider, Kinks=False)  # -> Points, Tangents, Parameters
panel = Panel("""0
0
0
1
1
1""")
weave = Weave(Pattern=panel, Stream0=divide_2.Points, Stream1=divide.Points, NullGaps=False)
dup = DuplicateData(Data="0", Number=number_slider_2, Order=True)
dup_2 = DuplicateData(Data=crv, Number=number_slider_2, Order=True)
ins = InsertItems(List=dup, Item="1", Indices="-1", Wrap=True)
nurbs = NurbsCurve(Vertices=weave, Degree=3, Periodic=Toggle(True))  # -> Curve, Length, Domain
weave_2 = Weave(Pattern=ins, Stream0=dup_2, Stream1=nurbs.Curve, NullGaps=False)
repeat = RepeatData(Data=weave_2, Length=Slider(100, range=0..100))
lng = ListLength(List=repeat)
series = Series(Start=0, Step=Slider(0.2, range=0..1), Count=lng)
Z = UnitZ(Factor=series)
move = Move(Geometry=repeat, Motion=Z)  # -> Geometry, Transform
topoly = CurveToPolyline(Curve=move.Geometry, ToleranceDistance=Slider(0.01, range=0..0.01), ToleranceAngle=0)  # -> Polyline, Segments

# ---- group: in progress rotateidea, probably just want to change it too take a list of curves then somehting maybe an attractor
crv_4 = Curve(<curve referenced from the Rhino model>)
crv_5 = Curve([<curve referenced from the Rhino model> x2])
crv_6 = Curve(<curve referenced from the Rhino model>)
series_2 = Series(Start=0, Step=Slider(0.2, range=0..1), Count=Slider(350, range=0..400))
Z_2 = UnitZ(Factor=series_2)
Z_3 = UnitZ(Factor=series_2)
Z_4 = UnitZ(Factor=series_2)
move_2 = Move(Geometry=crv_4, Motion=Z_2)  # -> Geometry, Transform
move_3 = Move(Geometry=crv_6, Motion=Z_3)  # -> Geometry, Transform
move_4 = Move(Geometry=crv_5, Motion=Z_4)  # -> Geometry, Transform
merge = Merge(Data1=move_4.Geometry, Data2=move_3.Geometry, Data3=move_2.Geometry)
area = Area(Geometry=merge)  # -> Area, Centroid
pdecon = Deconstruct(Point=area.Centroid)  # -> XComponent, YComponent, ZComponent
sort = SortList(Keys=pdecon.ZComponent, ValuesA=merge)  # -> Keys, ValuesA
lng_2 = ListLength(List=sort.ValuesA)
area_2 = Area(Geometry=sort.ValuesA)  # -> Area, Centroid
series_3 = Series(Start=0, Step=1, Count=lng_2)
rotate = Rotate(Geometry=sort.ValuesA, Angle=degrees(series_3), Plane=area_2.Centroid)  # -> Geometry, Transform

# ----
crazy_sputnik_idea = CrazySputnikIdea()

# ---- group: vase from surface
md_slider = MDSlider(SliderMode=0, slider_value=Point(0.5, 0.5, 0.5), x_domain=Domain(0, 1), y_domain=Domain(0, 1), z_domain=Domain(0, 1))
srf = Surface(reparameterize(<surface referenced from the Rhino model>))
iso = IsoCurve(Surface=srf, UVPoint=md_slider)  # -> UIsocurve, VIsocurve
divdist = DivideDistance(Curve=iso.UIsocurve, Distance=Slider(0.5, range=0..1))  # -> Points, Tangents, Parameters
srf_cp = SurfaceClosestPoint(Point=divdist.Points, Surface=srf)  # -> Point, UVPoint, Distance
number_slider_3 = Slider(87, range=0..300)
iso_2 = IsoCurve(Surface=srf, UVPoint=srf_cp.UVPoint)  # -> UIsocurve, VIsocurve
divide_3 = DivideCurve(Curve=iso_2.VIsocurve, Count=number_slider_3, Kinks=False)  # -> Points, Tangents, Parameters
flip = FlipMatrix(Data=divide_3.Points)
pline = PolyLine(Vertices=flip, Closed=False)
explode = Explode(Curve=pline, Recursive=True)  # -> Segments, Vertices
dom = ConstructDomain(DomainStart=0, DomainEnd=1)
end = EndPoints(Curve=explode.Segments)  # -> Start, End
vec2pt = Vector2Pt(PointA=end.Start, PointB=end.End, Unitize=False)  # -> Vector, Length
range = Range(Domain=dom, Steps=expr("x-1", number_slider_3))
flip_2 = FlipMatrix(Data=vec2pt.Vector)
multiplication = Multiplication(A=flip_2, B=range)
move_5 = Move(Geometry=divide_3.Points, Motion=multiplication)  # -> Geometry, Transform
pline_2 = PolyLine(Vertices=flatten(move_5.Geometry), Closed=False)

# ----
crv_7 = Curve([<curve referenced from the Rhino model> x401])
item = ListItem(List=crv_7, Index=Slider(238, range=0..400), Wrap=True)
cull_i = CullIndex(List=crv_7, Indices=Slider(0, range=0..1000), Wrap=True)  # -> reverse(List)
Z_5 = UnitZ(Factor=Slider(0.2, range=0..1))
move_6 = Move(Geometry=crv_7, Motion=Z_5)  # -> Geometry, Transform

# ==== cluster Cluster_6
C = ClusterInput()
topoly = CurveToPolyline(Curve=C, ToleranceDistance=Slider(0.28, range=0..1), ToleranceAngle=0)  # -> Polyline, Segments

layerhieght = Slider(0.2, range=0..1)
extrusion_width = Slider(3, range=0..4)
expression = Expression(W=extrusion_width, H=layerhieght, Expression="(W - H) * H  + π * (H / 2)²")
num = Number(expression)

explode = Explode(Curve=topoly.Polyline, Recursive=True)  # -> Segments, Vertices
cp = ControlPoints(Curve=topoly.Polyline)  # -> Points, Weights, Knots
len = Length(Curve=explode.Segments)
pdecon = Deconstruct(Point=cp.Points)  # -> XComponent, YComponent, ZComponent
ins = InsertItems(List=len, Item="0", Indices="0", Wrap=True)
addition = Addition(A=pdecon.ZComponent, B=layerhieght)
panel = Panel(addition)
item = ListItem(List=addition, Index=0, Wrap=True)
panel_2 = Panel(item)
item_2 = ListItem(List=addition, Index=0, Wrap=True)
retraction_distance = Slider(0.1, range=0..1)
expression_2 = Expression(A=num, x=Slider(1.08, range=0..2), L=ins, d=Slider(1.75, range=0..10), Expression="(A * L * 4) / (π * d²* x)")
addition_2 = Addition(A=retraction_distance, B=item)
expression_3 = Expression(z=addition_2, f=Slider(1800, range=0..10000), Expression="Format(\"G1 Z{0} F{1}\", round(z,4), round(f,4))")
expression_4 = Expression(z=item_2, f=Slider(700, range=0..1000), Expression="Format(\"G1 Z{0} F{1}\", round(z,4), round(f,4))")
lng = ListLength(List=flatten(addition_2))
lng_2 = ListLength(List=flatten(item_2))
repeat = RepeatData(Data="G1 E -.07 F2100", Length=lng)
repeat_2 = RepeatData(Data="G1 E .07 F1500", Length=lng_2)
concat = Concatenate(
    FragmentA="G1 ",
    FragmentB="F850",
    FragmentC=" X",
    FragmentD=pdecon.XComponent,
    FragmentE=" Y",
    FragmentF=pdecon.YComponent,
    FragmentG=" Z",
    FragmentH=addition,
    FragmentI=" E",
    FragmentJ=expression_2)
merge = Merge(Data1=simplify(graft(repeat)), Data2=simplify(expression_3))
merge_2 = Merge(Data1=simplify(graft(repeat_2)), Data2=simplify(expression_4))
panel_3 = Panel(merge)
panel_4 = Panel(merge_2)
ins_2 = InsertItems(List=concat, Item=panel_3, Indices=1, Wrap=True)
panel_5 = Panel(ins_2)
ins_3 = InsertItems(List=ins_2, Item=panel_4, Indices=-1, Wrap=True)
enderslicer = Panel(ins_3)
end_gcode = Panel("""; ==== End of Print: Safe shutdown sequence ====

M400                         ; Wait for motion buffer to clear
G92 E0                       ; Reset extruder position
G1 E-0.8 F1800               ; Retract filament slightly
G1 Z{max_layer_z + 0.5} F900 ; Raise Z slightly above last printed layer
G1 X65 Y245 F12000           ; Move to safe wipe zone
G1 Y265 F3000                ; Final wipe motion

; ==== Repeat wipe motion (optional safety loop) ====
G1 X65 Y245 F12000
G1 Y265 F3000

; ==== Turn off heaters and fans ====
M140 S0                      ; Turn off heated bed
M106 S0                      ; Turn off part cooling fan
M106 P2 S0                   ; Turn off remote fan
M106 P3 S0                   ; Turn off chamber fan

; ==== Wipe and pull back filament for AMS ====
G1 X100 F12000               ; Wipe motion
M620 S255                    ; Notify AMS to begin unload from Tool 0
G1 X20 Y50 F12000
G1 Y-3
T255                         ; Switch to virtual tool (AMS unload target)
G1 X65 F12000
G1 Y265
G1 X100 F12000               ; Final wipe
M621 S255                    ; Confirm unload complete

M104 S0                      ; Turn off hotend heater

; ==== Optional: Timelapse logic (safe to remove on non-Bambu printers) ====
; Removed: M622.1 S1, M991 S0, etc. — Bambu-only timelapse logic

; ==== Safe Z-lift to avoid crashing on shutdown ====
M400                         ; Wait for all motion to complete
M17 S                        ; (Optional) Sync stepper state
M17 Z0.4                     ; Lower Z current in case of bed contact

; ==== Raise Z high if safe to do so ====
{if (max_layer_z + 100.0) < 250}
    G1 Z{max_layer_z + 100.0} F600
    G1 Z{max_layer_z + 98.0}
{else}
    G1 Z250 F600
    G1 Z248
{endif}
M400 P100                    ; Delay briefly
M17 R                        ; Restore Z motor current

; ==== Reset printer state for next job ====
M220 S100                    ; Reset feedrate
M201.2 K1.0                  ; Reset acceleration scaling
M73.2 R1.0                   ; Reset remaining time estimate
M1002 set_gcode_claim_speed_level : 0 ; Reset internal state

; ==== Lower all motor currents for idle mode ====
M17 X0.8 Y0.8 Z0.5           ; Reduce holding current to save energy""")

# ---- group: start gcode it do be a bunch
cluster = Cluster_5()

# ----
merge_3 = Merge(Data1=flatten(cluster), Data2=flatten(enderslicer), Data3=flatten(end_gcode))
R = ClusterOutput(merge_3)

# ==== cluster Cluster_7
crv = ClusterInput()
crv_2 = Curve(crv)
item = ListItem(List=crv_2, Index=-1, Wrap=True)
area = Area(Geometry=item)  # -> Area, Centroid
yz = YZPlane(Origin=area.Centroid)
xy = XYPlane(Origin=area.Centroid)
xz = XZPlane(Origin=area.Centroid)
A = ClusterInput()
rotate = Rotate(Geometry=item, Angle=degrees(A), Plane=xy)  # -> Geometry, Transform
A_2 = ClusterInput()
item_2 = ListItem(List=crv_2, Index=0, Wrap=True)
rotate_2 = Rotate(Geometry=rotate.Geometry, Angle=degrees(A_2), Plane=yz)  # -> Geometry, Transform
A_3 = ClusterInput()
rotate_3 = Rotate(Geometry=rotate_2.Geometry, Angle=degrees(A_3), Plane=xz)  # -> Geometry, Transform
B = ClusterInput()

# ---- group: non planar base code surface to curve
top_crv = Curve(rotate_3.Geometry)
bottom_crv = Curve(item_2)
area_2 = Area(Geometry=bottom_crv)  # -> Area, Centroid
pdecon = Deconstruct(Point=area_2.Centroid)  # -> XComponent, YComponent, ZComponent

# ----
topoly = CurveToPolyline(Curve=top_crv, ToleranceDistance=Slider(0.1, range=0..0.1), ToleranceAngle=0)  # -> Polyline, Segments
pcen = PolygonCenter(Polyline=topoly.Polyline)  # -> CenterV, CenterE, CenterA

# ---- group: non planar base code surface to curve (continued)
pdecon_2 = Deconstruct(Point=pcen.CenterE)  # -> XComponent, YComponent, ZComponent
division = Division(A=pdecon_2.ZComponent, B=B)
range = Range(Domain=Domain(0, 1), Steps=expr("x-1", division))
tweencrv = TweenCurve(CurveA=bottom_crv, CurveB=top_crv, Factor=range, BlendType=0)

# ----
T = ClusterOutput(tweencrv)

# ==== cluster ImagerSmaplerDirectlyOntoSurface
gate = StreamGate(Gate=Slider(1, range=0..1))  # -> Target0, Target1
# the non planar bassically voids the image i would recomend dont use both
# 
# 
# also if the image has a bit of noise the srface grid can create a non closed  surface so its a bit iffy
panel = Panel("image?")

# ---- group: image sampler
cluster = Cluster_8(srf=gate.Target0)

# ==== cluster Cluster_9

# ==== cluster Cluster_11
# creates a shape which oyu can identify where the cross sections are
C = ClusterInput()
C_2 = ClusterInput()
topoly = CurveToPolyline(Curve=C, ToleranceDistance=Slider(0.1, range=0..0.1), ToleranceAngle=0)  # -> Polyline, Segments
pcen = PolygonCenter(Polyline=topoly.Polyline)  # -> CenterV, CenterE, CenterA
pdecon = Deconstruct(Point=pcen.CenterE)  # -> XComponent, YComponent, ZComponent
item = ListItem(List=C_2, Index=0, Wrap=True)
flip = FlipCurve(Curve=C_2, Guide=item)  # -> Curve, Flag
sort = SortList(Keys=pdecon.ZComponent, ValuesA=flip.Curve)  # -> Keys, ValuesA

# ---- group: get rid of the first value
cull_i = CullIndex(List=sort.ValuesA, Indices=0, Wrap=True)  # -> graft(List)

# ----
cull_i_2 = CullIndex(List=sort.ValuesA, Indices=-1, Wrap=True)  # -> graft(List)
cluster = Cluster_10(C=cull_i)
cluster_2 = Cluster_10(C=cull_i_2)
B = ClusterInput()
subtraction = Subtraction(A=cluster, B=cluster_2)
division = Division(A=subtraction, B=B)
range = Range(Domain=Domain(0, 1), Steps=division)
panel = Panel(range)
cull_i_3 = CullIndex(List=range, Indices=-1, Wrap=True)
tweencrv = TweenCurve(CurveA=cull_i_2, CurveB=cull_i, Factor=cull_i_3, BlendType=0)  # -> flatten(Tween)
G = ClusterInput()
filter = StreamFilter(Gate=G, Stream4=tweencrv)
s_5 = ClusterOutput(filter)

# ==== cluster Cluster_12
C = ClusterInput()
cp = ControlPoints(Curve=C)  # -> Points, Weights, Knots
intcrv = Interpolate(Vertices=cp.Points, Degree=3, Periodic=False, KnotStyle=2)  # -> Curve, Length, Domain
clean = CleanTree(RemoveNulls=True, RemoveInvalid=True, RemoveEmpty=True, Tree=intcrv.Curve)
T = ClusterOutput(clean)

# ==== cluster Cluster_13
crv = ClusterInput()

# ---- group: centering everyhting around 0
crv_2 = Curve(crv)
bbox = BoundingBox(Content=crv_2, Plane=PlaneXY(0, 0, 0), UnionBox=True)  # -> Box, Box_2
panel = Panel("""0
1
2
3""")
debrep = DeconstructBrep(Brep=bbox.Box)  # -> Faces, Edges, Vertices
item = ListItem(List=debrep.Edges, Index=panel, Wrap=True)
join = JoinCurves(Curves=item, Preserve=False)
area = Area(Geometry=join)  # -> Area, Centroid
pt = Point(Point(0, 0, 0))
vec2pt = Vector2Pt(PointA=area.Centroid, PointB=pt, Unitize=False)  # -> Vector, Length
move = Move(Geometry=crv_2, Motion=vec2pt.Vector)  # -> Geometry, Transform

# ----
num = ClusterInput()
A = ClusterInput()
multiplication = Multiplication(A=A, B=1)
num_2 = Number(num)
addition = Addition(A=num_2, B=multiplication)
Z = UnitZ(Factor=addition)
move_2 = Move(Geometry=move.Geometry, Motion=Z)  # -> Geometry, Transform
explode = Explode(Curve=move_2.Geometry, Recursive=True)  # -> Segments, Vertices
len = Length(Curve=explode.Segments)
ma = MassAddition(Input=flatten(len))  # -> Result, PartialResults
panel_2 = Panel(ma.Result)
division = Division(A=ma.Result, B=Slider(900, range=0..1000))
panel_3 = Panel(division)
topoly = CurveToPolyline(Curve=move_2.Geometry, ToleranceDistance=Slider(0.1, range=0..1), ToleranceAngle=0)  # -> Polyline, Segments
explode_2 = Explode(Curve=topoly.Polyline, Recursive=True)  # -> Segments, Vertices
cp = ControlPoints(Curve=topoly.Polyline)  # -> Points, Weights, Knots
len_2 = Length(Curve=explode_2.Segments)
pdecon = Deconstruct(Point=cp.Points)  # -> XComponent, YComponent, ZComponent
panel_4 = Panel(pdecon.ZComponent)
ins = InsertItems(List=len_2, Item="0", Indices="0", Wrap=True)
item_2 = ListItem(List=pdecon.ZComponent, Index=-1, Wrap=True)
item_3 = ListItem(List=pdecon.ZComponent, Index=0, Wrap=True)
panel_5 = Panel(item_3)
panel_6 = Panel(item_2)
retraction_distance = Slider(0.1, range=0..1)
B = ClusterInput()
multiplication_2 = Multiplication(A=ins, B=B)
addition_2 = Addition(A=retraction_distance, B=item_3)
expression = Expression(z=addition_2, f=Slider(1800, range=0..10000), Expression="Format(\"G1 Z{0} F{1}\", round(z,4), round(f,4))")
lng = ListLength(List=flatten(addition_2))
expression_2 = Expression(z=item_2, f=Slider(700, range=0..1000), Expression="Format(\"G1 Z{0} F{1}\", round(z,4), round(f,4))")
lng_2 = ListLength(List=flatten(item_2))
repeat = RepeatData(Data="G1 E -.07 F2100", Length=lng)
repeat_2 = RepeatData(Data="G1 E .07 F1500", Length=lng_2)
concat = Concatenate(
    FragmentA="G1 ",
    FragmentB="F900",
    FragmentC=" X",
    FragmentD=pdecon.XComponent,
    FragmentE=" Y",
    FragmentF=pdecon.YComponent,
    FragmentG=" Z",
    FragmentH=pdecon.ZComponent,
    FragmentI=" E",
    FragmentJ=multiplication_2)
merge = Merge(Data1=simplify(graft(repeat)), Data2=simplify(expression))  # -> flatten(Result)
merge_2 = Merge(Data1=simplify(graft(repeat_2)), Data2=simplify(expression_2))  # -> flatten(Result)
panel_7 = Panel(concat)
partition = PartitionList(List=merge, Size=2)
partition_2 = PartitionList(List=merge_2, Size=2)
panel_8 = Panel(partition)
panel_9 = Panel(partition_2)
ins_2 = InsertItems(List=concat, Item=panel_8, Indices=1, Wrap=True)
ins_3 = InsertItems(List=ins_2, Item=panel_9, Indices=-1, Wrap=True)
enderslicer = Panel(ins_3)
panel_10 = Panel(""";start gcode
G28 ; home all axes
G1 Z5 F5000 ; lift nozzle
M104 S0 ; turn off temperature
M302 S0
M163 S0 P0.50
M163 S1 P0.50
M164 S1 ; Saves 50/50 mix as preset S1
M83""")
panel_11 = Panel(""";end code
M104 S0 ; turn off temperature
G28 ; home all axes""")
merge_3 = Merge(Data1=flatten(panel_10), Data2=flatten(enderslicer), Data3=flatten(panel_11))
R = ClusterOutput(merge_3)
panel_12 = Panel(merge_3)

# ==== cluster Cluster_15
crv = ClusterInput()
crv_2 = Curve(crv)
F = ClusterInput()
Z = UnitZ(Factor=expr("x*-1", F))
move = Move(Geometry=crv_2, Motion=Z)  # -> Geometry, Transform
A = ClusterInput()
cluster = Cluster_14(C=crv_2, G=crv_2)
multiplication = Multiplication(A=A, B=1)
Z_2 = UnitZ(Factor=multiplication)
move_2 = Move(Geometry=move.Geometry, Motion=Z_2)  # -> Geometry, Transform
topoly = CurveToPolyline(Curve=move_2.Geometry, ToleranceDistance=Slider(0.28, range=0..1), ToleranceAngle=0)  # -> Polyline, Segments
explode = Explode(Curve=topoly.Polyline, Recursive=True)  # -> Segments, Vertices
cp = ControlPoints(Curve=topoly.Polyline)  # -> Points, Weights, Knots
len = Length(Curve=explode.Segments)
B = ClusterInput()
pdecon = Deconstruct(Point=cp.Points)  # -> XComponent, YComponent, ZComponent
ins = InsertItems(List=len, Item="0", Indices="0", Wrap=True)
addition = Addition(A=pdecon.ZComponent, B=B)
panel = Panel(addition)
item = ListItem(List=addition, Index=0, Wrap=True)
panel_2 = Panel(item)
item_2 = ListItem(List=addition, Index=0, Wrap=True)
retraction_distance = Slider(0.1, range=0..1)
B_2 = ClusterInput()
multiplication_2 = Multiplication(A=ins, B=B_2)
addition_2 = Addition(A=retraction_distance, B=item)
expression = Expression(z=addition_2, f=Slider(1800, range=0..10000), Expression="Format(\"G1 Z{0} F{1}\", round(z,4), round(f,4))")
expression_2 = Expression(z=item_2, f=Slider(700, range=0..1000), Expression="Format(\"G1 Z{0} F{1}\", round(z,4), round(f,4))")
lng = ListLength(List=flatten(addition_2))
lng_2 = ListLength(List=flatten(item_2))
repeat = RepeatData(Data="G1 E -.07 F2100", Length=lng)
repeat_2 = RepeatData(Data="G1 E .07 F1500", Length=lng_2)
concat = Concatenate(
    FragmentA="G1 ",
    FragmentB="F3000",
    FragmentC=" X",
    FragmentD=pdecon.XComponent,
    FragmentE=" Y",
    FragmentF=pdecon.YComponent,
    FragmentG=" Z",
    FragmentH=addition,
    FragmentI=" E",
    FragmentJ=multiplication_2)
merge = Merge(Data1=simplify(graft(repeat)), Data2=simplify(expression))
merge_2 = Merge(Data1=simplify(graft(repeat_2)), Data2=simplify(expression_2))
panel_3 = Panel(merge)
panel_4 = Panel(merge_2)
ins_2 = InsertItems(List=concat, Item=panel_3, Indices=1, Wrap=True)
panel_5 = Panel(ins_2)
ins_3 = InsertItems(List=ins_2, Item=panel_4, Indices=-1, Wrap=True)
potterbot = Panel(ins_3)
panel_6 = Panel(""";;; START GCODE ;;;
M83 ;Set to Relative Extrusion Mode
G28 ;Home
G1 X207.5 Y202.5 Z20 F10000 ;Move X and Y to center, Z to 20mm high
G1 E2000 F20000 ; !!Prime Extruder
G92 E0
;;; ======""")
panel_7 = Panel(""";;; === END GCODE ===
M83 ;Set to Relative Extrusion Mode
G28 Z ;Home Z
; === DEPRESSURIZE ===
G91
G91
G1 E-1300 F4000
G90
G90""")
merge_3 = Merge(Data1=flatten(panel_6), Data2=flatten(potterbot), Data3=flatten(panel_7))
R = ClusterOutput(merge_3)

# ==== cluster Cluster_16
G = ClusterInput()
_0 = ClusterInput()
_1 = ClusterInput()
filter = StreamFilter(Gate=G, Stream0=_0, Stream1=_1)
s_1 = ClusterOutput(filter)

# ==== cluster Cluster_17
L = ClusterInput()
L_2 = ClusterInput()
L_3 = ClusterInput()
x = ClusterInput()
L_4 = ClusterInput()
repeat = RepeatData(Data="False", Length=L)
repeat_2 = RepeatData(Data="False", Length=L_2)
repeat_3 = RepeatData(Data="True", Length=L_3)
expression = Expression(x=x, Expression="1-x")
repeat_4 = RepeatData(Data="True", Length=L_4)
merge = Merge(Data1=repeat_2, Data2=repeat_3)
merge_2 = Merge(Data1=repeat_4, Data2=repeat)
G = ClusterInput()
_1 = ClusterInput()
G_2 = ClusterInput()
filter = StreamFilter(Gate=G, Stream0=merge, Stream1=_1)
filter_2 = StreamFilter(Gate=G_2, Stream0=merge_2, Stream1=expression)
s_0 = ClusterOutput(filter)
s_0_2 = ClusterOutput(filter_2)

# ==== cluster Cluster_18
x = ClusterInput()
L = ClusterInput()
L_2 = ClusterInput()
L_3 = ClusterInput()
L_4 = ClusterInput()
expression = Expression(x=x, Expression="1-x")
repeat = RepeatData(Data="False", Length=L)
repeat_2 = RepeatData(Data="False", Length=L_2)
repeat_3 = RepeatData(Data="True", Length=L_3)
repeat_4 = RepeatData(Data="True", Length=L_4)
merge = Merge(Data1=repeat_2, Data2=repeat_3)
merge_2 = Merge(Data1=repeat_4, Data2=repeat)
G = ClusterInput()
_1 = ClusterInput()
G_2 = ClusterInput()
filter = StreamFilter(Gate=G, Stream0=merge, Stream1=_1)
filter_2 = StreamFilter(Gate=G_2, Stream0=merge_2, Stream1=expression)
s_0 = ClusterOutput(filter)
s_0_2 = ClusterOutput(filter_2)

# ==== cluster Cluster_19
relay = ClusterInput()
domain = ClusterInput()
int = ClusterInput()
loft = Loft(Curves=relay, Options={Adjust=False, Closed=False, LoftEnds=0, LoftSimp=0, LoftType=0, Rebuild=10, Refit=0.01})
domain_2 = Domain(domain)
int_2 = Integer(int)
P = ClusterInput()
dispatch = Dispatch(List=flatten(relay), DispatchPattern=P)  # -> ListA, ListB
geo = Geometry(loft)
P_2 = ClusterInput()
dispatch_2 = Dispatch(List=flatten(dispatch.ListB), DispatchPattern=P_2)  # -> ListA, ListB
G = ClusterInput()
G_2 = ClusterInput()
gate = StreamGate(Stream=dispatch_2.ListA, Gate=G)  # -> Target0, Target1
divide = DivideCurve(Curve=dispatch.ListA, Count=int_2, Kinks=False)  # -> Points, Tangents, Parameters
gate_2 = StreamGate(Stream=dispatch_2.ListB, Gate=G_2)  # -> Target0, Target1
relay_2 = ClusterInput()
divide_2 = DivideCurve(Curve=gate.Target1, Count=int_2, Kinks=False)  # -> Points, Tangents, Parameters
divide_3 = DivideCurve(Curve=gate_2.Target1, Count=int_2, Kinks=False)  # -> Points, Tangents, Parameters
gate_3 = StreamGate(Stream=divide_3.Points, Gate=relay_2)  # -> Target0, Target1
gate_4 = StreamGate(Stream=divide_2.Points, Gate=relay_2)  # -> Target0, Target1
dispatch_3 = Dispatch(List=gate_3.Target0, DispatchPattern=[True, False])  # -> ListA, ListB
C = ClusterInput()
dispatch_4 = Dispatch(List=gate_4.Target0, DispatchPattern=[True, False])  # -> ListA, ListB
C_2 = ClusterInput()
cp = ClosestPoint(Point=[dispatch_4.ListA, gate_4.Target1], Cloud=C)  # -> ClosestPoint, CPIndex, Distance
brep_cp = BrepClosestPoint(Point=[dispatch_3.ListB, gate_3.Target1], Brep=geo)  # -> Point, Normal, Distance
cp_2 = ClosestPoint(Point=[dispatch_3.ListB, gate_3.Target1], Cloud=C_2)  # -> ClosestPoint, CPIndex, Distance
brep_cp_2 = BrepClosestPoint(Point=[dispatch_4.ListA, gate_4.Target1], Brep=geo)  # -> Point, Normal, Distance
bnd = Bounds(Numbers=cp.Distance)
bnd_2 = Bounds(Numbers=cp_2.Distance)
remap = RemapNumbers(Value=cp.Distance, Source=bnd, Target=domain_2)  # -> Mapped, Clipped
remap_2 = RemapNumbers(Value=cp_2.Distance, Source=bnd_2, Target=domain_2)  # -> Mapped, Clipped
amp = Amplitude(Vector=brep_cp_2.Normal, Amplitude=remap.Mapped)
amp_2 = Amplitude(Vector=brep_cp.Normal, Amplitude=remap_2.Mapped)
devec = DeconstructVector(Vector=amp)  # -> XComponent, YComponent, ZComponent
devec_2 = DeconstructVector(Vector=amp_2)  # -> XComponent, YComponent, ZComponent
vec = VectorXYZ(XComponent=devec.XComponent, YComponent=devec.YComponent, ZComponent=0)  # -> Vector, Length
intcrv = Interpolate(Vertices=divide.Points, Degree=3, Periodic=True, KnotStyle=1)  # -> flatten(Curve), Length, Domain
vec_2 = VectorXYZ(XComponent=devec_2.XComponent, YComponent=devec_2.YComponent, ZComponent=0)  # -> Vector, Length
move = Move(Geometry=[dispatch_4.ListA, gate_4.Target1], Motion=vec.Vector)  # -> Geometry, Transform
move_2 = Move(Geometry=[dispatch_3.ListB, gate_3.Target1], Motion=vec_2.Vector)  # -> Geometry, Transform
gate_5 = StreamGate(Stream=move.Geometry, Gate=relay_2)  # -> Target0, Target1
weave = Weave(Pattern=[0, 1], Stream0=gate_5.Target0, Stream1=dispatch_4.ListB, NullGaps=False)
gate_6 = StreamGate(Stream=move_2.Geometry, Gate=relay_2)  # -> Target0, Target1
weave_2 = Weave(Pattern=[0, 1], Stream0=dispatch_3.ListA, Stream1=gate_6.Target0, NullGaps=False)
pline = PolyLine(Vertices=[weave, gate_5.Target1], Closed=True)
pline_2 = PolyLine(Vertices=[weave_2, gate_6.Target1], Closed=True)
P_3 = ClusterInput()
weave_3 = Weave(Pattern=P_3, Stream0=flatten([gate.Target0, pline]), Stream1=flatten([gate_2.Target0, pline_2]), NullGaps=False)
P_4 = ClusterInput()
weave_4 = Weave(Pattern=P_4, Stream0=intcrv.Curve, Stream1=weave_3, NullGaps=False)
W = ClusterOutput(weave_4)

# ==== cluster Cluster_20
geo = ClusterInput()
domain = ClusterInput()
int = ClusterInput()
geo_2 = Geometry(geo)
domain_2 = Domain(domain)
relay = ClusterInput()
int_2 = Integer(int)
loft = Loft(Curves=relay, Options={Adjust=False, Closed=False, LoftEnds=0, LoftSimp=1, LoftType=0, Rebuild=24, Refit=0.01})
geo_3 = Geometry(loft)
P = ClusterInput()
P_2 = ClusterInput()
dispatch = Dispatch(List=flatten(relay), DispatchPattern=P_2)  # -> ListA, ListB
dispatch_2 = Dispatch(List=flatten(dispatch.ListB), DispatchPattern=P)  # -> ListA, ListB
G = ClusterInput()
G_2 = ClusterInput()
gate = StreamGate(Stream=dispatch_2.ListA, Gate=G)  # -> Target0, Target1
gate_2 = StreamGate(Stream=dispatch_2.ListB, Gate=G_2)  # -> Target0, Target1
relay_2 = ClusterInput()
divide = DivideCurve(Curve=gate.Target1, Count=int_2, Kinks=False)  # -> Points, Tangents, Parameters
divide_2 = DivideCurve(Curve=gate_2.Target1, Count=int_2, Kinks=False)  # -> Points, Tangents, Parameters
gate_3 = StreamGate(Stream=divide_2.Points, Gate=relay_2)  # -> Target0, Target1
divide_3 = DivideCurve(Curve=dispatch.ListA, Count=int_2, Kinks=False)  # -> Points, Tangents, Parameters
gate_4 = StreamGate(Stream=divide.Points, Gate=relay_2)  # -> Target0, Target1
dispatch_3 = Dispatch(List=gate_3.Target0, DispatchPattern=[True, False])  # -> ListA, ListB
dispatch_4 = Dispatch(List=gate_4.Target0, DispatchPattern=[True, False])  # -> ListA, ListB
geo_4 = Geometry(gate_3.Target1)
crv_cp = CurveClosestPoint(Point=[dispatch_3.ListB, geo_4], Curve=geo_2)  # -> Point, Parameter, Distance
geo_5 = Geometry(gate_4.Target1)
crv_cp_2 = CurveClosestPoint(Point=[dispatch_4.ListA, geo_5], Curve=geo_2)  # -> Point, Parameter, Distance
intcrv = Interpolate(Vertices=divide_3.Points, Degree=3, Periodic=True, KnotStyle=1)  # -> flatten(Curve), Length, Domain
brep_cp = BrepClosestPoint(Point=[dispatch_3.ListB, geo_4], Brep=geo_3)  # -> Point, Normal, Distance
panel = Panel(intcrv.Curve)
bnd = Bounds(Numbers=crv_cp_2.Distance)
bnd_2 = Bounds(Numbers=crv_cp.Distance)
brep_cp_2 = BrepClosestPoint(Point=[dispatch_4.ListA, geo_5], Brep=geo_3)  # -> Point, Normal, Distance
remap = RemapNumbers(Value=crv_cp_2.Distance, Source=bnd, Target=domain_2)  # -> Mapped, Clipped
remap_2 = RemapNumbers(Value=crv_cp.Distance, Source=bnd_2, Target=domain_2)  # -> Mapped, Clipped
amp = Amplitude(Vector=brep_cp.Normal, Amplitude=remap_2.Mapped)
amp_2 = Amplitude(Vector=brep_cp_2.Normal, Amplitude=remap.Mapped)
devec = DeconstructVector(Vector=amp)  # -> XComponent, YComponent, ZComponent
devec_2 = DeconstructVector(Vector=amp_2)  # -> XComponent, YComponent, ZComponent
vec = VectorXYZ(XComponent=devec.XComponent, YComponent=devec.YComponent, ZComponent=0)  # -> Vector, Length
vec_2 = VectorXYZ(XComponent=devec_2.XComponent, YComponent=devec_2.YComponent, ZComponent=0)  # -> Vector, Length
move = Move(Geometry=[dispatch_3.ListB, geo_4], Motion=vec.Vector)  # -> Geometry, Transform
move_2 = Move(Geometry=[dispatch_4.ListA, geo_5], Motion=vec_2.Vector)  # -> Geometry, Transform
gate_5 = StreamGate(Stream=move.Geometry, Gate=relay_2)  # -> Target0, Target1
gate_6 = StreamGate(Stream=move_2.Geometry, Gate=relay_2)  # -> Target0, Target1
weave = Weave(Pattern=[0, 1], Stream0=dispatch_3.ListA, Stream1=gate_5.Target0, NullGaps=False)
weave_2 = Weave(Pattern=[0, 1], Stream0=gate_6.Target0, Stream1=dispatch_4.ListB, NullGaps=False)
pline = PolyLine(Vertices=[weave, gate_5.Target1], Closed=True)
pline_2 = PolyLine(Vertices=[weave_2, gate_6.Target1], Closed=True)
P_3 = ClusterInput()
weave_3 = Weave(Pattern=P_3, Stream0=flatten([gate.Target0, pline_2]), Stream1=flatten([gate_2.Target0, pline]), NullGaps=False)
P_4 = ClusterInput()
weave_4 = Weave(Pattern=P_4, Stream0=intcrv.Curve, Stream1=weave_3, NullGaps=False)
W = ClusterOutput(weave_4)

# ==== cluster Cluster_23
relay = ClusterInput()
domain = ClusterInput()
bool = ClusterInput()
int = ClusterInput()
S = ClusterInput()
P = ClusterInput()
P_2 = ClusterInput()
domain_2 = Domain(domain)
crv = Curve(relay)
bool_2 = Boolean(bool)
int_2 = Integer(int)
P_3 = ClusterInput()
P_4 = ClusterInput()
cluster = Cluster_21(N_3=int_2, P=P, C=crv, S=S, G_2=bool_2, N_2=int_2, P_2=P_2, N=int_2, G=bool_2)  # -> pl, uvp, N_5, _0_2, A_2, B_2, A, B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

# ---- group: image for values odd values
image = ImageSampler(
    cluster.uvp_2,
    FilePath="C:\Users\ikelo\Downloads\football.jpg",
    Filter="Value",
    Interpolate=False,
    Umax=1,
    Umin=0,
    Vmax=1,
    Vmin=0,
    Wrap=1)

# ---- group: image for even values
image_2 = ImageSampler(
    cluster.uvp,
    FilePath="C:\Users\ikelo\Downloads\football.jpg",
    Filter="Value",
    Interpolate=False,
    Umax=1,
    Umin=0,
    Vmax=1,
    Vmin=0,
    Wrap=1)

# ----
cluster_2 = Cluster_22(
    P_2=P_4,
    N=image_2,
    _0_2=cluster.pl,
    V=image_2,
    T=domain_2,
    G=cluster._0_2,
    V_3=cluster.N_5,
    _1=cluster.B_2,
    relay=cluster.A_2,
    relay_2=bool_2,
    P=P_3,
    G_2=[cluster.B, cluster._0],
    _0=cluster.A,
    V_4=cluster.N_4,
    V_2=image,
    T_2=domain_2,
    N_2=image)
W = ClusterOutput(cluster_2)

# ==== cluster Cluster_24
srf = ClusterInput()
srf_2 = Surface(srf)
U = ClusterInput()
V = ClusterInput()
divide = DivideDomain²(Domain=srf_2, UCount=U, VCount=V)
subsrf = Isotrim(Surface=srf_2, Domain=divide)
debrep = DeconstructBrep(Brep=subsrf)  # -> Faces, Edges, Vertices

# ---- group: curves01
crv = Curve(debrep.Edges)

# ---- group: faces
srf_3 = Surface(debrep.Faces)

# ----
join = JoinCurves(Curves=crv, Preserve=False)
D = ClusterInput()
md_slider = MDSlider(
    SliderMode=0,
    slider_value=Point(0.4679208151, 0.5323188596, 0.5),
    x_domain=Domain(0, 1),
    y_domain=Domain(0, 1),
    z_domain=Domain(0, 1))
offsets = OffsetOnSrf(Curve=join, Distance=D, Surface=srf_3)

# ---- group: curves2
crv_2 = Curve(offsets)

# ----
srf_4 = Surface(reparameterize(srf_3))
explode = Explode(Curve=crv_2, Recursive=True)  # -> Segments, Vertices
evalsrf = EvaluateSurface(Surface=srf_4, Point=md_slider)  # -> Point, Normal, UDirection, VDirection, Frame
crv_3 = Curve(explode.Segments)
x = ClusterInput()
pt = Point(evalsrf.Point)
F = ClusterInput()
neg = Negative(Value=x)
join_2 = JoinCurves(Curves=crv_3, Preserve=False)
scale = Scale(Geometry=crv_2, Center=pt, Factor=F)  # -> Geometry, Transform
multiplication = Multiplication(A=evalsrf.Normal, B=neg)
join_3 = JoinCurves(Curves=crv, Preserve=False)
join_4 = JoinCurves(Curves=crv_3, Preserve=False)
move = Move(Geometry=scale.Geometry, Motion=multiplication)  # -> Geometry, Transform
merge = Merge(Data1=simplify(graft(join_2)), Data2=simplify(graft(join_3)))

# ---- group: curves6
crv_4 = Curve(move.Geometry)

# ----
explode_2 = Explode(Curve=crv_4, Recursive=True)  # -> Segments, Vertices
merge_2 = Merge(Data1=simplify(graft(join_4)), Data2=simplify(graft(crv_4)))
item = ListItem(List=explode_2.Segments, Index=0, Wrap=True)  # -> Item, Item1, Item2, Item3
loft = Loft(Curves=merge, Options={Adjust=False, Closed=False, LoftEnds=0, LoftSimp=0, LoftType=0, Rebuild=10, Refit=0.01})
loft_2 = Loft(Curves=merge_2, Options={Adjust=False, Closed=False, LoftEnds=0, LoftSimp=0, LoftType=0, Rebuild=10, Refit=0.01})
edgesrf = EdgeSurface(CurveA=item.Item, CurveB=item.Item1, CurveC=item.Item2, CurveD=item.Item3)
join_5 = BrepJoin(Breps=flatten([loft, loft_2, edgesrf]))  # -> Breps, Closed
B = ClusterOutput(join_5.Breps)

# ==== cluster Cluster_25
B = ClusterInput()

geo = Geometry()
bbox = BoundingBox(Content=geo, Plane=PlaneXY(0, 0, 0))  # -> Box, Box_2
debox = DeconstructBox(Box=bbox.Box)  # -> Plane, X, Y, Z
dedomain = DeconstructDomain(Domain=debox.Z)  # -> Start, End
division = Division(A=dedomain.End, B=B)
range = Range(Domain=Domain(0, 1), Steps=division)
pt = ConstructPoint(XCoordinate=range, YCoordinate=0, ZCoordinate=0)
iso = IsoCurve(Surface=reparameterize(geo), UVPoint=pt)  # -> UIsocurve, flatten(VIsocurve)

# ==== cluster Cluster_26
srf = ClusterInput()
U = ClusterInput()
V = ClusterInput()
A = ClusterInput()
diamond = DiamondPanels(Surface=srf, UDivisions=U, VDivisions=V)  # -> DiamondPanels, TriPanels
division = Division(A=A, B=2)
split = SplitList(List=diamond.TriPanels, Index=1)  # -> ListA, ListB
geo = Geometry(diamond.DiamondPanels)
split_2 = SplitList(List=split.ListB, Index=expr("x-1", division))  # -> ListA, ListB
lng = ListLength(List=split_2.ListB)
subtraction = Subtraction(A=lng, B=division)
split_3 = SplitList(List=split_2.ListB, Index=subtraction)  # -> ListA, ListB
cull_i = CullIndex(List=split_3.ListB, Indices=-1, Wrap=True)
item = ListItem(List=split_3.ListB, Index=-1, Wrap=True)
geo_2 = Geometry(cull_i)
geo_3 = Geometry(split_2.ListA)
geo_4 = Geometry(split.ListA)
geo_5 = Geometry(split_3.ListA)
geo_6 = Geometry(item)
join = BrepJoin(Breps=flatten([geo_4, geo_5, geo_6]))  # -> Breps, Closed
edges = BrepEdges(Brep=join.Breps)  # -> Naked, Interior, NonManifold
item_2 = ListItem(List=edges.Naked, Index=0, Wrap=True)  # -> Item, Item1, Item2, Item3
edgesrf = EdgeSurface(CurveA=item_2.Item, CurveB=item_2.Item1, CurveC=item_2.Item2, CurveD=item_2.Item3)
join_2 = BrepJoin(Breps=flatten([geo, geo_3, geo_2, edgesrf]))  # -> Breps, Closed
B = ClusterOutput(join_2.Breps)

# ==== cluster Cluster_27
A = ClusterInput()
division = Division(A=A, B=2)
number_slider = Slider(1, range=0..1)
srf = ClusterInput()
U = ClusterInput()
V = ClusterInput()
repeat = RepeatData(Data=Slider(0, range=0..100), Length=division)
repeat_2 = RepeatData(Data=Slider(0, range=0..1), Length=expr("(x+1)-2", division))
hex = HexagonCells(Surface=srf, UDivisions=U, VDivisions=V, TParameter=0.25)  # -> HexagonCells, Centers
merge = Merge(Data1=flatten(number_slider), Data2=flatten(repeat_2), Data3=flatten(number_slider), Data4=flatten(repeat))
dispatch = Dispatch(List=hex.HexagonCells, DispatchPattern=invert(merge))  # -> graft(ListA), ListB
panel = Panel(merge)
geo = Geometry(dispatch.ListB)
split = SplitList(List=geo, Index=2)  # -> ListA, ListB
geo_2 = Geometry(dispatch.ListA)
lng = ListLength(List=split.ListB)
split_2 = SplitList(List=split.ListB, Index=expr("x-2", lng))  # -> ListA, ListB
geo_3 = Geometry(flatten([split.ListA, split_2.ListB]))
geo_4 = Geometry(split_2.ListA)

dispatch_2 = Dispatch(List=geo_4, DispatchPattern=[True, False])  # -> ListA, ListB
explode = Explode(Curve=dispatch_2.ListA, Recursive=True)  # -> Segments, Vertices
explode_2 = Explode(Curve=dispatch_2.ListB, Recursive=True)  # -> Segments, Vertices
item = ListItem(List=explode.Segments, Index=0, Wrap=True)  # -> Item, Item1, Item2, Item3, Item4
item_2 = ListItem(List=explode_2.Segments, Index=0, Wrap=True)  # -> Item, Item1, Item2, Item3, Item4
geo_5 = Geometry([item.Item2, item.Item3, item.Item, item.Item4])
geo_6 = Geometry([item_2.Item1, item_2.Item, item_2.Item2, item_2.Item3])
merge_2 = Merge(Data1=geo_5, Data2=geo_6)

number_slider_2 = Slider(25, range=0..50)
patch = Patch(Curves=dispatch.ListA, Spans=number_slider_2, Flexibility=1, Trim=True)  # -> flatten(Patch)
patch_2 = Patch(Curves=merge_2, Spans=number_slider_2, Flexibility=1, Trim=True)  # -> flatten(Patch)

dispatch_3 = Dispatch(List=geo_3, DispatchPattern=[True, False])  # -> ListA, ListB

dispatch_4 = Dispatch(List=dispatch_3.ListB, DispatchPattern=[True, False])  # -> ListA, ListB
explode_3 = Explode(Curve=dispatch_4.ListA, Recursive=True)  # -> Segments, Vertices
explode_4 = Explode(Curve=dispatch_4.ListB, Recursive=True)  # -> Segments, Vertices
item_3 = ListItem(List=explode_3.Segments, Index=0, Wrap=True)  # -> Item, Item1, Item2, Item3
item_4 = ListItem(List=explode_4.Segments, Index=0, Wrap=True)  # -> Item, Item1, Item2, Item3
geo_7 = Geometry([item_3.Item1, item_3.Item, item_3.Item2])
geo_8 = Geometry([item_4.Item, item_4.Item2, item_4.Item1])

dispatch_5 = Dispatch(List=dispatch_3.ListA, DispatchPattern=[True, False])  # -> ListA, ListB
explode_5 = Explode(Curve=dispatch_5.ListA, Recursive=True)  # -> Segments, Vertices
explode_6 = Explode(Curve=dispatch_5.ListB, Recursive=True)  # -> Segments, Vertices
item_5 = ListItem(List=explode_5.Segments, Index=0, Wrap=True)  # -> Item, Item1, Item2, Item3
item_6 = ListItem(List=explode_6.Segments, Index=0, Wrap=True)  # -> Item, Item1, Item2, Item3
geo_9 = Geometry([item_5.Item2, item_5.Item3, item_5.Item1])
geo_10 = Geometry([item_6.Item2, item_6.Item3, item_6.Item])

merge_3 = Merge(Data1=geo_9, Data2=geo_7)
merge_4 = Merge(Data1=geo_10, Data2=geo_8)

patch_3 = Patch(Curves=merge_3, Spans=number_slider_2, Flexibility=1, Trim=True)  # -> flatten(Patch)
patch_4 = Patch(Curves=merge_4, Spans=number_slider_2, Flexibility=1, Trim=True)  # -> flatten(Patch)
brepjoin = BrepJoinWithTolerance(Brep=[patch, patch_2, patch_3, patch_4], Tolerance=3)
brep = ClusterOutput(brepjoin)

# ==== cluster Cluster_32
int = ClusterInput()
int_2 = Integer(int)
geo = ClusterInput()
geo_2 = Geometry(geo)
P = ClusterInput()
loft = Loft(Curves=flatten(geo_2), Options={Adjust=True, Closed=False, LoftEnds=0, LoftSimp=1, LoftType=0, Rebuild=50, Refit=0.01})
dispatch = Dispatch(List=geo_2, DispatchPattern=P)  # -> ListA, ListB
P_2 = ClusterInput()
dispatch_2 = Dispatch(List=dispatch.ListB, DispatchPattern=P_2)  # -> ListA, ListB
divide = DivideCurve(Curve=dispatch.ListA, Count=int_2, Kinks=False)  # -> Points, Tangents, Parameters
pline = PolyLine(Vertices=divide.Points, Closed=True)  # -> flatten(Polyline)
R = ClusterInput()
R_2 = ClusterInput()
P_3 = ClusterInput()
P_4 = ClusterInput()

divide_2 = DivideCurve(Curve=dispatch_2.ListB, Count=int_2, Kinks=False)  # -> Points, Tangents, Parameters

cluster = Cluster_31(L=divide_2.Points)

divide_3 = DivideCurve(Curve=dispatch_2.ListA, Count=int_2, Kinks=False)  # -> Points, Tangents, Parameters

cluster_2 = Cluster_30(L=divide_3.Points)

dispatch_3 = Dispatch(List=divide_2.Points, DispatchPattern=invert(cluster))  # -> ListA, ListB
brep_cp = BrepClosestPoint(Point=dispatch_3.ListB, Brep=loft)  # -> Point, Normal, Distance
cluster_3 = Cluster_29(L_2=brep_cp.Normal, L=brep_cp.Normal, R=R)
amp = Amplitude(Vector=brep_cp.Normal, Amplitude=cluster_3)

devec = DeconstructVector(Vector=amp)  # -> XComponent, YComponent, ZComponent
vec = VectorXYZ(XComponent=devec.XComponent, YComponent=devec.YComponent, ZComponent=0)  # -> Vector, Length

move = Move(Geometry=dispatch_3.ListB, Motion=vec.Vector)  # -> Geometry, Transform
weave = Weave(Pattern=cluster, Stream0=dispatch_3.ListA, Stream1=move.Geometry, NullGaps=False)
pline_2 = PolyLine(Vertices=weave, Closed=True)  # -> flatten(Polyline)

dispatch_4 = Dispatch(List=divide_3.Points, DispatchPattern=invert(cluster_2))  # -> ListA, ListB
brep_cp_2 = BrepClosestPoint(Point=dispatch_4.ListA, Brep=loft)  # -> Point, Normal, Distance
cluster_4 = Cluster_28(L_2=brep_cp_2.Normal, L=brep_cp_2.Normal, R=R_2)
amp_2 = Amplitude(Vector=brep_cp_2.Normal, Amplitude=cluster_4)

devec_2 = DeconstructVector(Vector=amp_2)  # -> XComponent, YComponent, ZComponent
vec_2 = VectorXYZ(XComponent=devec_2.XComponent, YComponent=devec_2.YComponent, ZComponent=0)  # -> Vector, Length

move_2 = Move(Geometry=dispatch_4.ListA, Motion=vec_2.Vector)  # -> Geometry, Transform
weave_2 = Weave(Pattern=cluster_2, Stream0=move_2.Geometry, Stream1=dispatch_4.ListB, NullGaps=False)
pline_3 = PolyLine(Vertices=weave_2, Closed=True)  # -> flatten(Polyline)

weave_3 = Weave(Pattern=P_3, Stream0=pline_3, Stream1=pline_2, NullGaps=False)
weave_4 = Weave(Pattern=P_4, Stream0=pline, Stream1=weave_3, NullGaps=False)
W = ClusterOutput(weave_4)

# ==== cluster Cluster_33
C = ClusterInput()
bbox = BoundingBox(Content=C, Plane=PlaneXY(0, 0, 0), UnionBox=True)  # -> Box, Box_2
debrep = DeconstructBrep(Brep=bbox.Box)  # -> Faces, Edges, Vertices
X = ClusterInput()
Y = ClusterInput()
item = ListItem(List=debrep.Faces, Index=4, Wrap=True)
relay = ClusterInput()
pt = ConstructPoint(XCoordinate=X, YCoordinate=Y, ZCoordinate=0)
area = Area(Geometry=item)  # -> Area, Centroid
vec2pt = Vector2Pt(PointA=area.Centroid, PointB=pt, Unitize=False)  # -> Vector, Length
move = Move(Geometry=relay, Motion=vec2pt.Vector)  # -> Geometry, Transform
F = ClusterInput()
Z = UnitZ(Factor=F)

# ---- group: setting the correct base hieght
move_2 = Move(Geometry=move.Geometry, Motion=Z)  # -> Geometry, Transform

# ----
G = ClusterOutput(move_2.Geometry)

# ==== cluster Cluster_36
bool = ClusterInput()
relay = ClusterInput()
bool_2 = Boolean(bool)
gate = StreamGate(Stream=relay, Gate=bool_2)  # -> Target0, Target1
num = Number(expr("-x", gate.Target1))
C = ClusterInput()
reb = RebuildCurve(Curve=C, Degree=3, Count=45, Tangents=False)
num_2 = Number([gate.Target0, num])
P = ClusterInput()
relay_2 = ClusterInput()
clean = CleanTree(RemoveNulls=True, RemoveInvalid=True, RemoveEmpty=True, Tree=num_2)
dispatch = Dispatch(List=flatten(reb), DispatchPattern=P)  # -> ListA, ListB
P_2 = ClusterInput()
dispatch_2 = Dispatch(List=dispatch.ListB, DispatchPattern=P_2)  # -> ListA, ListB
loft = Loft(Curves=reb, Options={Adjust=False, Closed=False, LoftEnds=0, LoftSimp=0, LoftType=0, Rebuild=10, Refit=0.01})
divide = DivideCurve(Curve=dispatch.ListA, Count=relay_2, Kinks=False)  # -> Points, Tangents, Parameters
cluster = Cluster_35(N=10, P_4=[0, 1], P=[True, False], P_3=[0, 1], N_2=10, P_2=[True, False], X=1, Y=1, G=0, G_2=0, N_3=10)
pline = PolyLine(Vertices=divide.Points, Closed=True)
P_3 = ClusterInput()
P_4 = ClusterInput()

divide_2 = DivideCurve(Curve=dispatch_2.ListA, Count=relay_2, Kinks=False)  # -> Points, Tangents, Parameters
dispatch_3 = Dispatch(List=divide_2.Points, DispatchPattern=[True, False])  # -> ListA, ListB
brep_cp = BrepClosestPoint(Point=dispatch_3.ListA, Brep=loft)  # -> Point, Normal, Distance
amp = Amplitude(Vector=brep_cp.Normal, Amplitude=relay)

devec = DeconstructVector(Vector=amp)  # -> XComponent, YComponent, ZComponent
vec = VectorXYZ(XComponent=devec.XComponent, YComponent=devec.YComponent, ZComponent=0)  # -> Vector, Length

move = Move(Geometry=dispatch_3.ListA, Motion=vec.Vector)  # -> Geometry, Transform
weave = Weave(Pattern=[0, 1], Stream0=move.Geometry, Stream1=dispatch_3.ListB, NullGaps=False)
pline_2 = PolyLine(Vertices=weave, Closed=True)

divide_3 = DivideCurve(Curve=dispatch_2.ListB, Count=relay_2, Kinks=False)  # -> Points, Tangents, Parameters
dispatch_4 = Dispatch(List=divide_3.Points, DispatchPattern=[True, False])  # -> ListA, ListB
brep_cp_2 = BrepClosestPoint(Point=dispatch_4.ListB, Brep=loft)  # -> Point, Normal, Distance
amp_2 = Amplitude(Vector=brep_cp_2.Normal, Amplitude=clean)

devec_2 = DeconstructVector(Vector=amp_2)  # -> XComponent, YComponent, ZComponent
vec_2 = VectorXYZ(XComponent=devec_2.XComponent, YComponent=devec_2.YComponent, ZComponent=0)  # -> Vector, Length

move_2 = Move(Geometry=dispatch_4.ListB, Motion=vec_2.Vector)  # -> Geometry, Transform
weave_2 = Weave(Pattern=[0, 1], Stream0=dispatch_4.ListA, Stream1=move_2.Geometry, NullGaps=False)
pline_3 = PolyLine(Vertices=weave_2, Closed=True)

weave_3 = Weave(Pattern=P_3, Stream0=flatten(pline_2), Stream1=flatten(pline_3), NullGaps=False)
weave_4 = Weave(Pattern=P_4, Stream0=flatten(pline), Stream1=flatten(weave_3), NullGaps=False)
geo = Geometry(weave_4)
geo_2 = ClusterOutput(geo)

# ==== cluster Cluster_37
bool = ClusterInput()
bool_2 = Boolean(bool)
S = ClusterInput()
G = ClusterInput()

# ----
# get planes working and this is amazing
gate = StreamGate(Stream=S, Gate=G)  # -> Target0, Target1, Target2, Target3, Target4
geo = Geometry([gate.Target1, gate.Target2, gate.Target3, gate.Target4])
filter = StreamFilter(Gate=bool_2, Stream1=geo)
geo_2 = Geometry(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)
flip = FlipCurve(Curve=filter, Guide=geo_2)  # -> Curve, Flag
reb = RebuildCurve(Curve=flip.Curve, Degree=3, Count=40, Tangents=False)
patch = Patch(Curves=graft(reb), Spans=20, Flexibility=1, Trim=True)
panel = Panel(reb)
md_slider = MDSlider(SliderMode=0, slider_value=Point(0.5, 0.5, 0.5), x_domain=Domain(0, 1), y_domain=Domain(0, 1), z_domain=Domain(0, 1))
item = ListItem(List=flatten(patch), Index=0, Wrap=True)
flip_2 = Flip(Surface=patch, Guide=item)  # -> Surface, Result
crv = Curve(reb)
evalsrf = EvaluateSurface(Surface=flip_2.Surface, Point=md_slider)  # -> Point, Normal, UDirection, VDirection, Frame
item_2 = ListItem(List=crv, Index=0, Wrap=True)
item_3 = ListItem(List=flatten(evalsrf.Frame), Index=0, Wrap=True)
flip_3 = FlipCurve(Curve=crv, Guide=item_2)  # -> Curve, Flag
pl = PlaneNormal(Origin=evalsrf.Point, ZAxis=evalsrf.Normal)
align = AlignPlanes(Planes=flatten(pl))
offset = OffsetCurve(Curve=graft(flip_3.Curve), Distance=expr("-x", Slider(-10, range=-25..250)), Plane=graft(align), Corners=1)
patch_2 = Patch(Curves=offset, Points=evalsrf.Point, Spans=20, Flexibility=1, Trim=True)

geo_3 = ClusterInput()
geo_4 = Geometry(geo_3)
geo_5 = ClusterInput()

geo_6 = Geometry(geo_5)
filter_2 = StreamFilter(Gate=bool_2, Stream1=geo_6)
geo_7 = Geometry(filter_2)
bbox = BoundingBox(Content=geo_7, Plane=PlaneXY(0, 0, 0))  # -> Box, Box_2
volume = Volume(Geometry=bbox.Box)  # -> Volume, Centroid
scale_nu = ScaleNU(Geometry=geo_7, Plane=volume.Centroid, ScaleX=1, ScaleY=1, ScaleZ=1.01)  # -> Geometry, Transform
panel_2 = Panel(scale_nu.Geometry)
clean = CleanTree(RemoveNulls=True, RemoveInvalid=True, RemoveEmpty=True, Tree=scale_nu.Geometry)
cap = CapHoles(Brep=clean)

filter_3 = StreamFilter(Gate=bool_2, Stream1=geo_4)
bbx = BrepBrep(BrepA=clean, BrepB=flatten(patch_2))  # -> flatten(Curves), Points
geo_8 = Geometry(bbx.Curves)

geo_9 = Geometry([geo_8, filter_3])
simplify = SimplifyCurve(Curve=geo_9)  # -> Curve, Simplified
cp = ControlPoints(Curve=simplify.Curve)  # -> Points, Weights, Knots
lng = ListLength(List=cp.Points)  # -> flatten(Length)
bnd = Bounds(Numbers=lng)
dedomain = DeconstructDomain(Domain=bnd)  # -> Start, End

# ---- group: safety, just helps everything run super nicely later on
item_4 = ListItem(List=simplify.Curve, Index=0, Wrap=True)
flip_4 = FlipCurve(Curve=simplify.Curve, Guide=item_4)  # -> Curve, Flag
reb_2 = RebuildCurve(Curve=flip_4.Curve, Degree=1, Count=dedomain.Start, Tangents=False)  # -> flatten(Curve)

# ----
cp_2 = ControlPoints(Curve=reb_2)  # -> Points, Weights, Knots
nurbs = NurbsCurve(Vertices=cp_2.Points, Degree=3, Periodic=True)  # -> flatten(Curve), Length, Domain
item_5 = ListItem(List=nurbs.Curve, Index=Slider(74, range=0..100), Wrap=True)
len = Length(Curve=nurbs.Curve)
pline = PolyLine(Vertices=cp_2.Points, Closed=True)
panel_3 = Panel(len)
cull_i = CullIndex(List=reb_2, Indices=51, Wrap=True)
ipy2 = IronPython2Script(x=panel_3)  # -> flatten(out), flatten(a), flatten(b)
# ---------- ipy2: IronPython ----------
"""
Inputs:
    x : list or tree of numeric values
Outputs:
    a : indices (0-based) of values < 50% of the first value
    b : the corresponding values
"""

# Try to flatten Grasshopper DataTree if needed
try:
    vals = list(x.AllData())   # works if x is a GH tree
except:
    try:
        vals = list(x)         # works if x is already a list
    except:
        vals = [x]             # fallback: single value

# Safe float conversion
nums = []
for v in vals:
    try:
        nums.append(float(str(v)))  # handles GH_Number, strings, etc.
    except:
        pass  # skip anything that can’t convert

a = []
b = []

if len(nums) > 0:
    ref = nums[0]
    limit = ref * 0.5
    for i in range(len(nums)):
        if nums[i] < limit:
            a.append(i)
            b.append(nums[i])
# ---------- end ipy2 ----------
panel_4 = Panel(ipy2.b)
panel_5 = Panel(ipy2.a)
G_2 = ClusterInput()
gate_2 = StreamGate(Stream=flatten(reb_2), Gate=G_2)  # -> Target0, Target1, Target2, Target3, Target4, Target5
_5 = ClusterOutput(gate_2.Target5)
geo_10 = Geometry(gate_2.Target5)

# ==== cluster Cluster_41
int = ClusterInput()
geo = ClusterInput()
int_2 = Integer(int)
geo_2 = Geometry(geo)
geo_3 = ClusterInput()
geo_4 = Geometry(geo_3)
geo_5 = ClusterInput()
S = ClusterInput()
G = ClusterInput()
S_2 = ClusterInput()
cluster = Cluster_40(S=S_2, C=geo_4)  # -> C_2, L
B = ClusterInput()

geo_6 = Geometry(geo_5)
cluster_2 = Cluster_38(geo=geo_6, B=B)
reb = RebuildCurve(Curve=cluster_2, Count=18, Tangents=False)

B_2 = ClusterInput()

item = ListItem(List=geo_2, Index=0, Wrap=True)
topoly = CurveToPolyline(Curve=geo_2, ToleranceDistance=Slider(0.1, range=0..0.1), ToleranceAngle=0)  # -> Polyline, Segments
pcen = PolygonCenter(Polyline=topoly.Polyline)  # -> CenterV, CenterE, CenterA
area = Area(Geometry=item)  # -> Area, Centroid
pdecon = Deconstruct(Point=pcen.CenterE)  # -> XComponent, YComponent, ZComponent
xz = XZPlane(Origin=area.Centroid)
sort = SortList(Keys=pdecon.ZComponent, ValuesA=geo_2)  # -> Keys, ValuesA
pcx = CurvePlane(Curve=sort.ValuesA, Plane=xz)  # -> Points, ParamsC, ParamsP
pdecon_2 = Deconstruct(Point=pcx.Points)  # -> XComponent, YComponent, ZComponent
sort_2 = SortList(Keys=pdecon_2.XComponent, ValuesB=pcx.Points, ValuesA=pcx.ParamsC)  # -> Keys, ValuesB, ValuesA
item_2 = ListItem(List=sort_2.ValuesA, Index=0, Wrap=True)
seam = Seam(Curve=sort.ValuesA, Seam=flatten(item_2))
cluster_3 = Cluster_39(C=seam, S=S)  # -> C_3, C_2
loft = Loft(
    Curves=flatten(cluster_3.C_2),
    Options={Adjust=True, Closed=False, LoftEnds=0, LoftSimp=1, LoftType=0, Rebuild=30, Refit=0.01})
cluster_4 = Cluster_38(geo=loft, B=B_2)

filter = StreamFilter(Gate=G, Stream0=cluster.C_2, Stream1=cluster_3.C_3)
s_1 = ClusterOutput(filter)
filter_2 = StreamFilter(Gate=int_2, Stream0=geo_4, Stream1=cluster_4, Stream2=reb)
filter_3 = StreamFilter(Gate=int_2, Stream0=cluster.L, Stream1=loft, Stream2=geo_6)
s_1_2 = ClusterOutput(filter_2)
s_1_3 = ClusterOutput(filter_3)

# ==== cluster Cluster_42
geo = ClusterInput()
i = ClusterInput()

geo_2 = Geometry(geo)
split = SplitList(List=geo_2, Index=i)  # -> ListA, ListB

flip = FlipCurve(Curve=split.ListB, Guide=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)  # -> Curve, Flag
A = ClusterOutput(split.ListA)
B = ClusterOutput(split.ListB)
C = ClusterOutput(flip.Curve)

# ==== cluster Cluster_45
crv = ClusterInput()
int = ClusterInput()
P = ClusterInput()
crv_2 = Curve(crv)
int_2 = Integer(int)
A = ClusterInput()
A_2 = ClusterInput()
A_3 = ClusterInput()
A_4 = ClusterInput()
dispatch = Dispatch(List=crv_2, DispatchPattern=P)  # -> ListA, ListB
P_2 = ClusterInput()
cluster = Cluster_43(L_2=int_2, L=int_2)
dispatch_2 = Dispatch(List=dispatch.ListB, DispatchPattern=P_2)  # -> ListA, ListB
lng = ListLength(List=dispatch.ListB)
cluster_2 = Cluster_44(L=lng, A_2=A, A=A_2)
cluster_3 = Cluster_44(L=lng, A_2=A_3, A=A_4)
L = ClusterOutput(lng)
divide = DivideCurve(Curve=dispatch_2.ListA, Count=int_2, Kinks=False)  # -> Points, Tangents, Parameters
P_3 = ClusterInput()
P_4 = ClusterInput()
dispatch_3 = Dispatch(List=cluster_3, DispatchPattern=P_3)  # -> ListA, ListB
dispatch_4 = Dispatch(List=cluster_2, DispatchPattern=P_4)  # -> ListA, ListB
loft = Loft(Curves=crv_2, Options={Adjust=False, Closed=False, LoftEnds=0, LoftSimp=0, LoftType=0, Rebuild=10, Refit=0.01})
dispatch_5 = Dispatch(List=divide.Points, DispatchPattern=cluster)  # -> ListA, ListB
divide_2 = DivideCurve(Curve=dispatch_2.ListB, Count=int_2, Kinks=False)  # -> Points, Tangents, Parameters
dispatch_6 = Dispatch(List=divide_2.Points, DispatchPattern=cluster)  # -> ListA, ListB

dispatch_7 = Dispatch(List=dispatch_5.ListA, DispatchPattern=[True, False])  # -> ListA, ListB
brep_cp = BrepClosestPoint(Point=dispatch_7.ListB, Brep=loft)  # -> Point, Normal, Distance
lng_2 = ListLength(List=brep_cp.Normal)
repeat = RepeatData(Data=graft(dispatch_3.ListA), Length=lng_2)
amp = Amplitude(Vector=brep_cp.Normal, Amplitude=repeat)
devec = DeconstructVector(Vector=amp)  # -> XComponent, YComponent, ZComponent
vec = VectorXYZ(XComponent=devec.XComponent, YComponent=devec.YComponent, ZComponent=0)  # -> Vector, Length
move = Move(Geometry=dispatch_7.ListB, Motion=vec.Vector)  # -> Geometry, Transform
weave = Weave(Pattern=[0, 1], Stream0=dispatch_7.ListA, Stream1=move.Geometry, NullGaps=False)

dispatch_8 = Dispatch(List=dispatch_5.ListB, DispatchPattern=[True, False])  # -> ListA, ListB
brep_cp_2 = BrepClosestPoint(Point=dispatch_8.ListB, Brep=loft)  # -> Point, Normal, Distance
lng_3 = ListLength(List=brep_cp_2.Normal)
repeat_2 = RepeatData(Data=graft(dispatch_4.ListA), Length=lng_3)
amp_2 = Amplitude(Vector=brep_cp_2.Normal, Amplitude=repeat_2)
devec_2 = DeconstructVector(Vector=amp_2)  # -> XComponent, YComponent, ZComponent
vec_2 = VectorXYZ(XComponent=devec_2.XComponent, YComponent=devec_2.YComponent, ZComponent=0)  # -> Vector, Length
move_2 = Move(Geometry=dispatch_8.ListB, Motion=vec_2.Vector)  # -> Geometry, Transform
weave_2 = Weave(Pattern=[0, 1], Stream0=dispatch_8.ListA, Stream1=move_2.Geometry, NullGaps=False)

dispatch_9 = Dispatch(List=dispatch_6.ListB, DispatchPattern=invert([True, False]))  # -> ListA, ListB
brep_cp_3 = BrepClosestPoint(Point=dispatch_9.ListB, Brep=loft)  # -> Point, Normal, Distance
lng_4 = ListLength(List=brep_cp_3.Normal)
repeat_3 = RepeatData(Data=graft(dispatch_4.ListB), Length=lng_4)
amp_3 = Amplitude(Vector=brep_cp_3.Normal, Amplitude=repeat_3)
devec_3 = DeconstructVector(Vector=amp_3)  # -> XComponent, YComponent, ZComponent
vec_3 = VectorXYZ(XComponent=devec_3.XComponent, YComponent=devec_3.YComponent, ZComponent=0)  # -> Vector, Length
move_3 = Move(Geometry=dispatch_9.ListB, Motion=vec_3.Vector)  # -> Geometry, Transform
weave_3 = Weave(Pattern=[1, 0], Stream0=dispatch_9.ListA, Stream1=move_3.Geometry, NullGaps=False)

dispatch_10 = Dispatch(List=dispatch_6.ListA, DispatchPattern=invert([True, False]))  # -> ListA, ListB
brep_cp_4 = BrepClosestPoint(Point=dispatch_10.ListB, Brep=loft)  # -> Point, Normal, Distance
lng_5 = ListLength(List=brep_cp_4.Normal)
repeat_4 = RepeatData(Data=graft(dispatch_3.ListB), Length=lng_5)
amp_4 = Amplitude(Vector=brep_cp_4.Normal, Amplitude=repeat_4)
devec_4 = DeconstructVector(Vector=amp_4)  # -> XComponent, YComponent, ZComponent
vec_4 = VectorXYZ(XComponent=devec_4.XComponent, YComponent=devec_4.YComponent, ZComponent=0)  # -> Vector, Length
move_4 = Move(Geometry=dispatch_10.ListB, Motion=vec_4.Vector)  # -> Geometry, Transform
weave_4 = Weave(Pattern=[1, 0], Stream0=dispatch_10.ListA, Stream1=move_4.Geometry, NullGaps=False)

divide_3 = DivideCurve(Curve=dispatch.ListA, Count=int_2, Kinks=False)  # -> Points, Tangents, Parameters
pline = PolyLine(Vertices=divide_3.Points, Closed=True)  # -> flatten(Polyline)
merge = Merge(Data1=weave, Data2=weave_2)
merge_2 = Merge(Data1=weave_4, Data2=weave_3)
pline_2 = PolyLine(Vertices=merge, Closed=True)
pline_3 = PolyLine(Vertices=merge_2, Closed=True)
P_5 = ClusterInput()
weave_5 = Weave(Pattern=P_5, Stream0=flatten(pline_2), Stream1=flatten(pline_3), NullGaps=False)
P_6 = ClusterInput()
weave_6 = Weave(Pattern=P_6, Stream0=pline, Stream1=weave_5, NullGaps=False)
geo = Geometry(weave_6)
geo_2 = ClusterOutput(geo)

# ==== cluster Cluster_47
relay = ClusterInput()
N = ClusterInput()
G = ClusterInput()
D = ClusterInput()
G_2 = ClusterInput()
int = ClusterInput()
int_2 = Integer(int)
G_3 = ClusterInput()
D_2 = ClusterInput()
division = Division(A=int_2, B=2)
int_3 = ClusterInput()
relay_2 = ClusterInput()
relay_3 = ClusterInput()

division_2 = Division(A=relay_2, B=2)
multiplication = Multiplication(A=int_2, B=division_2)
multiplication_2 = Multiplication(A=relay, B=division_2)
addition = Addition(A=multiplication, B=multiplication_2)

P = ClusterInput()
R = ClusterOutput(addition)
number_slider = Slider(0, range=0..100)
addition_2 = Addition(A=int_2, B=relay)
repeat = RepeatData(Data=number_slider, Length=int_2)
repeat_2 = RepeatData(Data=Slider(1, range=0..1), Length=relay)
merge = Merge(Data1=repeat, Data2=repeat_2)
T = ClusterInput()
P_2 = ClusterInput()

filter = StreamFilter(Gate=G, Stream1=-1)

int_4 = Integer(addition)
int_5 = Integer(int_3)
repeat_3 = RepeatData(Data=Slider(0, range=0..100), Length=int_5)

division_3 = Division(A=int_4, B=relay_2)

repeat_4 = RepeatData(Data="0", Length=division)

repeat_5 = RepeatData(Data=division_3, Length=int_5)
merge_2 = Merge(Data1=repeat_3, Data2=repeat_5)

dispatch = Dispatch(List=flatten(relay_3), DispatchPattern=P)  # -> ListA, ListB
divide = DivideCurve(Curve=dispatch.ListB, Count=addition, Kinks=False)  # -> Points, Tangents, Parameters
divide_2 = DivideCurve(Curve=dispatch.ListA, Count=addition, Kinks=False)  # -> Points, Tangents, Parameters
loft = Loft(Curves=relay_3, Options={Adjust=True, Closed=False, LoftEnds=0, LoftSimp=1, LoftType=0, Rebuild=36, Refit=0.01})
pline = PolyLine(Vertices=divide_2.Points, Closed=True)

lng = ListLength(List=dispatch.ListB)
repeat_6 = RepeatData(Data=D_2, Length=lng)

series = Series(Start=0, Step=N, Count=lng)
repeat_7 = RepeatData(Data=D, Length=lng)
gate = StreamGate(Stream=series, Gate=G_2)  # -> Target0, Target1
multiplication_3 = Multiplication(A=gate.Target1, B=filter)
clean = CleanTree(RemoveNulls=True, RemoveInvalid=True, RemoveEmpty=True, Tree=[gate.Target0, multiplication_3])
filter_2 = StreamFilter(Gate=G_3, Stream0=repeat_7, Stream1=clean)

panel = Panel(filter_2)

# ---- group: this might need a bit of work so that, tje points dont align on the end
ipy2 = IronPython2Script(x=division, y=repeat_6)  # -> out, a
# ---------- ipy2: IronPython ----------
# Inputs: x, y

x = int(x)
y = int(y)

output = []

# Reserve 2 zeros at start and 2 at end
reserved_zeros = 4
remaining_space = x - reserved_zeros

# Number of 0 zones between 1s is (y + 1)
gap_count = y + 1

# Remaining zeros to distribute
zeros_to_distribute = remaining_space - y  # Subtract y 1s

# Compute average gap size
gap_size = float(zeros_to_distribute) / gap_count

# Add 2 zeros at the beginning
output += ["0", "0"]

accum = 0.0
total_inserted = 2

for i in range(y):
    # Add block of 0s
    zeros_this_block = int(round(gap_size))
    output += ["0"] * zeros_this_block
    total_inserted += zeros_this_block

    # Add a 1
    output.append("1")
    total_inserted += 1

# Add final block of 0s before the ending reserved 0s
final_zeros = x - total_inserted - 2
output += ["0"] * final_zeros

# Add final 2 reserved zeros
output += ["0", "0"]

# Output each line
for val in output:
    print val
# ---------- end ipy2 ----------

# ----
lng_2 = ListLength(List=ipy2.out)
repeat_8 = RepeatData(Data=repeat_4, Length=lng_2)
weave = Weave(Pattern=[0, 1], Stream0=repeat_8, Stream1=ipy2.out, NullGaps=False)

repeat_9 = RepeatData(Data=merge_2, Length=lng)

int_6 = Integer(graft(repeat_9))
lng_3 = ListLength(List=weave)
subtraction = Subtraction(A=lng_3, B=relay)
subtraction_2 = Subtraction(A=lng_3, B=subtraction)
panel_2 = Panel(int_6)
repeat_10 = RepeatData(Data=number_slider, Length=subtraction_2)
panel_3 = Panel(lng_3)
panel_4 = Panel(subtraction_2)
weave_2 = Weave(Pattern=merge, Stream0=flatten(weave), Stream1=flatten(repeat_10), NullGaps=False)
partition = PartitionList(List=weave_2, Size=addition_2)

shift = ShiftList(List=divide.Points, Shift=int_6, Wrap=True)
shift_2 = ShiftList(List=shift, Shift=graft(filter_2), Wrap=True)
dispatch_2 = Dispatch(List=shift_2, DispatchPattern=invert(partition))  # -> ListA, ListB
brep_cp = BrepClosestPoint(Point=dispatch_2.ListB, Brep=loft)  # -> Point, Normal, Distance
lng_4 = ListLength(List=brep_cp.Normal)
cluster = Cluster_46(L=dispatch.ListB, T=T, Panel=lng_4)
repeat_11 = RepeatData(Data=cluster, Length=lng_4)
amp = Amplitude(Vector=brep_cp.Normal, Amplitude=repeat_11)
pdecon = Deconstruct(Point=amp)  # -> XComponent, YComponent, ZComponent
vec = VectorXYZ(XComponent=pdecon.XComponent, YComponent=pdecon.YComponent, ZComponent=0)  # -> Vector, Length
move = Move(Geometry=dispatch_2.ListB, Motion=vec.Vector)  # -> Geometry, Transform
weave_3 = Weave(Pattern=partition, Stream0=dispatch_2.ListA, Stream1=move.Geometry, NullGaps=False)
pline_2 = PolyLine(Vertices=weave_3, Closed=False)
weave_4 = Weave(Pattern=P_2, Stream0=flatten(pline), Stream1=flatten(pline_2), NullGaps=False)  # -> flatten(Weave)

panel_5 = Panel(partition)
W = ClusterOutput(weave_4)

# ==== cluster Cluster_54
geo = ClusterInput()
geo_2 = Geometry(geo)

# ---- group: helps to find a unit measure to create a scale factor for internal curves
cluster = Cluster_50(L=geo_2)

# ----
A = ClusterInput()
B = ClusterInput()

topoly = CurveToPolyline(Curve=geo_2, ToleranceDistance=Slider(0.01, range=0..0.01), ToleranceAngle=0)  # -> Polyline, Segments
pcen = PolygonCenter(Polyline=topoly.Polyline)  # -> CenterV, CenterE, CenterA
multiplication = Multiplication(A=A, B=B)
subtraction = Subtraction(A=cluster, B=multiplication)
division = Division(A=subtraction, B=cluster)
scale_nu = ScaleNU(Geometry=geo_2, Plane=pcen.CenterE, ScaleX=division, ScaleY=division, ScaleZ=1)  # -> Geometry, Transform

G = ClusterInput()
gate = StreamGate(Stream=scale_nu.Geometry, Gate=G)  # -> Target0, Target1
relay = ClusterInput()

cluster_2 = Cluster_53(C=gate.Target1)
crv_cp = CurveClosestPoint(Point=cluster_2, Curve=gate.Target1)  # -> Point, Parameter, Distance
division_2 = Division(A=crv_cp.Distance, B=relay)
series = Series(Start=0, Step=relay, Count=division_2)
lng = ListLength(List=series)
repeat = RepeatData(Data=graft(crv_cp.Distance), Length=lng)
flip = FlipCurve(Curve=gate.Target1, Guide=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)  # -> Curve, Flag
subtraction_2 = Subtraction(A=repeat, B=series)
division_3 = Division(A=subtraction_2, B=repeat)
lng_2 = ListLength(List=division_3)
item = ListItem(List=flatten(lng_2), Index=0, Wrap=True)
series_2 = Series(Start=0, Step=1, Count=item)
replace = ReplaceItems(List=flatten(division_3), Item=Slider(1, range=0..1), Indices=series_2, Wrap=False)
partition = PartitionList(List=flatten(replace), Size=flatten(lng_2))
scale_nu_2 = ScaleNU(Geometry=graft(flip.Curve), Plane=graft(cluster_2), ScaleX=division_3, ScaleY=division_3, ScaleZ=partition)  # -> Geometry, Transform

D = ClusterInput()
D_2 = ClusterInput()

patch = Patch(Curves=graft(gate.Target0), Spans=20, Flexibility=1, Trim=True)
X = UnitX(Factor=1)
dispatch = Dispatch(List=flatten(patch), DispatchPattern=[True, False])  # -> ListA, ListB
Y = UnitY(Factor=1)
contour = Contour(Shape=dispatch.ListA, Point=Point(0, 0, 0), Direction=X, Distance=D)  # -> flatten(Contours)
contour_2 = Contour(Shape=dispatch.ListB, Point=Point(0, 0, 0), Direction=Y, Distance=D_2)  # -> flatten(Contours)
dispatch_2 = Dispatch(List=contour, DispatchPattern=[True, False])  # -> ListA, ListB
dispatch_3 = Dispatch(List=contour_2, DispatchPattern=[True, False])  # -> ListA, ListB
flip_2 = FlipCurve(Curve=dispatch_2.ListB)  # -> Curve, Flag
flip_3 = FlipCurve(Curve=dispatch_3.ListB)  # -> Curve, Flag
weave = Weave(Pattern=[0, 1], Stream0=dispatch_2.ListA, Stream1=flip_2.Curve, NullGaps=False)
weave_2 = Weave(Pattern=[0, 1], Stream0=dispatch_3.ListA, Stream1=flip_3.Curve, NullGaps=False)
disc = Discontinuity(Curve=weave, Level=3)  # -> flatten(Points), Parameters
disc_2 = Discontinuity(Curve=weave_2, Level=3)  # -> flatten(Points), Parameters
cluster_3 = Cluster_49(relay=disc_2.Points, geo=dispatch.ListB)
cluster_4 = Cluster_48(relay=disc.Points, geo=dispatch.ListA)
partition_2 = PartitionList(List=disc.Points, Size=flatten(cluster_4))
partition_3 = PartitionList(List=disc_2.Points, Size=flatten(cluster_3))
dispatch_4 = Dispatch(List=geo_2, DispatchPattern=[True, False])  # -> ListA, ListB
pline = PolyLine(Vertices=partition_2, Closed=False)  # -> flatten(Polyline)
pline_2 = PolyLine(Vertices=partition_3, Closed=False)  # -> flatten(Polyline)
weave_3 = Weave(Pattern=[0, 1], Stream0=dispatch_4.ListA, Stream1=pline, NullGaps=False)
weave_4 = Weave(Pattern=[0, 1], Stream0=dispatch_4.ListB, Stream1=pline_2, NullGaps=False)
weave_5 = Weave(Pattern=[0, 0, 1, 1], Stream0=weave_3, Stream1=weave_4, NullGaps=False)

panel = Panel(weave_5)

lng_3 = ListLength(List=scale_nu_2.Geometry)  # -> flatten(Length)
repeat_2 = RepeatData(Data=Slider(0, range=0..100), Length=2500)
item_2 = ListItem(List=flatten(lng_3), Index=Slider(5, range=0..10), Wrap=True)
item_3 = ListItem(List=flatten(lng_3), Index=Slider(4, range=0..10), Wrap=True)
item_4 = ListItem(List=flatten(lng_3), Index=Slider(3, range=0..10), Wrap=True)
item_5 = ListItem(List=flatten(lng_3), Index=Slider(0, range=0..100), Wrap=True)
item_6 = ListItem(List=flatten(lng_3), Index=Slider(2, range=0..10), Wrap=True)
item_7 = ListItem(List=flatten(lng_3), Index=Slider(1, range=0..1), Wrap=True)
cluster_5 = Cluster_52(L=item_5)
cluster_6 = Cluster_52(L=item_7)
cluster_7 = Cluster_52(L=item_6)
cluster_8 = Cluster_52(L=item_3)
cluster_9 = Cluster_52(L=item_4)
merge = Merge(Data1=cluster_5, Data2=repeat_2)
cluster_10 = Cluster_52(L=item_2)
merge_2 = Merge(Data1=cluster_6, Data2=repeat_2)
dispatch_5 = Dispatch(List=flatten(scale_nu_2.Geometry), DispatchPattern=merge)  # -> ListA, ListB
merge_3 = Merge(Data1=cluster_7, Data2=repeat_2)
dispatch_6 = Dispatch(List=dispatch_5.ListB, DispatchPattern=merge_2)  # -> ListA, ListB
merge_4 = Merge(Data1=cluster_9, Data2=repeat_2)
dispatch_7 = Dispatch(List=dispatch_6.ListB, DispatchPattern=merge_3)  # -> ListA, ListB
merge_5 = Merge(Data1=cluster_8, Data2=repeat_2)
merge_6 = Merge(Data1=cluster_10, Data2=repeat_2)
dispatch_8 = Dispatch(List=dispatch_7.ListB, DispatchPattern=merge_4)  # -> ListA, ListB
dispatch_9 = Dispatch(List=dispatch_8.ListB, DispatchPattern=merge_5)  # -> ListA, ListB
cluster_11 = Cluster_51(C=dispatch_5.ListA)
cluster_12 = Cluster_51(C=dispatch_6.ListA)
cluster_13 = Cluster_51(C=dispatch_7.ListA)
dispatch_10 = Dispatch(List=dispatch_9.ListB, DispatchPattern=merge_6)  # -> ListA, ListB
cluster_14 = Cluster_51(C=dispatch_8.ListA)
cluster_15 = Cluster_51(C=dispatch_9.ListA)
cluster_16 = Cluster_51(C=dispatch_10.ListA)
geo_3 = Geometry(cluster_13)
geo_4 = Geometry(cluster_11)
geo_5 = Geometry(cluster_15)

panel_2 = Panel(lng_3)
flip_4 = FlipCurve(Curve=cluster_12)  # -> Curve, Flag
flip_5 = FlipCurve(Curve=cluster_14)  # -> Curve, Flag
flip_6 = FlipCurve(Curve=cluster_16)  # -> Curve, Flag

geo_6 = Geometry(flip_5.Curve)
geo_7 = Geometry(flip_4.Curve)
geo_8 = Geometry(flip_6.Curve)

merge_7 = Merge(Data1=geo_4, Data2=geo_7, Data3=geo_3, Data4=geo_6, Data5=geo_5, Data6=geo_8)
clean = CleanTree(RemoveNulls=True, RemoveInvalid=True, RemoveEmpty=True, Tree=merge_7)
weave_6 = Weave(Pattern=[0, 1], Stream0=geo_2, Stream1=clean, NullGaps=False)
panel_3 = Panel(weave_6)
clean_2 = CleanTree(RemoveNulls=True, RemoveInvalid=True, RemoveEmpty=True, Tree=[weave_5, weave_6])

partition_4 = PartitionList(List=clean_2, Size=2)
N = ClusterInput()
C = ClusterInput()
series_3 = Series(Start=0, Step=N, Count=C)  # -> reverse(graft(Series))
Z = UnitZ(Factor=expr("-x", series_3))
move = Move(Geometry=partition_4, Motion=Z)  # -> flatten(Geometry), Transform
geo_9 = Geometry(move.Geometry)

geo_10 = ClusterOutput(geo_9)
panel_4 = Panel(move.Geometry)

# ==== cluster Cluster_55
geo = ClusterInput()
geo_2 = Geometry(geo)
item = ListItem(List=flatten(geo_2), Index=0, Wrap=True)
bbox = BoundingBox(Content=item, Plane=PlaneXY(0, 0, 0))  # -> Box, Box_2
debrep = DeconstructBrep(Brep=bbox.Box_2)  # -> Faces, Edges, Vertices
area = Area(Geometry=debrep.Faces)  # -> Area, Centroid
pt = Point(Point(0, 0, 0))
vec2pt = Vector2Pt(PointA=area.Centroid, PointB=pt, Unitize=False)  # -> Vector, Length
G = ClusterInput()
move = Move(Geometry=geo_2, Motion=vec2pt.Vector)  # -> graft(Geometry), Transform
move_2 = Move(Geometry=G, Motion=vec2pt.Vector)  # -> Geometry, Transform
G_2 = ClusterOutput(move_2.Geometry)
mirror = Mirror(Geometry=move.Geometry, Plane=PlaneYZ(0, 0, 0))  # -> Geometry, Transform
mirror_2 = Mirror(Geometry=move_2.Geometry, Plane=PlaneYZ(0, 0, 0))  # -> Geometry, Transform
merge = Merge(Data1=move.Geometry, Data2=mirror.Geometry)
G_3 = ClusterOutput(mirror_2.Geometry)
runion = RegionUnion(Curves=merge)  # -> flatten(Result)
len = Length(Curve=runion)
B = ClusterInput()
smaller = SmallerThan(FirstNumber=len, SecondNumber=B)  # -> SmallerThan, OrEqualTo
dispatch = Dispatch(List=runion, DispatchPattern=smaller.SmallerThan)  # -> ListA, flatten(ListB)
geo_3 = Geometry(dispatch.ListA)
reb = RebuildCurve(Curve=dispatch.ListB, Degree=3, Count=Slider(90, range=0..100), Tangents=False)
item_2 = ListItem(List=reb, Index=0, Wrap=True)
flip = FlipCurve(Curve=reb, Guide=item_2)  # -> Curve, Flag
G_4 = ClusterInput()
gate = StreamGate(Stream=flip.Curve, Gate=G_4)  # -> Target0, Target1
_1 = ClusterOutput(gate.Target1)

# ==== cluster Cluster_56
geo = Geometry([<brep referenced from the Rhino model> x2])
contour = Contour(Shape=geo, Point=Point(0, 0, 0), Direction=Vector(0, 0, 1), Distance=Slider(1.8, range=0..40))
lng = ListLength(List=flatten(contour))
lng_2 = ListLength(List=geo)
reb = RebuildCurve(Curve=contour, Count=Slider(50, range=0..100), Tangents=False)
division = Division(A=lng, B=lng_2)
split = SplitList(List=flatten(reb), Index=division)  # -> graft(ListA), graft(ListB)
merge = Merge(Data1=split.ListA, Data2=split.ListB)
runion = RegionUnion(Curves=merge)  # -> flatten(Result)

# ==== cluster Cluster_57

number_slider = Slider(30, range=0..30)
division = Division(A=1, B=number_slider)
range = Range(Domain=Domain(0, 1), Steps=expr("x-1", Slider(5, range=0..30)))
series = Series(Start=0, Step=division, Count=number_slider)
repeat = RepeatData(Data=graft(range), Length=number_slider)
loft = Loft(Options={Adjust=True, Closed=False, LoftEnds=0, LoftSimp=1, LoftType=0, Rebuild=30, Refit=0.01})
pt = ConstructPoint(XCoordinate=repeat, YCoordinate=series, ZCoordinate=0)  # -> flatten(Point)
split = SplitList(List=pt, Index=number_slider)  # -> ListA, ListB
panel = Panel(split.ListA)
number_slider_2 = Slider(0.02, range=0..0.1)
pdecon = Deconstruct(Point=split.ListB)  # -> XComponent, YComponent, ZComponent
dispatch = Dispatch(List=pdecon.XComponent, DispatchPattern=[True, False])  # -> ListA, ListB
dispatch_2 = Dispatch(List=dispatch.ListB, DispatchPattern=[True, False])  # -> ListA, ListB
addition = Addition(A=dispatch_2.ListA, B=number_slider_2)
subtraction = Subtraction(A=dispatch_2.ListB, B=number_slider_2)
weave = Weave(Pattern=[0, 1], Stream0=addition, Stream1=subtraction, NullGaps=False)
weave_2 = Weave(Pattern=[0, 1], Stream0=dispatch.ListA, Stream1=weave, NullGaps=False)
pt_2 = ConstructPoint(XCoordinate=weave_2, YCoordinate=pdecon.YComponent, ZCoordinate=0)
merge = Merge(Data1=split.ListA, Data2=pt_2)
evalsrf = EvaluateSurface(Surface=reparameterize(loft), Point=merge)  # -> Point, Normal, UDirection, VDirection, Frame
partition = PartitionList(List=evalsrf.Point, Size=number_slider)
intcrv = Interpolate(Vertices=partition, Degree=3, Periodic=True, KnotStyle=1)  # -> flatten(Curve), Length, Domain
intcrv_2 = Interpolate(Vertices=partition, Degree=3, Periodic=True, KnotStyle=1)  # -> Curve, Length, Domain
item = ListItem(List=intcrv.Curve, Index=0, Wrap=True)
pline = PolyLine(Vertices=partition, Closed=True)
flip = FlipCurve(Curve=intcrv.Curve, Guide=item)  # -> Curve, Flag
loft_2 = Loft(
    Curves=flatten(intcrv_2.Curve),
    Options={Adjust=False, Closed=False, LoftEnds=0, LoftSimp=0, LoftType=0, Rebuild=10, Refit=0.01})
loft_3 = Loft(
    Curves=flatten(flip.Curve),
    Options={Adjust=True, Closed=False, LoftEnds=0, LoftSimp=1, LoftType=0, Rebuild=60, Refit=0.01})
pt_3 = Point(evalsrf.Point)

# ==== cluster Cluster_58
C = ClusterInput()
reb = RebuildCurve(Curve=C, Degree=3, Count=46, Tangents=False)
P = ClusterInput()
dispatch = Dispatch(List=reb, DispatchPattern=P)  # -> ListA, ListB
P_2 = ClusterInput()
dispatch_2 = Dispatch(List=dispatch.ListB, DispatchPattern=P_2)  # -> ListA, ListB
N = ClusterInput()
N_2 = ClusterInput()
N_3 = ClusterInput()
divide = DivideCurve(Curve=dispatch_2.ListA, Count=N, Kinks=False)  # -> Points, Tangents, Parameters
divide_2 = DivideCurve(Curve=dispatch_2.ListB, Count=N_2, Kinks=False)  # -> Points, Tangents, Parameters
divide_3 = DivideCurve(Curve=dispatch.ListA, Count=N_3, Kinks=False)  # -> Points, Tangents, Parameters
loft = Loft(Curves=reb, Options={Adjust=True, Closed=False, LoftEnds=0, LoftSimp=1, LoftType=0, Rebuild=46, Refit=0.01})
dispatch_3 = Dispatch(List=divide.Points, DispatchPattern=[True, False])  # -> ListA, ListB
dispatch_4 = Dispatch(List=divide_2.Points, DispatchPattern=[True, False])  # -> ListA, ListB
brep_cp = BrepClosestPoint(Point=dispatch_4.ListA, Brep=loft)  # -> Point, Normal, Distance
brep_cp_2 = BrepClosestPoint(Point=dispatch_3.ListB, Brep=loft)  # -> Point, Normal, Distance
brep_cp_3 = BrepClosestPoint(Point=dispatch_4.ListB, Brep=loft)  # -> Point, Normal, Distance
brep_cp_4 = BrepClosestPoint(Point=dispatch_3.ListA, Brep=loft)  # -> Point, Normal, Distance
devec = DeconstructVector(Vector=brep_cp_2.Normal)  # -> XComponent, YComponent, ZComponent
devec_2 = DeconstructVector(Vector=brep_cp.Normal)  # -> XComponent, YComponent, ZComponent
devec_3 = DeconstructVector(Vector=brep_cp_3.Normal)  # -> XComponent, YComponent, ZComponent
devec_4 = DeconstructVector(Vector=brep_cp_4.Normal)  # -> XComponent, YComponent, ZComponent
vec = VectorXYZ(XComponent=devec.XComponent, YComponent=devec.YComponent, ZComponent=0)  # -> Vector, Length
A = ClusterInput()
vec_2 = VectorXYZ(XComponent=devec_2.XComponent, YComponent=devec_2.YComponent, ZComponent=0)  # -> Vector, Length
A_2 = ClusterInput()
vec_3 = VectorXYZ(XComponent=devec_3.XComponent, YComponent=devec_3.YComponent, ZComponent=0)  # -> Vector, Length
A_3 = ClusterInput()
vec_4 = VectorXYZ(XComponent=devec_4.XComponent, YComponent=devec_4.YComponent, ZComponent=0)  # -> Vector, Length
A_4 = ClusterInput()
amp = Amplitude(Vector=vec.Vector, Amplitude=A)
amp_2 = Amplitude(Vector=vec_3.Vector, Amplitude=A_2)
amp_3 = Amplitude(Vector=vec_2.Vector, Amplitude=A_3)
pline = PolyLine(Vertices=divide_3.Points, Closed=True)
amp_4 = Amplitude(Vector=vec_4.Vector, Amplitude=A_4)
move = Move(Geometry=dispatch_3.ListB, Motion=amp)  # -> Geometry, Transform
move_2 = Move(Geometry=dispatch_4.ListB, Motion=amp_2)  # -> Geometry, Transform
move_3 = Move(Geometry=dispatch_4.ListA, Motion=amp_3)  # -> Geometry, Transform
move_4 = Move(Geometry=dispatch_3.ListA, Motion=amp_4)  # -> Geometry, Transform
weave = Weave(Pattern=[0, 1], Stream0=move_4.Geometry, Stream1=move.Geometry, NullGaps=False)
weave_2 = Weave(Pattern=[0, 1], Stream0=move_3.Geometry, Stream1=move_2.Geometry, NullGaps=False)
pline_2 = PolyLine(Vertices=weave, Closed=True)
pline_3 = PolyLine(Vertices=weave_2, Closed=True)
P_3 = ClusterInput()
weave_3 = Weave(Pattern=P_3, Stream0=flatten(pline_2), Stream1=flatten(pline_3), NullGaps=False)
P_4 = ClusterInput()
weave_4 = Weave(Pattern=P_4, Stream0=flatten(pline), Stream1=flatten(weave_3), NullGaps=False)  # -> flatten(Weave)
geo = Geometry(weave_4)
geo_2 = ClusterOutput(geo)

# ==== cluster Cluster_59
geo = ClusterInput()
relay = ClusterInput()
geo_2 = Geometry(geo)
N = ClusterInput()
P = ClusterInput()
dispatch = Dispatch(List=geo_2, DispatchPattern=P)  # -> ListA, ListB
G = ClusterInput()
G_2 = ClusterInput()
D = ClusterInput()
loft = Loft(Curves=geo_2, Options={Adjust=True, Closed=False, LoftEnds=0, LoftSimp=1, LoftType=0, Rebuild=50, Refit=0.01})
relay_2 = ClusterInput()
divide = DivideCurve(Curve=dispatch.ListB, Count=relay, Kinks=False)  # -> Points, Tangents, Parameters
num = ClusterInput()
G_3 = ClusterInput()
lng = ListLength(List=dispatch.ListB)

# ---- group: rotation
int = Integer(lng)
series = Series(Start=0, Step=N, Count=int)
gate = StreamGate(Stream=series, Gate=G)  # -> Target0, Target1
filter = StreamFilter(Gate=G_2, Stream1=-1)
repeat = RepeatData(Data=D, Length=int)
multiplication = Multiplication(A=gate.Target1, B=filter)
clean = CleanTree(RemoveNulls=True, RemoveInvalid=True, RemoveEmpty=True, Tree=multiplication)
filter_2 = StreamFilter(Gate=G_3, Stream0=repeat, Stream1=[clean, gate.Target0])
int_2 = Integer(graft(filter_2))

# ----
int_3 = ClusterOutput(int)
shift = ShiftList(List=divide.Points, Shift=int_2, Wrap=True)
dispatch_2 = Dispatch(List=shift, DispatchPattern=invert(relay_2))  # -> ListA, ListB
num_2 = Number(num)
brep_cp = BrepClosestPoint(Point=dispatch_2.ListB, Brep=loft)  # -> Point, Normal, Distance
repeat_2 = RepeatData(Data=num_2, Length=lng)  # -> graft(Data)
divide_2 = DivideCurve(Curve=dispatch.ListA, Count=relay, Kinks=False)  # -> Points, Tangents, Parameters
devec = DeconstructVector(Vector=brep_cp.Point)  # -> XComponent, YComponent, ZComponent
vec = VectorXYZ(XComponent=devec.XComponent, YComponent=devec.YComponent, ZComponent=0)  # -> Vector, Length
panel = Panel(int_2)
panel_2 = Panel(vec.Vector)
panel_3 = Panel(repeat_2)
amp = Amplitude(Vector=vec.Vector, Amplitude=repeat_2)
move = Move(Geometry=dispatch_2.ListB, Motion=amp)  # -> Geometry, Transform
weave = Weave(Pattern=relay_2, Stream0=dispatch_2.ListA, Stream1=move.Geometry, NullGaps=False)
pline = PolyLine(Vertices=weave, Closed=True)  # -> flatten(Polyline)
pline_2 = PolyLine(Vertices=divide_2.Points, Closed=True)  # -> flatten(Polyline)
P_2 = ClusterInput()
weave_2 = Weave(Pattern=P_2, Stream0=pline_2, Stream1=pline, NullGaps=False)
W = ClusterOutput(weave_2)

# ==== cluster Cluster_60
num = ClusterInput()
num_2 = ClusterInput()
relay = ClusterInput()
num_3 = Number(num)
num_4 = Number(num_2)
int = ClusterInput()
P = ClusterInput()
int_2 = Integer(int)
dispatch = Dispatch(List=relay, DispatchPattern=P)  # -> ListA, ListB
P_2 = ClusterInput()
dispatch_2 = Dispatch(List=dispatch.ListB, DispatchPattern=P_2)  # -> ListA, ListB
divide = DivideCurve(Curve=dispatch_2.ListB, Count=int_2, Kinks=False)  # -> Points, Tangents, Parameters
loft = Loft(Curves=relay, Options={Adjust=True, Closed=False, LoftEnds=0, LoftSimp=1, LoftType=0, Rebuild=46, Refit=0.01})
divide_2 = DivideCurve(Curve=dispatch_2.ListA, Count=int_2, Kinks=False)  # -> Points, Tangents, Parameters
divide_3 = DivideCurve(Curve=dispatch.ListA, Count=int_2, Kinks=False)  # -> Points, Tangents, Parameters
brep_cp = BrepClosestPoint(Point=divide_2.Points, Brep=loft)  # -> Point, Normal, Distance
brep_cp_2 = BrepClosestPoint(Point=divide.Points, Brep=loft)  # -> Point, Normal, Distance
devec = DeconstructVector(Vector=brep_cp.Normal)  # -> XComponent, YComponent, ZComponent
devec_2 = DeconstructVector(Vector=brep_cp_2.Normal)  # -> XComponent, YComponent, ZComponent
pline = PolyLine(Vertices=divide_3.Points, Closed=True)  # -> flatten(Polyline)
vec = VectorXYZ(XComponent=devec.XComponent, YComponent=devec.YComponent, ZComponent=0)  # -> Vector, Length
vec_2 = VectorXYZ(XComponent=devec_2.XComponent, YComponent=devec_2.YComponent, ZComponent=0)  # -> Vector, Length
amp = Amplitude(Vector=vec.Vector, Amplitude=num_3)
amp_2 = Amplitude(Vector=vec.Vector, Amplitude=num_4)
amp_3 = Amplitude(Vector=vec_2.Vector, Amplitude=num_3)
amp_4 = Amplitude(Vector=vec_2.Vector, Amplitude=num_4)
move = Move(Geometry=divide_2.Points, Motion=amp_2)  # -> Geometry, Transform
move_2 = Move(Geometry=divide_2.Points, Motion=amp)  # -> Geometry, Transform
panel = Panel("""1
0
0
1""")
panel_2 = Panel("""1
1
0
0""")
move_3 = Move(Geometry=divide.Points, Motion=amp_4)  # -> Geometry, Transform
move_4 = Move(Geometry=divide.Points, Motion=amp_3)  # -> Geometry, Transform
shift = ShiftList(List=move_2.Geometry, Shift=-1, Wrap=True)
weave = Weave(Pattern=panel_2, Stream0=move.Geometry, Stream1=shift, NullGaps=False)
weave_2 = Weave(Pattern=panel, Stream0=move_4.Geometry, Stream1=move_3.Geometry, NullGaps=False)
pline_2 = PolyLine(Vertices=weave, Closed=True)  # -> flatten(Polyline)
pline_3 = PolyLine(Vertices=weave_2, Closed=True)  # -> flatten(Polyline)
P_3 = ClusterInput()
weave_3 = Weave(Pattern=P_3, Stream0=pline_2, Stream1=pline_3, NullGaps=False)
P_4 = ClusterInput()
weave_4 = Weave(Pattern=P_4, Stream0=pline, Stream1=weave_3, NullGaps=False)
W = ClusterOutput(weave_4)

# ==== cluster Cluster_62
P = ClusterInput()
geo = ClusterInput()

# ---- group: aligning curves
geo_2 = Geometry(geo)
cp = ControlPoints(Curve=geo_2)  # -> Points, Weights, Knots
cullpt = CullDuplicates(Points=cp.Points, Tolerance=0.1, CullMode=3)  # -> Points, Indices, Valence
pline = PolyLine(Vertices=cullpt.Points, Closed=True)  # -> flatten(Polyline)
geo_3 = Geometry(pline)

# ----
dispatch = Dispatch(List=geo_2, DispatchPattern=P)  # -> ListA, ListB
lng = ListLength(List=dispatch.ListA)
py3 = Python3Script(x=lng)  # -> out, a
# ---------- py3: Python ----------
if x >= 1:
    a = 1
elif x == 0:
    a = 0
# ---------- end py3 ----------
md_slider = MDSlider(
    SliderMode=0,
    slider_value=Point(0.9029903927, 0.1962116521, 0.5),
    x_domain=Domain(0, 1),
    y_domain=Domain(0, 1),
    z_domain=Domain(0, 1))
panel = Panel(py3.a)
filter = StreamFilter(Gate=py3.a, Stream0=dispatch.ListB, Stream1=dispatch.ListA)
number_slider = Slider(10, range=0..10)
loft = Loft(Curves=filter, Options={Adjust=True, Closed=False, LoftEnds=0, LoftSimp=1, LoftType=0, Rebuild=100, Refit=0.01})
iso = IsoCurve(Surface=reparameterize(loft), UVPoint=md_slider)  # -> UIsocurve, VIsocurve
ext = ExtendCurve(Curve=iso.UIsocurve, Type=2, Start=number_slider, End=number_slider)
divide = DivideCurve(Curve=ext, Count=expr("x-1", 36), Kinks=False)  # -> Points, Tangents, Parameters
number_slider_2 = Slider(5, range=0..25)
brep_cp = BrepClosestPoint(Point=divide.Points, Brep=loft)  # -> Point, Normal, Distance
amp = Amplitude(Vector=brep_cp.Normal, Amplitude=expr("-x", number_slider_2))
amp_2 = Amplitude(Vector=brep_cp.Normal, Amplitude=number_slider_2)
move = Move(Geometry=divide.Points, Motion=amp_2)  # -> Geometry, Transform
move_2 = Move(Geometry=divide.Points, Motion=amp)  # -> Geometry, Transform
pline_2 = PolyLine(Vertices=move_2.Geometry, Closed=False)
pline_3 = PolyLine(Vertices=move.Geometry, Closed=False)
loft_2 = Loft(
    Curves=[pline_3, pline_2],
    Options={Adjust=True, Closed=False, LoftEnds=0, LoftSimp=1, LoftType=0, Rebuild=50, Refit=0.01})
split = SplitWithBrep(Curve=flatten(geo_3), Brep=flatten(loft_2))  # -> Curve, Points
cp_2 = ControlPoints(Curve=split.Curve)  # -> Points, Weights, Knots
cull_i = CullIndex(List=cp_2.Points, Indices=0, Wrap=True)
cull_i_2 = CullIndex(List=cull_i, Indices=-1, Wrap=True)
cullpt_2 = CullDuplicates(Points=cull_i_2, Tolerance=0.1, CullMode=3)  # -> Points, Indices, Valence
clean = CleanTree(RemoveNulls=True, RemoveInvalid=True, RemoveEmpty=True, Tree=cull_i_2)
panel_2 = Panel(loft_2)
pline_4 = PolyLine(Vertices=clean, Closed=False)
int = ClusterInput()
number_slider_3 = Slider(0.5, range=0..1)

# ---- group: curves to vase mode
cp_3 = ControlPoints(Curve=flatten(pline_4))  # -> Points, Weights, Knots
lng_2 = ListLength(List=cp_3.Points)
item = ListItem(List=flatten(lng_2), Index=0, Wrap=True)
item_2 = ListItem(List=cp_3.Points, Index=-1, Wrap=True)  # -> flatten(Item)
int_2 = Integer(int)
cull_i_3 = CullIndex(List=item_2, Indices=-1, Wrap=True)
cull_i_4 = CullIndex(List=item_2, Indices=0, Wrap=True)
pdecon = Deconstruct(Point=cull_i_3)  # -> XComponent, YComponent, ZComponent
pdecon_2 = Deconstruct(Point=cull_i_4)  # -> XComponent, YComponent, ZComponent
subtraction = Subtraction(A=pdecon_2.ZComponent, B=pdecon.ZComponent)
dom = ConstructDomain(DomainStart=0, DomainEnd=subtraction)

# ----
series = Series(Start=0, Step=1, Count=expr("x", item))
dom_2 = ConstructDomain(DomainStart=0, DomainEnd=int_2)
merge = Merge(Data1=flatten(dom), Data2=dom_2)
item_3 = ListItem(List=flatten(cp_3.Points), Index=series, Wrap=True)

# ---- group: curves to vase mode (continued)
range = Range(Domain=merge, Steps=expr("x-1", item))
Z = UnitZ(Factor=range)
move_3 = Move(Geometry=cp_3.Points, Motion=Z)  # -> Geometry, Transform

# ----
cluster = Cluster_61(D=number_slider_3, A=int_2, L_2=item, B=number_slider_3, L=range, i=series)
series_2 = Series(Start=0, Step=1, Count=cluster)
cull_i_5 = CullIndex(List=item_3, Indices=series_2, Wrap=True)
pline_5 = PolyLine(Vertices=flatten(cull_i_5), Closed=False)
panel_3 = Panel(range)
cp_4 = ControlPoints(Curve=pline_5)  # -> Points, Weights, Knots
merge_2 = Merge(Data1=cp_4.Points, Data2=move_3.Geometry)
pline_6 = PolyLine(Vertices=flatten(merge_2), Closed=False)

# ---- group: curves to vase mode (continued)
panel_4 = Panel(pline_6)

# ----
pl = ClusterOutput(pline_6)

# ==== cluster Cluster_70

# ----
# top layer flatening offset, changes how much it flatens by
panel = Panel("""true= walls 
false= vase mode """)

# ---- group: vase mode!!! doesnt matter, planar non planar
# its like 90% there it doesnt work perfect for non planar, probably just need to adjust how i extend the crv to align the curves
# planar test surface
# then use the shift indexs on the non planar
# kinda useful for clay vase mode but this helps ensure that the top surface is nice and needs very litte cleaning up by bringing the top of the curve down by 1 layer hieght.
flattening_on_the_top_line = Slider(54, range=0..54)
shift_amount_inverted_0_is_full_vase_mod = Slider(0, range=0..150)  # "shift amount, inverted (0 is full vase mode)"

# ---- group: offset multiplier
# this alows for slight motifications of the distances between walls
number_slider = Slider(5, range=-5..5)

# ----
geo = Geometry()
num = ClusterInput()
P = ClusterInput()
A = ClusterInput()

toggle = BooleanToggle(False)
cluster = Cluster_64(geo_2=geo, A=A, B=number_slider, geo=geo, B_2=Slider(0.38, range=0..1), G=toggle, G_2=toggle, num=num)

num_2 = ClusterInput()
cluster_2 = Cluster_69(
    int=shift_amount_inverted_0_is_full_vase_mod,
    B=flattening_on_the_top_line,
    N=flattening_on_the_top_line,
    geo=geo,
    int_2=num,
    P=P)

# ==== cluster CrazySputnikIdea
layerhieght = Slider(0.2, range=0..1)
bigger_support_srf = Surface(<surface referenced from the Rhino model>)
contour = Contour(Shape=bigger_support_srf, Point=Point(0, 0, 0), Direction=Vector(0, 0, 1), Distance=layerhieght)  # -> flatten(Contours)
srf = Surface(<surface referenced from the Rhino model>)
cull_i = CullIndex(List=contour, Indices=0, Wrap=True)
contour_2 = Contour(Shape=srf, Point=Point(0, 0, 0), Direction=Vector(0, 0, 1), Distance=layerhieght)  # -> flatten(Contours)
cull_i_2 = CullIndex(List=contour_2, Indices=-1, Wrap=True)
cull_i_3 = CullIndex(List=cull_i, Indices=-1, Wrap=True)
item = ListItem(List=cull_i, Index=-1, Wrap=True)
reb = RebuildCurve(Curve=item, Count=Slider(64, range=0..100), Tangents=False)
cull_i_4 = CullIndex(List=cull_i_2, Indices=-1, Wrap=True)
item_2 = ListItem(List=cull_i_2, Index=-1, Wrap=True)
reb_2 = RebuildCurve(Curve=item_2, Count=Slider(30, range=0..100), Tangents=False)
area = Area(Geometry=reb)  # -> Area, Centroid
number_slider = Slider(0.9, range=0..1)
number_slider_2 = Slider(1.1, range=0..10)
area_2 = Area(Geometry=reb_2)  # -> Area, Centroid
number_slider_3 = Slider(0.9, range=0..1)
number_slider_4 = Slider(1.1, range=0..10)
scale_nu = ScaleNU(Geometry=reb, Plane=area.Centroid, ScaleX=number_slider_2, ScaleY=number_slider_2, ScaleZ=1)  # -> Geometry, Transform
scale_nu_2 = ScaleNU(Geometry=reb, Plane=area.Centroid, ScaleX=number_slider, ScaleY=number_slider, ScaleZ=1)  # -> Geometry, Transform
scale_nu_3 = ScaleNU(Geometry=reb_2, Plane=area_2.Centroid, ScaleX=number_slider_3, ScaleY=number_slider_3, ScaleZ=1)  # -> Geometry, Transform
cp = ControlPoints(Curve=scale_nu_2.Geometry)  # -> Points, Weights, Knots
cp_2 = ControlPoints(Curve=scale_nu.Geometry)  # -> Points, Weights, Knots
scale_nu_4 = ScaleNU(Geometry=reb_2, Plane=area_2.Centroid, ScaleX=number_slider_4, ScaleY=number_slider_4, ScaleZ=1)  # -> Geometry, Transform
dispatch = Dispatch(List=cp_2.Points, DispatchPattern=[True, False])  # -> ListA, ListB
dispatch_2 = Dispatch(List=cp.Points, DispatchPattern=[True, False])  # -> ListA, ListB
cp_3 = ControlPoints(Curve=scale_nu_3.Geometry)  # -> Points, Weights, Knots
cp_4 = ControlPoints(Curve=scale_nu_4.Geometry)  # -> Points, Weights, Knots
dispatch_3 = Dispatch(List=cp_4.Points, DispatchPattern=[True, False])  # -> ListA, ListB
dispatch_4 = Dispatch(List=cp_3.Points, DispatchPattern=[True, False])  # -> ListA, ListB
cull_i_5 = CullIndex(List=dispatch.ListB, Indices=-1, Wrap=True)
cull_i_6 = CullIndex(List=dispatch_2.ListA, Indices=-1, Wrap=True)
weave = Weave(Pattern=[0, 1], Stream0=cull_i_6, Stream1=cull_i_5, NullGaps=False)
cull_i_7 = CullIndex(List=dispatch_3.ListB, Indices=-1, Wrap=True)
cull_i_8 = CullIndex(List=dispatch_4.ListA, Indices=-1, Wrap=True)
intcrv = Interpolate(Vertices=weave, Degree=3, Periodic=True, KnotStyle=1)  # -> Curve, Length, Domain
weave_2 = Weave(Pattern=[0, 1], Stream0=cull_i_8, Stream1=cull_i_7, NullGaps=False)
intcrv_2 = Interpolate(Vertices=weave_2, Degree=3, Periodic=True, KnotStyle=1)  # -> Curve, Length, Domain
merge = Merge(Data1=cull_i_3, Data2=intcrv.Curve)  # -> flatten(Result)
merge_2 = Merge(Data1=cull_i_4, Data2=intcrv_2.Curve)  # -> flatten(Result)
Z = UnitZ(Factor=expr("x+.1", layerhieght))
move = Move(Geometry=item, Motion=Z)  # -> Geometry, Transform
weave_3 = Weave(Pattern=[0, 1], Stream0=merge, Stream1=merge_2, NullGaps=False)
item_3 = ListItem(List=weave_3, Index=Slider(2, range=0..1000), Wrap=True)
geo = Geometry(item_3)
reb_3 = RebuildCurve(Curve=move.Geometry, Count=Slider(114, range=0..300), Tangents=False)
cp_5 = ControlPoints(Curve=reb_3)  # -> Points, Weights, Knots
dispatch_5 = Dispatch(List=cp_5.Points, DispatchPattern=[True, False])  # -> ListA, reverse(ListB)
Z_2 = UnitZ(Factor=layerhieght)
cull_i_9 = CullIndex(List=dispatch_5.ListA, Indices=-1, Wrap=True)
cull_i_10 = CullIndex(List=dispatch_5.ListB, Indices=1, Wrap=True)
move_2 = Move(Geometry=move.Geometry, Motion=Z_2)  # -> Geometry, Transform
weave_4 = Weave(Pattern=[0, 1], Stream0=cull_i_10, Stream1=dispatch_5.ListA, NullGaps=False)
move_3 = Move(Geometry=move_2.Geometry, Motion=Z_2)  # -> Geometry, Transform
intcrv_3 = Interpolate(Vertices=weave_4, Degree=3, Periodic=False, KnotStyle=1)  # -> Curve, Length, Domain
move_4 = Move(Geometry=intcrv_3.Curve, Motion=Z_2)  # -> Geometry, Transform
base_geometry_for_next_steps = Geometry(move_3.Geometry)
middle_crv = Geometry(<curve referenced from the Rhino model>)
end = Geometry(<curve referenced from the Rhino model>)
area_3 = Area(Geometry=reb_3)  # -> Area, Centroid
rotate = Rotate(Geometry=move_4.Geometry, Angle=degrees(90), Plane=area_3.Centroid)  # -> Geometry, Transform
area_4 = Area(Geometry=base_geometry_for_next_steps)  # -> Area, Centroid
area_5 = Area(Geometry=end)  # -> Area, Centroid
pdecon = Deconstruct(Point=area_4.Centroid)  # -> XComponent, YComponent, ZComponent
topoly = CurveToPolyline(Curve=middle_crv, ToleranceDistance=Slider(0.1, range=0..0.1), ToleranceAngle=0)  # -> Polyline, Segments
pdecon_2 = Deconstruct(Point=area_5.Centroid)  # -> XComponent, YComponent, ZComponent
pcen = PolygonCenter(Polyline=topoly.Polyline)  # -> CenterV, CenterE, CenterA
pdecon_3 = Deconstruct(Point=pcen.CenterE)  # -> XComponent, YComponent, ZComponent
subtraction = Subtraction(A=pdecon_2.ZComponent, B=pdecon_3.ZComponent)
subtraction_2 = Subtraction(A=pdecon_3.ZComponent, B=pdecon.ZComponent)
division = Division(A=subtraction_2, B=layerhieght)
division_2 = Division(A=subtraction, B=layerhieght)
range = Range(Domain=Domain(0, 1), Steps=division)
range_2 = Range(Domain=Domain(0, 1), Steps=division_2)
tweencrv = TweenCurve(CurveA=base_geometry_for_next_steps, CurveB=middle_crv, Factor=range, BlendType=0)  # -> flatten(Tween)
tweencrv_2 = TweenCurve(CurveA=middle_crv, CurveB=end, Factor=range_2, BlendType=0)  # -> flatten(Tween)
number_slider_5 = Slider(0.1, range=0..0.1)
dispatch_6 = Dispatch(List=tweencrv, DispatchPattern=[True, True, False])  # -> ListA, ListB
dispatch_7 = Dispatch(List=tweencrv_2, DispatchPattern=[True, True, False])  # -> ListA, ListB
topoly_2 = CurveToPolyline(Curve=dispatch_7.ListB, ToleranceDistance=number_slider_5, ToleranceAngle=0)  # -> Polyline, Segments
topoly_3 = CurveToPolyline(Curve=dispatch_6.ListB, ToleranceDistance=number_slider_5, ToleranceAngle=0)  # -> Polyline, Segments
pcen_2 = PolygonCenter(Polyline=topoly_2.Polyline)  # -> CenterV, CenterE, CenterA
pcen_3 = PolygonCenter(Polyline=topoly_3.Polyline)  # -> CenterV, CenterE, CenterA
number_slider_6 = Slider(2.4, range=0..10)
lng = ListLength(List=dispatch_7.ListB)
dom = ConstructDomain(DomainStart=number_slider_6, DomainEnd=Slider(1.1, range=0..10))
range_3 = Range(Domain=dom, Steps=lng)
scale_nu_5 = ScaleNU(Geometry=dispatch_6.ListB, Plane=pcen_3.CenterE, ScaleX=number_slider_6, ScaleY=number_slider_6, ScaleZ=1)  # -> Geometry, Transform
number_slider_7 = Slider(20, range=0..100)
number_slider_8 = Slider(20, range=0..100)
scale_nu_6 = ScaleNU(Geometry=dispatch_7.ListB, Plane=pcen_2.CenterE, ScaleX=range_3, ScaleY=range_3, ScaleZ=1)  # -> Geometry, Transform
reb_4 = RebuildCurve(Curve=scale_nu_5.Geometry, Count=number_slider_7, Tangents=False)
reb_5 = RebuildCurve(Curve=dispatch_6.ListB, Count=number_slider_7, Tangents=False)
reb_6 = RebuildCurve(Curve=scale_nu_6.Geometry, Count=number_slider_8, Tangents=False)
reb_7 = RebuildCurve(Curve=dispatch_7.ListB, Count=number_slider_8, Tangents=False)
cp_6 = ControlPoints(Curve=reb_4)  # -> Points, Weights, Knots
cp_7 = ControlPoints(Curve=reb_5)  # -> Points, Weights, Knots
cp_8 = ControlPoints(Curve=reb_6)  # -> Points, Weights, Knots
cp_9 = ControlPoints(Curve=reb_7)  # -> Points, Weights, Knots
dispatch_8 = Dispatch(List=cp_6.Points, DispatchPattern=[True, False])  # -> ListA, ListB
dispatch_9 = Dispatch(List=cp_7.Points, DispatchPattern=[True, False])  # -> ListA, ListB
dispatch_10 = Dispatch(List=cp_8.Points, DispatchPattern=[True, False])  # -> ListA, ListB
dispatch_11 = Dispatch(List=cp_9.Points, DispatchPattern=[True, False])  # -> ListA, ListB
cull_i_11 = CullIndex(List=dispatch_9.ListA, Indices=-1, Wrap=True)
cull_i_12 = CullIndex(List=dispatch_8.ListB, Indices=-1, Wrap=True)
cull_i_13 = CullIndex(List=dispatch_9.ListB, Indices=-1, Wrap=True)
cull_i_14 = CullIndex(List=dispatch_8.ListA, Indices=-1, Wrap=True)
cull_i_15 = CullIndex(List=dispatch_11.ListA, Indices=-1, Wrap=True)
cull_i_16 = CullIndex(List=dispatch_10.ListB, Indices=-1, Wrap=True)
cull_i_17 = CullIndex(List=dispatch_11.ListB, Indices=-1, Wrap=True)
cull_i_18 = CullIndex(List=dispatch_10.ListA, Indices=-1, Wrap=True)
weave_5 = Weave(Pattern=[0, 1], Stream0=cull_i_11, Stream1=cull_i_12, NullGaps=False)
weave_6 = Weave(Pattern=[0, 1], Stream0=cull_i_14, Stream1=cull_i_13, NullGaps=False)
weave_7 = Weave(Pattern=[0, 1], Stream0=cull_i_15, Stream1=cull_i_16, NullGaps=False)
weave_8 = Weave(Pattern=[0, 1], Stream0=cull_i_18, Stream1=cull_i_17, NullGaps=False)
intcrv_4 = Interpolate(Vertices=weave_5, Degree=3, Periodic=True, KnotStyle=1)  # -> Curve, Length, Domain
intcrv_5 = Interpolate(Vertices=weave_6, Degree=3, Periodic=True, KnotStyle=1)  # -> Curve, Length, Domain
intcrv_6 = Interpolate(Vertices=weave_7, Degree=3, Periodic=True, KnotStyle=1)  # -> Curve, Length, Domain
intcrv_7 = Interpolate(Vertices=weave_8, Degree=3, Periodic=True, KnotStyle=1)  # -> Curve, Length, Domain
dispatch_12 = Dispatch(List=flatten(intcrv_4.Curve), DispatchPattern=[True, False])  # -> ListA, ListB
dispatch_13 = Dispatch(List=flatten(intcrv_5.Curve), DispatchPattern=[True, False])  # -> ListA, ListB
dispatch_14 = Dispatch(List=flatten(intcrv_6.Curve), DispatchPattern=[True, False])  # -> ListA, ListB
dispatch_15 = Dispatch(List=flatten(intcrv_7.Curve), DispatchPattern=[True, False])  # -> ListA, ListB
weave_9 = Weave(Pattern=[0, 1], Stream0=dispatch_12.ListA, Stream1=dispatch_13.ListB, NullGaps=False)
weave_10 = Weave(Pattern=[0, 1], Stream0=dispatch_14.ListA, Stream1=dispatch_15.ListB, NullGaps=False)
weave_11 = Weave(Pattern=[0, 0, 1], Stream0=dispatch_6.ListA, Stream1=weave_9, NullGaps=False)
crv = Curve()
weave_12 = Weave(Pattern=[0, 0, 1], Stream0=dispatch_7.ListA, Stream1=weave_10, NullGaps=False)
merge_3 = Merge(
    Data1=flatten(weave_3),
    Data2=flatten(move.Geometry),
    Data3=flatten(intcrv_3.Curve),
    Data4=flatten(move_2.Geometry),
    Data6=flatten(weave_11),
    Data7=flatten(weave_12))
item_4 = ListItem(List=merge_3, Index=Slider(757, range=0..1000), Wrap=True)
gate = StreamGate(Gate=Toggle(False))  # -> Target0, Target1

# ==== cluster Cluster_5

# ---- group: start gcode
panel = Panel("""; ==== Initialize: prevent oozing and enable fans ====
M104 S75                          ; Preheat nozzle slightly to allow fan activation
M710 A1 S255                      ; Turn on motion controller fan (Bambu-specific)""")
panel_2 = Panel("""; ==== Set printer state and Z-axis crash protection ====
M290 X40 Y40 Z2.6666666           ; Set babystepping offset (if previously stored)
G91                               ; Use relative positioning temporarily
M17 Z0.4                          ; Lower Z motor current for crash safety
G380 S2 Z30 F300                  ; Raise bed slowly (clear nozzle area)
G380 S2 Z-25 F300                 ; Lower bed to safe minimum Z
G1 Z5 F300                        ; Raise Z slightly for clearance
G90                               ; Back to absolute positioning
M17 X1.2 Y1.2 Z0.75               ; Restore normal motor currents""")
panel_3 = Panel("""; ==== Set print parameters ====
M220 S100                         ; Reset feedrate to 100%
M221 S100                         ; Reset flowrate to 100%
M204 S10000                       ; Set max acceleration to 10,000 mm/s² (default fast)""")
panel_4 = Panel("""; ==== Activate AMS Slot 1 (Tool 0) ====
T0                                ; Select Tool 0 (assumed AMS slot 1)
M620 S0A                          ; Confirm AMS tool is selected (Bambu command)""")
panel_5 = Panel("""; ==== Preheat bed for PLA ====
M140 S60                          ; Set bed temp for PLA
M190 S60                          ; Wait for bed to reach target temp""")
panel_6 = Panel("""; ==== Turn on fans to prevent PLA jamming ====
M106 P3 S180                      ; Turn on chamber fan for PLA jam prevention
M106 P2 S100                      ; Start toolhead cooling fan""")
panel_7 = Panel("""; ==== Purge line and wipe ====
G1 X20 Y50 F12000                 ; Move to purge start
G1 Y-3                            ; Align with purge line
G1 X54 Y265 F12000                ; Full purge stroke
M400                              ; Wait for move to complete""")
panel_8 = Panel("""; ==== Prepare nozzle ====
M104 S220                         ; Preheat nozzle to print temp for PLA
G91
G0 Z10 F1200                      ; Raise Z before moving
G90
G28 X                             ; Home X to avoid hard stop
G1 X60 Y245 F12000                ; Move near purge position
G1 Y265 F3000                     ; Slow wipe line prep
M109 S220                         ; Wait for nozzle to reach target temp""")
panel_9 = Panel("""; ==== Extrude purge filament ====
G92 E0                            ; Reset extruder
G1 E50 F200                       ; Purge 50mm
M400
G92 E0
G1 E5 F300                        ; Final priming
M109 S200                         ; Slight cool-down for PLA
G92 E0
G1 E-0.5 F300                     ; Small retract""")
panel_10 = Panel("""; ==== Shake and wipe the nozzle ====
G1 X70 F9000
G1 X76 F15000
G1 X65 F15000
G1 X76 F15000
G1 X65 F15000                    ; Shake wipe sequence
G1 X80 F6000
G1 X95 F15000
G1 X80 F15000
G1 X165 F15000                   ; Final fast wipe
M400""")
panel_11 = Panel("""; ==== Final wipe on steel surface ====
G1 X65 Y230 F18000
G1 Y264 F6000
M109 S200                        ; Drop to bed-safe temp
G1 X100 F18000                  ; Wipe mouth pass
G0 X135 Y253 F20000             ; Move to steel wipe zone
G28 Z P0 T300                   ; Home Z safely at high temp
G29.2 S0                        ; Disable ABL (to avoid interference)""")
panel_12 = Panel("""; ==== Second wipe and nozzle prep ====
G1 Z5 F20000
G1 X60 Y265
G92 E0
G1 E-0.5 F300
G1 X100 F5000
G1 X70 F15000
G1 X100 F5000
G1 X70 F15000
G1 X100 F5000
G1 X70 F15000
G1 X90 F5000""")
panel_13 = Panel("""; ==== Bed leveling ====
G29.2 S1                         ; Re-enable ABL
G29 A X0 Y0 I250 J250            ; Perform mesh leveling over full bed
M400
M500                             ; Save mesh""")
panel_14 = Panel("""; ==== Final prep before print ====
G28                              ; Home again after bed leveling
M975 S1                          ; Enable vibration suppression""")
panel_15 = Panel("""; ==== Final low Z spiral wipe ====
G0 X128 Y261 Z-1.5 F20000
M104 S140                        ; Drop nozzle temp further
M106 S255                        ; Force fan on for cooling

; Soft-endstop handling (for safe spiral)
M221 Z0                          ; Disable Z soft-endstop
G0 Z0.5 F20000
G0 X125 Y259.5 Z-1.01
G0 X131 F211
G0 X124
(repeat spiral wipe logic…)

M109 S140                        ; Wait until temp hits 140°C
G2 I0.5 J0 F3000                 ; Spiral wipe cycles
(repeat…)

M221 R                           ; Re-enable Z soft-endstop
G1 Z10 F1200                     ; Raise nozzle before probing
G1 X230 Y15 F30000               ; Park before mesh""")
panel_16 = Panel("""; ==== Textured PEI Plate Z-compensation ====
G29.1 Z-0.04                    ; Lower nozzle slightly for textured surface

; ==== Turn off prep fans ====
M106 S0
M106 P2 S0
M106 P3 S0""")
panel_17 = Panel("""; ==== Load line before print ====
G90
M83
T0
G1 X18.0 Y1.0 Z0.8 F18000
M109 S220
G1 Z0.2
G0 E2 F300
G0 X240 E15 F1200
G0 Y11 E0.700 F300
G0 X239.5
G0 E0.2
G0 Y1.5 E0.700
G0 X18 E15 F1200
M400""")

# ----
merge = Merge(
    Data1=flatten(panel),
    Data2=flatten(panel_2),
    Data3=flatten(panel_3),
    Data4=flatten(panel_4),
    Data5=flatten(panel_5),
    Data6=flatten(panel_6),
    Data7=flatten(panel_8),
    Data8=flatten(panel_7),
    Data9=flatten(panel_9),
    Data10=flatten(panel_10),
    Data11=flatten(panel_11),
    Data12=flatten(panel_12),
    Data13=flatten(panel_15),
    Data14=flatten(panel_13),
    Data15=flatten(panel_14),
    Data16=flatten(panel_17),
    Data17=flatten(panel_16))

R = ClusterOutput(merge)

# ==== cluster Cluster_8
srf = ClusterInput()
number_slider = Slider(500, range=0..1000)
number_slider_2 = Slider(200, range=0..1000)
srf_2 = Surface(reparameterize(srf))
range = Range(Domain=Domain(0, 1), Steps=expr("x-1", number_slider_2))
range_2 = Range(Domain=Domain(0, 1), Steps=expr("x-1", number_slider_2))
crossref = CrossReference(ListA=range_2, ListB=range, CrossMode=1)  # -> ListA, ListB
pt = ConstructPoint(XCoordinate=crossref.ListB, YCoordinate=crossref.ListA, ZCoordinate=0)
image = ImageSampler(
    pt,
    FilePath="C:\Users\ikelo\Downloads\nelsonsface.jpg",
    Filter="Value",
    Interpolate=False,
    Umax=1,
    Umin=0,
    Vmax=1,
    Vmin=0,
    Wrap=2)
bnd = Bounds(Numbers=image)
evalsrf = EvaluateSurface(Surface=srf_2, Point=pt)  # -> Point, Normal, UDirection, VDirection, Frame
dom = ConstructDomain(DomainStart=Slider(1, range=0..1), DomainEnd=Slider(0.05, range=0..0.1))
remap = RemapNumbers(Value=image, Source=bnd, Target=dom)  # -> Mapped, Clipped
multiplication = Multiplication(A=evalsrf.Normal, B=remap.Mapped)
multiplication_2 = Multiplication(A=multiplication, B=Slider(1.3, range=0..10))
move = Move(Geometry=evalsrf.Point, Motion=multiplication_2)  # -> Geometry, Transform
srfgrid = SurfaceFromPoints(Points=move.Geometry, UCount=number_slider_2, Interpolate=False)
S = ClusterOutput(srfgrid)

# ==== cluster Cluster_10
C = ClusterInput()
topoly = CurveToPolyline(Curve=C, ToleranceDistance=Slider(0.1, range=0..0.1), ToleranceAngle=0)  # -> Polyline, Segments
pcen = PolygonCenter(Polyline=topoly.Polyline)  # -> CenterV, CenterE, CenterA
pdecon = Deconstruct(Point=pcen.CenterE)  # -> XComponent, YComponent, ZComponent
Z = ClusterOutput(pdecon.ZComponent)

# ==== cluster Cluster_14
C = ClusterInput()
G = ClusterInput()

# ---- group: centering everyhting around 0
bbox = BoundingBox(Content=C, Plane=PlaneXY(0, 0, 0), UnionBox=True)  # -> Box, Box_2
panel = Panel("""0
1
2
3""")
debrep = DeconstructBrep(Brep=bbox.Box)  # -> Faces, Edges, Vertices
item = ListItem(List=debrep.Edges, Index=panel, Wrap=True)
join = JoinCurves(Curves=item, Preserve=False)
area = Area(Geometry=join)  # -> Area, Centroid
pt = Point(Point(0, 0, 0))
vec2pt = Vector2Pt(PointA=area.Centroid, PointB=pt, Unitize=False)  # -> Vector, Length
move = Move(Geometry=G, Motion=vec2pt.Vector)  # -> Geometry, Transform

# ==== cluster Cluster_21
C = ClusterInput()
reb = RebuildCurve(Curve=C, Degree=3, Count=100, Tangents=False)
cp = ControlPoints(Curve=reb)  # -> Points, Weights, Knots
cullpt = CullDuplicates(Points=cp.Points, Tolerance=0.1, CullMode=3)  # -> Points, Indices, Valence
S = ClusterInput()
shift = ShiftList(List=cullpt.Points, Shift=S, Wrap=True)
intcrv = Interpolate(Vertices=shift, Degree=3, Periodic=True, KnotStyle=1)  # -> Curve, Length, Domain
P = ClusterInput()
loft = Loft(
    Curves=flatten(intcrv.Curve),
    Options={Adjust=False, Closed=False, LoftEnds=0, LoftSimp=1, LoftType=0, Rebuild=60, Refit=0.01})
dispatch = Dispatch(List=flatten(intcrv.Curve), DispatchPattern=P)  # -> ListA, ListB
geo = Geometry(loft)
P_2 = ClusterInput()
dispatch_2 = Dispatch(List=dispatch.ListB, DispatchPattern=P_2)  # -> ListA, ListB
N = ClusterInput()
N_2 = ClusterInput()
divide = DivideCurve(Curve=dispatch_2.ListB, Count=N, Kinks=False)  # -> Points, Tangents, Parameters
G = ClusterInput()
divide_2 = DivideCurve(Curve=dispatch_2.ListA, Count=N_2, Kinks=False)  # -> Points, Tangents, Parameters
G_2 = ClusterInput()
gate = StreamGate(Stream=divide.Points, Gate=G)  # -> Target0, Target1
N_3 = ClusterInput()
gate_2 = StreamGate(Stream=divide_2.Points, Gate=G_2)  # -> Target0, Target1
_0 = ClusterOutput(gate.Target0)
divide_3 = DivideCurve(Curve=dispatch.ListA, Count=N_3, Kinks=False)  # -> Points, Tangents, Parameters
dispatch_3 = Dispatch(List=gate.Target1, DispatchPattern=[True, False])  # -> ListA, ListB
_0_2 = ClusterOutput(gate_2.Target0)
dispatch_4 = Dispatch(List=gate_2.Target1, DispatchPattern=[True, False])  # -> ListA, ListB
brep_cp = BrepClosestPoint(Point=[dispatch_4.ListA, gate_2.Target0], Brep=geo)  # -> Point, Normal, Distance
brep_cp_2 = BrepClosestPoint(Point=[dispatch_3.ListB, gate.Target0], Brep=geo)  # -> Point, Normal, Distance
A = ClusterOutput(dispatch_3.ListA)
B = ClusterOutput(dispatch_3.ListB)
A_2 = ClusterOutput(dispatch_4.ListA)
B_2 = ClusterOutput(dispatch_4.ListB)
pline = PolyLine(Vertices=divide_3.Points, Closed=True)
N_4 = ClusterOutput(brep_cp_2.Normal)
N_5 = ClusterOutput(brep_cp.Normal)
srf_cp = SurfaceClosestPoint(Point=brep_cp.Point, Surface=reparameterize(geo))  # -> Point, UVPoint, Distance
srf_cp_2 = SurfaceClosestPoint(Point=brep_cp_2.Point, Surface=reparameterize(geo))  # -> Point, UVPoint, Distance
pl = ClusterOutput(pline)
uvp = ClusterOutput(srf_cp.UVPoint)
uvp_2 = ClusterOutput(srf_cp_2.UVPoint)

# ==== cluster Cluster_22
relay = ClusterInput()
N = ClusterInput()
N_2 = ClusterInput()
bnd = Bounds(Numbers=N)
bnd_2 = Bounds(Numbers=N_2)
V = ClusterInput()
T = ClusterInput()
V_2 = ClusterInput()
T_2 = ClusterInput()
remap = RemapNumbers(Value=V, Source=bnd, Target=T)  # -> Mapped, Clipped
V_3 = ClusterInput()
remap_2 = RemapNumbers(Value=V_2, Source=bnd_2, Target=T_2)  # -> Mapped, Clipped
amp = Amplitude(Vector=V_3, Amplitude=remap.Mapped)
V_4 = ClusterInput()
relay_2 = ClusterInput()
amp_2 = Amplitude(Vector=V_4, Amplitude=remap_2.Mapped)
devec = DeconstructVector(Vector=amp)  # -> XComponent, YComponent, ZComponent
devec_2 = DeconstructVector(Vector=amp_2)  # -> XComponent, YComponent, ZComponent
vec = VectorXYZ(XComponent=devec.XComponent, YComponent=devec.YComponent, ZComponent=0)  # -> Vector, Length
G = ClusterInput()
vec_2 = VectorXYZ(XComponent=devec_2.XComponent, YComponent=devec_2.YComponent, ZComponent=0)  # -> Vector, Length
G_2 = ClusterInput()
move = Move(Geometry=[relay, G], Motion=vec.Vector)  # -> Geometry, Transform
_1 = ClusterInput()
move_2 = Move(Geometry=G_2, Motion=vec_2.Vector)  # -> Geometry, Transform
_0 = ClusterInput()
weave = Weave(Pattern=[0, 1], Stream0=move.Geometry, Stream1=_1, NullGaps=False)
weave_2 = Weave(Pattern=[0, 1], Stream0=_0, Stream1=move_2.Geometry, NullGaps=False)
filter = StreamFilter(Gate=relay_2, Stream0=move.Geometry, Stream1=weave)
filter_2 = StreamFilter(Gate=relay_2, Stream0=move_2.Geometry, Stream1=weave_2)
pline = PolyLine(Vertices=filter_2, Closed=True)  # -> flatten(Polyline)
pline_2 = PolyLine(Vertices=filter, Closed=True)  # -> flatten(Polyline)
P = ClusterInput()
weave_3 = Weave(Pattern=P, Stream0=pline_2, Stream1=pline, NullGaps=False)
P_2 = ClusterInput()
_0_2 = ClusterInput()
weave_4 = Weave(Pattern=P_2, Stream0=flatten(_0_2), Stream1=flatten(weave_3), NullGaps=False)
W = ClusterOutput(weave_4)

# ==== cluster Cluster_28
L = ClusterInput()
lng = ListLength(List=flatten(L))
L_2 = ClusterInput()
R = ClusterInput()
lng_2 = ListLength(List=L_2)
random = Random(Range=R, Number=lng, Seed=2)
item = ListItem(List=flatten(lng_2), Index=0, Wrap=True)
partition = PartitionList(List=random, Size=item)
C = ClusterOutput(partition)

# ==== cluster Cluster_29
L = ClusterInput()
lng = ListLength(List=flatten(L))
L_2 = ClusterInput()
R = ClusterInput()
lng_2 = ListLength(List=L_2)
random = Random(Range=R, Number=lng, Seed=0)
item = ListItem(List=flatten(lng_2), Index=0, Wrap=True)
partition = PartitionList(List=random, Size=item)
C = ClusterOutput(partition)

# ==== cluster Cluster_30
L = ClusterInput()
lng = ListLength(List=L)
lng_2 = ListLength(List=flatten(lng))
item = ListItem(List=flatten(lng), Index=0, Wrap=True)
dom = ConstructDomain(DomainStart=0, DomainEnd=expr("x/2", item))
random = Random(Range=dom, Number=lng_2, Seed=2)
int = Integer(graft(random))
subtraction = Subtraction(A=item, B=int)  # -> graft(Result)
int_2 = Integer(int)
int_3 = Integer(subtraction)
ipy2 = IronPython2Script(zeros=int_3, ones=int_2)  # -> result, flatten(result_2)
# ---------- ipy2: IronPython ----------
"""
Inputs:
    zeros: int
    ones: int
Outputs:
    result: list
"""

import random

# fallback defaults if inputs are missing
if zeros is None: zeros = 0
if ones is None: ones = 0

# build list
values = [0] * int(zeros) + [1] * int(ones)

# shuffle
random.shuffle(values)

# output
result = values
# ---------- end ipy2 ----------
result = ClusterOutput(ipy2.result_2)

# ==== cluster Cluster_31
L = ClusterInput()

lng = ListLength(List=L)
lng_2 = ListLength(List=flatten(lng))
item = ListItem(List=flatten(lng), Index=0, Wrap=True)
dom = ConstructDomain(DomainStart=0, DomainEnd=expr("x/2", item))
random = Random(Range=dom, Number=lng_2, Seed=3)
int = Integer(graft(random))
subtraction = Subtraction(A=item, B=int)  # -> graft(Result)
int_2 = Integer(int)
int_3 = Integer(subtraction)
ipy2 = IronPython2Script(zeros=int_3, ones=int_2)  # -> result, flatten(result_2); same code as ipy2

result = ClusterOutput(ipy2.result_2)

# ==== cluster Cluster_35
C = ClusterInput()
N = ClusterInput()
reb = RebuildCurve(Curve=C, Degree=3, Count=N, Tangents=False)
int = Integer(2)
G = ClusterInput()
S = ClusterInput()
G_2 = ClusterInput()
P = ClusterInput()
gate = StreamGate(Stream=int, Gate=G)  # -> Target0, Target1
gate_2 = StreamGate(Stream=S, Gate=G_2)  # -> Target0, Target1
dispatch = Dispatch(List=reb, DispatchPattern=P)  # -> ListA, ListB
P_2 = ClusterInput()
subtraction = Subtraction(A=gate.Target0, B=gate_2.Target0)
dispatch_2 = Dispatch(List=dispatch.ListB, DispatchPattern=P_2)  # -> ListA, ListB
X = ClusterInput()
Y = ClusterInput()
geo = Geometry(dispatch.ListA)
N_2 = ClusterInput()

# ---- group: inside droops
cluster = Cluster_34(C=dispatch_2.ListA)
scale_nu = ScaleNU(Geometry=dispatch_2.ListA, Plane=cluster, ScaleX=X, ScaleY=Y, ScaleZ=1)  # -> Geometry, Transform
reb_2 = RebuildCurve(Curve=scale_nu.Geometry, Count=N_2, Tangents=False)
cp = ControlPoints(Curve=dispatch_2.ListA)  # -> Points, Weights, Knots
cp_2 = ControlPoints(Curve=reb_2)  # -> Points, Weights, Knots
dispatch_3 = Dispatch(List=cp.Points, DispatchPattern=[True, False])  # -> ListA, ListB
dispatch_4 = Dispatch(List=cp_2.Points, DispatchPattern=[True, False])  # -> ListA, ListB
geo_2 = Geometry(dispatch_4.ListB)
cull_i = CullIndex(List=dispatch_3.ListA, Indices=-1, Wrap=True)
cull_i_2 = CullIndex(List=dispatch_4.ListB, Indices=-1, Wrap=True)
weave = Weave(Pattern=[0, 1], Stream0=cull_i, Stream1=cull_i_2, NullGaps=False)
pline = PolyLine(Vertices=weave, Closed=True)

# ----
N_3 = ClusterInput()

# ---- group: outside droopys
topoly = CurveToPolyline(Curve=dispatch_2.ListB, ToleranceDistance=Slider(0.1, range=0..0.1), ToleranceAngle=0)  # -> Polyline, Segments
pcen = PolygonCenter(Polyline=topoly.Polyline)  # -> CenterV, CenterE, CenterA
scale_nu_2 = ScaleNU(
    Geometry=dispatch_2.ListB,
    Plane=pcen.CenterE,
    ScaleX=[gate_2.Target1, subtraction],
    ScaleY=[gate_2.Target1, subtraction],
    ScaleZ=1)  # -> Geometry, Transform
reb_3 = RebuildCurve(Curve=scale_nu_2.Geometry, Count=N_3, Tangents=False)
cp_3 = ControlPoints(Curve=dispatch_2.ListB)  # -> Points, Weights, Knots
cp_4 = ControlPoints(Curve=reb_3)  # -> Points, Weights, Knots
dispatch_5 = Dispatch(List=cp_3.Points, DispatchPattern=[True, False])  # -> ListA, ListB
dispatch_6 = Dispatch(List=cp_4.Points, DispatchPattern=[True, False])  # -> ListA, ListB
cull_i_3 = CullIndex(List=dispatch_5.ListB, Indices=-1, Wrap=True)  # -> reverse(List)
cull_i_4 = CullIndex(List=dispatch_6.ListA, Indices=-1, Wrap=True)  # -> reverse(List)
weave_2 = Weave(Pattern=[0, 1], Stream0=cull_i_4, Stream1=cull_i_3, NullGaps=False)  # -> reverse(Weave)
pline_2 = PolyLine(Vertices=weave_2, Closed=True)

# ----
P_3 = ClusterInput()
weave_3 = Weave(Pattern=P_3, Stream0=flatten(pline), Stream1=flatten(pline_2), NullGaps=False)
P_4 = ClusterInput()
weave_4 = Weave(Pattern=P_4, Stream0=flatten(geo), Stream1=flatten(weave_3), NullGaps=False)

# ==== cluster Cluster_38
geo = ClusterInput()
geo_2 = Geometry(geo)
bbox = BoundingBox(Content=geo_2, Plane=PlaneXY(0, 0, 0))  # -> Box, Box_2
debox = DeconstructBox(Box=bbox.Box)  # -> Plane, X, Y, Z
dedomain = DeconstructDomain(Domain=debox.Z)  # -> Start, End
B = ClusterInput()
division = Division(A=dedomain.End, B=B)
range = Range(Domain=Domain(0, 1), Steps=division)
pt = ConstructPoint(XCoordinate=range, YCoordinate=0, ZCoordinate=0)
iso = IsoCurve(Surface=reparameterize(geo_2), UVPoint=pt)  # -> UIsocurve, flatten(VIsocurve)
V = ClusterOutput(iso.VIsocurve)

# ==== cluster Cluster_39
C = ClusterInput()
reb = RebuildCurve(Curve=C, Count=41, Tangents=False)
cp = ControlPoints(Curve=reb)  # -> Points, Weights, Knots
cullpt = CullDuplicates(Points=cp.Points, Tolerance=0.1, CullMode=3)  # -> Points, Indices, Valence
S = ClusterInput()
shift = ShiftList(List=cullpt.Points, Shift=S, Wrap=True)
intcrv = Interpolate(Vertices=shift, Degree=3, Periodic=True, KnotStyle=1)  # -> Curve, Length, Domain
item = ListItem(List=shift, Index=0, Wrap=True)
item_2 = ListItem(List=shift, Index=-1, Wrap=True)
C_2 = ClusterOutput(intcrv.Curve)
intcrv_2 = Interpolate(Vertices=[item, item_2], Degree=3, Periodic=False, KnotStyle=1)  # -> Curve, Length, Domain
midpt = CurveMiddle(Curve=intcrv_2.Curve)
intcrv_3 = Interpolate(Vertices=flatten(midpt), Degree=3, Periodic=False, KnotStyle=1)  # -> Curve, Length, Domain
C_3 = ClusterOutput(intcrv_3.Curve)

# ==== cluster Cluster_40
C = ClusterInput()
cp = ControlPoints(Curve=C)  # -> Points, Weights, Knots
cullpt = CullDuplicates(Points=cp.Points, Tolerance=0.1, CullMode=3)  # -> Points, Indices, Valence
S = ClusterInput()
shift = ShiftList(List=cullpt.Points, Shift=S, Wrap=True)
intcrv = Interpolate(Vertices=shift, Degree=3, Periodic=True, KnotStyle=1)  # -> Curve, Length, Domain
item = ListItem(List=shift, Index=0, Wrap=True)
item_2 = ListItem(List=shift, Index=-1, Wrap=True)
loft = Loft(
    Curves=flatten(intcrv.Curve),
    Options={Adjust=True, Closed=False, LoftEnds=0, LoftSimp=1, LoftType=0, Rebuild=30, Refit=0.01})
intcrv_2 = Interpolate(Vertices=[item, item_2], Degree=3, Periodic=False, KnotStyle=1)  # -> Curve, Length, Domain
midpt = CurveMiddle(Curve=intcrv_2.Curve)
L = ClusterOutput(loft)
intcrv_3 = Interpolate(Vertices=flatten(midpt), Degree=3, Periodic=False, KnotStyle=1)  # -> Curve, Length, Domain
C_2 = ClusterOutput(intcrv_3.Curve)

# ==== cluster Cluster_43
L = ClusterInput()
L_2 = ClusterInput()
repeat = RepeatData(Data=Slider(0, range=0..100), Length=expr("x/2", L))
repeat_2 = RepeatData(Data=Slider(1, range=0..1), Length=expr("x/2", L_2))
merge = Merge(Data1=repeat_2, Data2=repeat)
R = ClusterOutput(merge)

# ==== cluster Cluster_44
A = ClusterInput()
A_2 = ClusterInput()
multiplication = Multiplication(A=A)
multiplication_2 = Multiplication(A=A_2)
L = ClusterInput()
clean = CleanTree(RemoveNulls=True, RemoveInvalid=True, RemoveEmpty=True, Tree=multiplication_2)
clean_2 = CleanTree(RemoveNulls=True, RemoveInvalid=True, RemoveEmpty=True, Tree=multiplication)
repeat = RepeatData(Data=Slider(0, range=0..100), Length=L)
replace = ReplaceItems(List=repeat, Item=clean_2, Indices=clean, Wrap=False)
L_2 = ClusterOutput(replace)

# ==== cluster Cluster_46
T = ClusterInput()
L = ClusterInput()
clean = CleanTree(RemoveNulls=True, RemoveInvalid=True, RemoveEmpty=True, Tree=T)
lng = ListLength(List=L)
multiplication = Multiplication(A=clean, B=1)
repeat = RepeatData(Data=multiplication, Length=lng)  # -> graft(Data)
D = ClusterOutput(repeat)
panel = Panel(repeat)
panel_2 = Panel(ClusterInput())

# ==== cluster Cluster_48
relay = ClusterInput()
geo = ClusterInput()
geo_2 = Geometry(geo)
srf_cp = SurfaceClosestPoint(Point=relay, Surface=graft(geo_2))  # -> Point, UVPoint, Distance
smaller = SmallerThan(FirstNumber=srf_cp.Distance, SecondNumber=Slider(0.01, range=0..0.01))  # -> SmallerThan, OrEqualTo
lng = ListLength(List=smaller.SmallerThan)
series = Series(Start=0, Step=1, Count=lng)
dispatch = Dispatch(List=series, DispatchPattern=smaller.SmallerThan)  # -> ListA, ListB
lng_2 = ListLength(List=dispatch.ListA)
L = ClusterOutput(lng_2)

# ==== cluster Cluster_49
geo = ClusterInput()
relay = ClusterInput()
geo_2 = Geometry(geo)
srf_cp = SurfaceClosestPoint(Point=relay, Surface=graft(geo_2))  # -> Point, UVPoint, Distance
smaller = SmallerThan(FirstNumber=srf_cp.Distance, SecondNumber=Slider(0.01, range=0..0.01))  # -> SmallerThan, OrEqualTo
lng = ListLength(List=smaller.SmallerThan)
series = Series(Start=0, Step=1, Count=lng)
dispatch = Dispatch(List=series, DispatchPattern=smaller.SmallerThan)  # -> ListA, ListB
lng_2 = ListLength(List=dispatch.ListA)
L = ClusterOutput(lng_2)

# ==== cluster Cluster_50
L = ClusterInput()
item = ListItem(List=L, Index=0, Wrap=True)
cp = ControlPoints(Curve=item)  # -> Points, Weights, Knots
topoly = CurveToPolyline(Curve=item, ToleranceDistance=0.01, ToleranceAngle=0)  # -> Polyline, Segments
pcen = PolygonCenter(Polyline=topoly.Polyline)  # -> CenterV, CenterE, CenterA
item_2 = ListItem(List=cp.Points, Index=0, Wrap=True)
pline = PolyLine(Vertices=flatten([item_2, pcen.CenterE]), Closed=False)
len = Length(Curve=pline)
L_2 = ClusterOutput(len)

# ==== cluster Cluster_51
C = ClusterInput()
number_slider = Slider(100, range=0..100)
divide = DivideCurve(Curve=C, Count=number_slider, Kinks=False)  # -> Points, Tangents, Parameters
pdecon = Deconstruct(Point=divide.Points)  # -> XComponent, YComponent, ZComponent
flip = FlipMatrix(Data=divide.Points)
pline = PolyLine(Vertices=flip, Closed=False)
explode = Explode(Curve=pline, Recursive=True)  # -> Segments, Vertices
end = EndPoints(Curve=explode.Segments)  # -> Start, End
vec2pt = Vector2Pt(PointA=end.Start, PointB=end.End, Unitize=False)  # -> Vector, Length
flip_2 = FlipMatrix(Data=vec2pt.Vector)
range = Range(Domain=Domain(0, 1), Steps=expr("x-1", number_slider))
multiplication = Multiplication(A=flip_2, B=range)
move = Move(Geometry=divide.Points, Motion=multiplication)  # -> Geometry, Transform
pline_2 = PolyLine(Vertices=flatten(move.Geometry), Closed=False)
pl = ClusterOutput(pline_2)

# ==== cluster Cluster_52
L = ClusterInput()
repeat = RepeatData(Data=Slider(1, range=0..1), Length=L)
D = ClusterOutput(repeat)

# ==== cluster Cluster_53
C = ClusterInput()
topoly = CurveToPolyline(Curve=C, ToleranceDistance=Slider(0.01, range=0..0.01), ToleranceAngle=0)  # -> Polyline, Segments
pcen = PolygonCenter(Polyline=topoly.Polyline)  # -> CenterV, CenterE, CenterA
ce = ClusterOutput(pcen.CenterE)

# ==== cluster Cluster_61
L = ClusterInput()
i = ClusterInput()
A = ClusterInput()
B = ClusterInput()
item = ListItem(List=flatten(L), Index=i, Wrap=True)
multiplication = Multiplication(A=A, B=B)
D = ClusterInput()
L_2 = ClusterInput()
smaller = SmallerThan(FirstNumber=multiplication, SecondNumber=item)  # -> SmallerThan, OrEqualTo
repeat = RepeatData(Data=D, Length=L_2)
dispatch = Dispatch(List=repeat, DispatchPattern=smaller.SmallerThan)  # -> ListA, ListB
lng = ListLength(List=dispatch.ListA)
L_3 = ClusterOutput(lng)

# ==== cluster Cluster_64
A = ClusterInput()
B = ClusterInput()
geo = ClusterInput()
cluster = Cluster_63(A=A, B=B, geo=geo)
geo_2 = ClusterInput()

# ---- group: seaming for 2 walls
geo_3 = Geometry(geo_2)
cp = ControlPoints(Curve=geo_3)  # -> Points, Weights, Knots
cullpt = CullDuplicates(Points=cp.Points, Tolerance=0.1, CullMode=3)  # -> Points, Indices, Valence
pline = PolyLine(Vertices=cullpt.Points, Closed=True)  # -> flatten(Polyline)
item = ListItem(List=pline, Index=0, Wrap=True)
cp_2 = ControlPoints(Curve=item)  # -> Points, Weights, Knots
lng = ListLength(List=cp_2.Points)  # -> expr("x-1", Length)
reb = RebuildCurve(Curve=cluster, Count=lng, Tangents=False)
cp_3 = ControlPoints(Curve=reb)  # -> Points, Weights, Knots
cullpt_2 = CullDuplicates(Points=cp_3.Points, Tolerance=0.1, CullMode=3)  # -> Points, Indices, Valence
pline_2 = PolyLine(Vertices=cullpt_2.Points, Closed=True)  # -> flatten(Polyline)
geo_4 = Geometry(pline)
item_2 = ListItem(List=geo_4, Index=0, Wrap=True)
cp_4 = ControlPoints(Curve=item_2)  # -> Points, Weights, Knots
number_slider = Slider(1.51, range=1..3)
topoly = CurveToPolyline(Curve=item_2, ToleranceDistance=0.01, ToleranceAngle=0)  # -> Polyline, Segments
item_3 = ListItem(List=cp_4.Points, Index=Slider(1, range=0..15), Wrap=True)
pcen = PolygonCenter(Polyline=topoly.Polyline)  # -> CenterV, CenterE, CenterA
geo_5 = Geometry(pline_2)
multiplication = Multiplication(A=number_slider, B=-1)
vec2pt = Vector2Pt(PointA=pcen.CenterE, PointB=item_3, Unitize=False)  # -> Vector, Length
multiplication_2 = Multiplication(A=vec2pt.Vector, B=[multiplication, number_slider])
extr = Extrude(Base=item_3, Direction=multiplication_2)
cp_5 = ControlPoints(Curve=geo_4)  # -> Points, Weights, Knots
cp_6 = ControlPoints(Curve=geo_5)  # -> Points, Weights, Knots
join = JoinCurves(Curves=extr, Preserve=False)
Z = UnitZ(Factor=Slider(10000, range=0..10000))
extr_2 = Extrude(Base=join, Direction=Z)
srf_cp = SurfaceClosestPoint(Point=cp_5.Points, Surface=extr_2)  # -> Point, UVPoint, Distance
srf_cp_2 = SurfaceClosestPoint(Point=cp_6.Points, Surface=extr_2)  # -> Point, UVPoint, Distance
dist = Distance(PointA=cp_5.Points, PointB=srf_cp.Point)
dist_2 = Distance(PointA=cp_6.Points, PointB=srf_cp_2.Point)
sort = SortList(Keys=dist, ValuesA=cp_5.Points)  # -> Keys, ValuesA
item_4 = ListItem(List=sort.ValuesA, Index=0, Wrap=True)
sort_2 = SortList(Keys=dist_2, ValuesA=cp_6.Points)  # -> Keys, ValuesA
item_5 = ListItem(List=sort_2.ValuesA, Index=0, Wrap=True)
crv_cp = CurveClosestPoint(Point=graft(item_4), Curve=graft(geo_4))  # -> Point, Parameter, Distance
seam = Seam(Curve=graft(geo_4), Seam=crv_cp.Parameter)
crv_cp_2 = CurveClosestPoint(Point=graft(item_5), Curve=graft(geo_5))  # -> Point, Parameter, Distance
seam_2 = Seam(Curve=graft(geo_5), Seam=crv_cp_2.Parameter)
cp_7 = ControlPoints(Curve=seam)  # -> Points, Weights, Knots
cp_8 = ControlPoints(Curve=seam_2)  # -> Points, Weights, Knots
cullpt_3 = CullDuplicates(Points=cp_7.Points, Tolerance=0.1, CullMode=3)  # -> Points, Indices, Valence
cullpt_4 = CullDuplicates(Points=cp_8.Points, Tolerance=0.1, CullMode=3)  # -> Points, Indices, Valence

# ----
G = ClusterInput()
G_2 = ClusterInput()
gate = StreamGate(Stream=cullpt_3.Points, Gate=G)  # -> Target0, Target1
gate_2 = StreamGate(Stream=cullpt_4.Points, Gate=G_2)  # -> Target0, Target1
num = ClusterInput()
num_2 = Number(num)
dom = ConstructDomain(DomainStart=0, DomainEnd=num_2)
B_2 = ClusterInput()
multiplication_3 = Multiplication(A=num_2, B=B_2)

pline_3 = PolyLine(Vertices=gate.Target1, Closed=True)
pline_4 = PolyLine(Vertices=gate_2.Target1, Closed=True)
merge = Merge(Data1=pline_3, Data2=pline_4)  # -> flatten(Result)
panel = Panel("""1
1
0
0""")
lng_2 = ListLength(List=merge)
repeat = RepeatData(Data=panel, Length=expr("x-1", lng_2))
merge_2 = Merge(Data1="0", Data2=repeat)  # -> flatten(Result)
panel_2 = Panel(merge_2)
weave = Weave(Pattern=merge_2, Stream0=flatten(pline_3), Stream1=flatten(pline_4), NullGaps=False)

pline_5 = PolyLine(Vertices=gate.Target0, Closed=False)
pline_6 = PolyLine(Vertices=gate_2.Target0, Closed=False)
dispatch = Dispatch(List=flatten(pline_6), DispatchPattern=[True, False])  # -> ListA, ListB
dispatch_2 = Dispatch(List=flatten(pline_5), DispatchPattern=[True, False])  # -> ListA, ListB
cp_9 = ControlPoints(Curve=dispatch_2.ListA)  # -> Points, Weights, Knots
cp_10 = ControlPoints(Curve=dispatch_2.ListB)  # -> Points, Weights, Knots
cp_11 = ControlPoints(Curve=dispatch.ListA)  # -> Points, Weights, Knots
cp_12 = ControlPoints(Curve=dispatch.ListB)  # -> Points, Weights, Knots
merge_3 = Merge(Data1=cp_12.Points, Data2=cp_10.Points)
merge_4 = Merge(Data1=cp_9.Points, Data2=cp_11.Points)
pline_7 = PolyLine(Vertices=merge_4, Closed=False)
pline_8 = PolyLine(Vertices=merge_3, Closed=False)
merge_5 = Merge(Data1=pline_7, Data2=pline_8)

cp_13 = ControlPoints(Curve=merge_5)  # -> Points, Weights, Knots

pline_9 = PolyLine(Vertices=cp_13.Points, Closed=False)

# ---- group: curves to vase mode
cp_14 = ControlPoints(Curve=flatten(pline_9))  # -> Points, Weights, Knots
lng_3 = ListLength(List=cp_14.Points)
item_6 = ListItem(List=flatten(lng_3), Index=0, Wrap=True)
item_7 = ListItem(List=cp_14.Points, Index=-1, Wrap=True)  # -> flatten(Item)
cull_i = CullIndex(List=item_7, Indices=-1, Wrap=True)
cull_i_2 = CullIndex(List=item_7, Indices=0, Wrap=True)
pdecon = Deconstruct(Point=cull_i)  # -> XComponent, YComponent, ZComponent
pdecon_2 = Deconstruct(Point=cull_i_2)  # -> XComponent, YComponent, ZComponent
subtraction = Subtraction(A=pdecon_2.ZComponent, B=pdecon.ZComponent)
dom_2 = ConstructDomain(DomainStart=0, DomainEnd=subtraction)
dom_3 = ConstructDomain(DomainStart=0, DomainEnd=multiplication_3)
range = Range(Domain=dom_3, Steps=expr("(x/2)-1", item_6))
multiplication_4 = Multiplication(A=range, B="-1")

# ----
merge_6 = Merge(Data1=flatten(dom_2), Data2=dom)  # -> graft(Result)
division = Division(A=item_6, B=2)

range_2 = Range(Domain=merge_6, Steps=expr("x-1", division))
lng_4 = ListLength(List=range_2)  # -> flatten(Length)
lng_5 = ListLength(List=lng_4)
multiplication_5 = Multiplication(A=division, B=lng_5)
repeat_2 = RepeatData(Data=Slider(0, range=0..100), Length=multiplication_5)
partition = PartitionList(List=repeat_2, Size=division)

# ---- group: i dont want to talk about this ITS SO DUMB but it works
repeat_3 = RepeatData(Data=Slider(0, range=0..100), Length=division)
repeat_4 = RepeatData(Data=Slider(1, range=0..1), Length=division)
merge_7 = Merge(Data1=repeat_3, Data2=repeat_4)
weave_2 = Weave(Pattern=merge_7, Stream0=flatten(partition), Stream1=flatten(range_2), NullGaps=False)
partition_2 = PartitionList(List=weave_2, Size=item_6)

# ----
repeat_5 = RepeatData(Data=Slider(0, range=0..100), Length=expr("x/2", item_6))
merge_8 = Merge(Data1=repeat_5, Data2=multiplication_4)

# ---- group: curves to vase mode (continued)
Z_2 = UnitZ(Factor=partition_2)
move = Move(Geometry=cp_14.Points, Motion=Z_2)  # -> flatten(Geometry), Transform
lng_6 = ListLength(List=move.Geometry)
subtraction_2 = Subtraction(A=lng_6, B=item_6)
split = SplitList(List=move.Geometry, Index=subtraction_2)  # -> ListA, ListB
Z_3 = UnitZ(Factor=merge_8)
move_2 = Move(Geometry=split.ListB, Motion=Z_3)  # -> Geometry, Transform
merge_9 = Merge(Data1=split.ListA, Data2=move_2.Geometry)
cull_i_3 = CullIndex(List=merge_9, Indices=[-1, -2], Wrap=True)
pline_10 = PolyLine(Vertices=cull_i_3, Closed=False)
clean = CleanTree(RemoveNulls=True, RemoveInvalid=True, RemoveEmpty=True, Tree=pline_10)
panel_3 = Panel(clean)

# ----
pline_11 = PolyLine(Vertices=move_2.Geometry, Closed=False)
geo_6 = Geometry([clean, weave])
geo_7 = ClusterOutput(geo_6)

# ==== cluster Cluster_69
geo = ClusterInput()
P = ClusterInput()

# ---- group: failures
crv = Curve()

# ----
md_slider = MDSlider(
    SliderMode=0,
    slider_value=Point(0.9029903927, 0.1962116521, 0.5),
    x_domain=Domain(0, 1),
    y_domain=Domain(0, 1),
    z_domain=Domain(0, 1))
dispatch = Dispatch(List=geo, DispatchPattern=P)  # -> ListA, ListB
loft = Loft(Curves=dispatch.ListA, Options={Adjust=True, Closed=False, LoftEnds=0, LoftSimp=1, LoftType=0, Rebuild=100, Refit=0.01})
number_slider = Slider(10, range=0..10)
iso = IsoCurve(Surface=reparameterize(loft), UVPoint=md_slider)  # -> UIsocurve, VIsocurve
ext = ExtendCurve(Curve=iso.UIsocurve, Type=2, Start=number_slider, End=number_slider)
divide = DivideCurve(Curve=ext, Count=expr("x-1", 36), Kinks=False)  # -> Points, Tangents, Parameters
number_slider_2 = Slider(5, range=0..25)
brep_cp = BrepClosestPoint(Point=divide.Points, Brep=loft)  # -> Point, Normal, Distance
amp = Amplitude(Vector=brep_cp.Normal, Amplitude=expr("-x", number_slider_2))
amp_2 = Amplitude(Vector=brep_cp.Normal, Amplitude=number_slider_2)
cp = ControlPoints(Curve=geo)  # -> Points, Weights, Knots
move = Move(Geometry=divide.Points, Motion=amp_2)  # -> Geometry, Transform
move_2 = Move(Geometry=divide.Points, Motion=amp)  # -> Geometry, Transform
cullpt = CullDuplicates(Points=cp.Points, Tolerance=0.1, CullMode=3)  # -> Points, Indices, Valence
pline = PolyLine(Vertices=move_2.Geometry, Closed=False)
pline_2 = PolyLine(Vertices=move.Geometry, Closed=False)
pline_3 = PolyLine(Vertices=cullpt.Points, Closed=True)  # -> flatten(Polyline)
geo_2 = Geometry()
loft_2 = Loft(Curves=[pline_2, pline], Options={Adjust=True, Closed=False, LoftEnds=0, LoftSimp=1, LoftType=0, Rebuild=50, Refit=0.01})
split = SplitWithBrep(Curve=flatten(pline_3), Brep=flatten(loft_2))  # -> Curve, Points
cp_2 = ControlPoints(Curve=split.Curve)  # -> Points, Weights, Knots
cull_i = CullIndex(List=cp_2.Points, Indices=0, Wrap=True)
cull_i_2 = CullIndex(List=cull_i, Indices=-1, Wrap=True)
cullpt_2 = CullDuplicates(Points=cull_i_2, Tolerance=0.1, CullMode=3)  # -> Points, Indices, Valence
clean = CleanTree(RemoveNulls=True, RemoveInvalid=True, RemoveEmpty=True, Tree=cull_i_2)
pline_4 = PolyLine(Vertices=clean, Closed=False)

# ---- group: failures / attempt 2
cluster = Cluster_65(crv=crv)

# ---- group: failures / attempt2.5/3
cluster_2 = Cluster_68(relay=crv)

# ---- group: failures / attempt 1 at shifting lists
cluster_3 = Cluster_67(L=crv, P_2=[0, 1], P=[True, False])

# ----
panel = Panel(loft_2)
int = ClusterInput()
int_2 = ClusterInput()
B = ClusterInput()
N = ClusterInput()

# ---- group: aligning curves by forcing a straight line / aligning curves
geo_3 = Geometry(geo)
cp_3 = ControlPoints(Curve=geo_3)  # -> Points, Weights, Knots
cullpt_3 = CullDuplicates(Points=cp_3.Points, Tolerance=0.1, CullMode=3)  # -> Points, Indices, Valence
pline_5 = PolyLine(Vertices=cullpt_3.Points, Closed=True)  # -> flatten(Polyline)
geo_4 = Geometry(pline_5)
item = ListItem(List=geo_4, Index=0, Wrap=True)
cp_4 = ControlPoints(Curve=item)  # -> Points, Weights, Knots
number_slider_3 = Slider(1.64, range=0..3)
topoly = CurveToPolyline(Curve=item, ToleranceDistance=0.01, ToleranceAngle=0)  # -> Polyline, Segments
item_2 = ListItem(List=cp_4.Points, Index=Slider(73, range=0..100), Wrap=True)
pcen = PolygonCenter(Polyline=topoly.Polyline)  # -> CenterV, CenterE, CenterA
multiplication = Multiplication(A=number_slider_3, B=-1)
vec2pt = Vector2Pt(PointA=pcen.CenterE, PointB=item_2, Unitize=False)  # -> Vector, Length
multiplication_2 = Multiplication(A=vec2pt.Vector, B=[multiplication, number_slider_3])
extr = Extrude(Base=item_2, Direction=multiplication_2)
Z = UnitZ(Factor=Slider(10000, range=0..10000))
join = JoinCurves(Curves=extr, Preserve=False)
cp_5 = ControlPoints(Curve=geo_4)  # -> Points, Weights, Knots
extr_2 = Extrude(Base=join, Direction=Z)
srf_cp = SurfaceClosestPoint(Point=cp_5.Points, Surface=extr_2)  # -> Point, UVPoint, Distance

# ----
lng = ListLength(List=cp_3.Points)
panel_2 = Panel(lng)
cp_6 = ControlPoints(Curve=pline_5)  # -> Points, Weights, Knots

# ---- group: aligning curves by forcing a straight line
crv_cp = CurveClosestPoint(Point=cp_5.Points)  # -> Point, Parameter, Distance

# ---- group: aligning curves by forcing a straight line / aligning curves (continued)
dist = Distance(PointA=cp_5.Points, PointB=crv_cp.Point)
sort = SortList(Keys=dist, ValuesA=cp_5.Points)  # -> Keys, ValuesA
item_3 = ListItem(List=sort.ValuesA, Index=0, Wrap=True)
crv_cp_2 = CurveClosestPoint(Point=graft(item_3), Curve=graft(geo_4))  # -> Point, Parameter, Distance
seam = Seam(Curve=graft(geo_4), Seam=crv_cp_2.Parameter)
cp_7 = ControlPoints(Curve=seam)  # -> Points, Weights, Knots
cullpt_4 = CullDuplicates(Points=cp_7.Points, Tolerance=0.1, CullMode=3)  # -> Points, Indices, Valence
item_4 = ListItem(List=cullpt_4.Points, Index=0, Wrap=True)
pline_6 = PolyLine(Vertices=cullpt_4.Points, Closed=False)

# ---- group: curves to vase mode
cp_8 = ControlPoints(Curve=flatten(pline_4))  # -> Points, Weights, Knots
lng_2 = ListLength(List=cp_8.Points)
int_3 = Integer(int)
item_5 = ListItem(List=flatten(lng_2), Index=0, Wrap=True)
item_6 = ListItem(List=cp_8.Points, Index=-1, Wrap=True)  # -> flatten(Item)
cull_i_3 = CullIndex(List=item_6, Indices=-1, Wrap=True)
cull_i_4 = CullIndex(List=item_6, Indices=0, Wrap=True)
int_4 = Integer(int_2)
pdecon = Deconstruct(Point=cull_i_3)  # -> XComponent, YComponent, ZComponent
pdecon_2 = Deconstruct(Point=cull_i_4)  # -> XComponent, YComponent, ZComponent
subtraction = Subtraction(A=pdecon_2.ZComponent, B=pdecon.ZComponent)
dom = ConstructDomain(DomainStart=0, DomainEnd=subtraction)
split_2 = SplitList(List=cp_8.Points, Index=int_3)  # -> ListA, ListB
subtraction_2 = Subtraction(A=item_5, B=int_3)
geo_5 = Geometry(split_2.ListA)
dom_2 = ConstructDomain(DomainStart=0, DomainEnd=int_4)
range = Range(Domain=dom_2, Steps=expr("x-1", N))
multiplication_3 = Multiplication(A=range, B="-1")
Z_2 = UnitZ(Factor=multiplication_3)

# ----
dom_3 = ConstructDomain(DomainStart=0, DomainEnd=int_4)
merge = Merge(Data1=flatten(dom), Data2=dom_3)

# ---- group: curves to vase mode (continued)
range_2 = Range(Domain=merge, Steps=expr("x-1", subtraction_2))
Z_3 = UnitZ(Factor=range_2)
move_3 = Move(Geometry=split_2.ListB, Motion=Z_3)  # -> Geometry, Transform
merge_2 = Merge(Data1=geo_5, Data2=move_3.Geometry)
lng_3 = ListLength(List=merge_2)
subtraction_3 = Subtraction(A=lng_3, B=B)
split_3 = SplitList(List=merge_2, Index=subtraction_3)  # -> ListA, ListB
move_4 = Move(Geometry=split_3.ListB, Motion=Z_2)  # -> Geometry, Transform
merge_3 = Merge(Data1=split_3.ListA, Data2=move_4.Geometry)
cull_i_5 = CullIndex(List=merge_3, Indices=[-1, -2], Wrap=True)
pline_7 = PolyLine(Vertices=cull_i_5, Closed=False)

# ----
pline_8 = PolyLine(Vertices=flatten(merge_2), Closed=False)
pl = ClusterOutput(pline_8)
cp_9 = ControlPoints(Curve=pline_8)  # -> Points, Weights, Knots

# ---- group: curves to vase mode (continued)
clean_2 = CleanTree(RemoveNulls=True, RemoveInvalid=True, RemoveEmpty=True, Tree=pline_8)
panel_3 = Panel(pline_8)

# ==== cluster Cluster_34
C = ClusterInput()
topoly = CurveToPolyline(Curve=C, ToleranceDistance=Slider(0.1, range=0..0.1), ToleranceAngle=0)  # -> Polyline, Segments
pcen = PolygonCenter(Polyline=topoly.Polyline)  # -> CenterV, CenterE, CenterA
ce = ClusterOutput(pcen.CenterE)

# ==== cluster Cluster_63
geo = ClusterInput()
A = ClusterInput()
B = ClusterInput()

geo_2 = Geometry(geo)
item = ListItem(List=geo_2, Index=0, Wrap=True)
topoly = CurveToPolyline(Curve=geo_2, ToleranceDistance=0.01, ToleranceAngle=0)  # -> Polyline, Segments
cp = ControlPoints(Curve=item)  # -> Points, Weights, Knots
pcen = PolygonCenter(Polyline=topoly.Polyline)  # -> CenterV, CenterE, CenterA
item_2 = ListItem(List=cp.Points, Index=0, Wrap=True)
item_3 = ListItem(List=pcen.CenterE, Index=0, Wrap=True)
dist = Distance(PointA=item_2, PointB=item_3)
multiplication = Multiplication(A=A, B=B)
subtraction = Subtraction(A=dist, B=multiplication)
division = Division(A=subtraction, B=dist)
scale_nu = ScaleNU(Geometry=geo_2, Plane=pcen.CenterE, ScaleX=division, ScaleY=division, ScaleZ=1)  # -> Geometry, Transform

G = ClusterOutput(scale_nu.Geometry)

# ==== cluster Cluster_65
crv = ClusterInput()
crv_2 = Curve(graft(crv))
topoly = CurveToPolyline(Curve=crv_2, ToleranceDistance=0.01, ToleranceAngle=0)  # -> Polyline, Segments
cp = ControlPoints(Curve=crv_2)  # -> Points, Weights, Knots
pcen = PolygonCenter(Polyline=topoly.Polyline)  # -> CenterV, CenterE, CenterA
pdecon = Deconstruct(Point=pcen.CenterV)  # -> XComponent, YComponent, ZComponent
sort = SortList(Keys=flatten(pdecon.ZComponent), ValuesA=flatten(crv_2))  # -> Keys, ValuesA
geo = Geometry(sort.ValuesA)

loft = Loft(Curves=flatten(geo), Options={Adjust=True, Closed=False, LoftEnds=0, LoftSimp=1, LoftType=1, Rebuild=1000, Refit=0.01})
pt = ConstructPoint(XCoordinate=0.01, YCoordinate=Slider(0.52, range=0..1), ZCoordinate=0)
iso = IsoCurve(Surface=reparameterize(loft), UVPoint=pt)  # -> UIsocurve, VIsocurve
crv_3 = Curve(iso.UIsocurve)

line = Line(Line((0, 0, 0), (0, 0, 3989)))
crv_cp = CurveClosestPoint(Point=cp.Points, Curve=line)  # -> Point, Parameter, Distance
cp_2 = ControlPoints(Curve=crv_2)  # -> Points, Weights, Knots
panel = Panel(crv_2)
cullpt = CullDuplicates(Points=cp_2.Points, Tolerance=0.1, CullMode=3)  # -> Points, Indices, Valence
crv_cp_2 = CurveClosestPoint(Point=cullpt.Points, Curve=line)  # -> Point, Parameter, Distance
lng = ListLength(List=cullpt.Points)
dist = Distance(PointA=crv_cp_2.Point, PointB=cullpt.Points)
panel_2 = Panel(lng)
bnd = Bounds(Numbers=dist)
sort_2 = SortList(Keys=dist, ValuesA=cullpt.Points)  # -> Keys, ValuesA
panel_3 = Panel(bnd)
item = ListItem(List=sort_2.ValuesA, Index=0, Wrap=True)
index = ItemIndex(List=cullpt.Points, Item=item)
subtraction = Subtraction(A=lng, B=index)
panel_4 = Panel(index)
shift = ShiftList(List=cullpt.Points, Shift=subtraction, Wrap=True)
pline = PolyLine(Vertices=shift, Closed=False)

# ==== cluster Cluster_67
int = ClusterInput()
int_2 = Integer(int)
_6 = ClusterInput()
_6_2 = ClusterInput()
cluster = Cluster_66(G_2=int_2, _6_2=_6, G=int_2, _6=_6_2)  # -> s_0_2, s_0
L = ClusterInput()
P = ClusterInput()
dispatch = Dispatch(List=L, DispatchPattern=P)  # -> ListA, ListB
panel = Panel(int_2)
dispatch_2 = Dispatch(List=dispatch.ListB, DispatchPattern=cluster.s_0_2)  # -> ListA, ListB
cp = ControlPoints(Curve=dispatch_2.ListA)  # -> Points, Weights, Knots
cp_2 = ControlPoints(Curve=dispatch.ListA)  # -> Points, Weights, Knots
cp_3 = ControlPoints(Curve=dispatch_2.ListB)  # -> Points, Weights, Knots
filter = StreamFilter(Gate=int_2, Stream0="2", Stream1="2", Stream2="0", Stream3="1", Stream4="1", Stream5="1", Stream6="2")
filter_2 = StreamFilter(Gate=int_2, Stream0="2", Stream1="0", Stream2="0", Stream3="1", Stream4="1", Stream5="1", Stream6="0")
cullpt = CullDuplicates(Points=cp_2.Points, Tolerance=0.1, CullMode=3)  # -> Points, Indices, Valence
cullpt_2 = CullDuplicates(Points=cp.Points, Tolerance=0.1, CullMode=3)  # -> Points, Indices, Valence
cullpt_3 = CullDuplicates(Points=cp_3.Points, Tolerance=0.1, CullMode=3)  # -> Points, Indices, Valence
shift = ShiftList(List=cullpt_2.Points, Shift=filter, Wrap=True)
shift_2 = ShiftList(List=cullpt_3.Points, Shift=filter_2, Wrap=True)
pline = PolyLine(Vertices=shift, Closed=False)  # -> flatten(Polyline)
pline_2 = PolyLine(Vertices=shift_2, Closed=False)  # -> flatten(Polyline)
pline_3 = PolyLine(Vertices=cullpt.Points, Closed=False)  # -> flatten(Polyline)
weave = Weave(Pattern=cluster.s_0, Stream0=pline, Stream1=pline_2, NullGaps=False)
P_2 = ClusterInput()
weave_2 = Weave(Pattern=P_2, Stream0=pline_3, Stream1=weave, NullGaps=False)

# ==== cluster Cluster_68
relay = ClusterInput()
cp = ControlPoints(Curve=relay)  # -> Points, Weights, Knots
cullpt = CullDuplicates(Points=cp.Points, Tolerance=0.1, CullMode=3)  # -> Points, Indices, Valence
pline = PolyLine(Vertices=cullpt.Points, Closed=False)

# ---- group: so close
cp_2 = ControlPoints(Curve=relay)  # -> Points, Weights, Knots
cullpt_2 = CullDuplicates(Points=cp_2.Points, Tolerance=0.1, CullMode=3)  # -> Points, Indices, Valence
item = ListItem(List=cullpt_2.Points, Index=0, Wrap=True)
geo = Geometry(item)
equals = Equality(FirstNumber=cp_2.Points, SecondNumber=geo)  # -> Equality, Inequality
cull_i = CullIndex(List=equals.Equality, Indices=0, Wrap=True)
lng = ListLength(List=equals.Equality)
series = Series(Start=0, Step=1, Count=flatten(lng))
panel = Panel(equals.Equality)
dispatch = Dispatch(List=series, DispatchPattern=equals.Equality)  # -> ListA, ListB
panel_2 = Panel(dispatch.ListA)
subtraction = Subtraction(A=Slider(8, range=0..10), B=panel_2)
shift = ShiftList(List=cullpt_2.Points, Shift=subtraction, Wrap=True)
cullpt_3 = CullDuplicates(Points=shift, Tolerance=0.1, CullMode=3)  # -> Points, Indices, Valence
pline_2 = PolyLine(Vertices=cullpt_3.Points, Closed=False)

# ----
pline_3 = PolyLine(Vertices=cullpt_2.Points, Closed=False)

# ==== cluster Cluster_66
panel = Panel("""False
True""")
panel_2 = Panel("""True
False""")
G = ClusterInput()
_6 = ClusterInput()
G_2 = ClusterInput()
_6_2 = ClusterInput()
filter = StreamFilter(Gate=G, Stream0=panel, Stream1=panel, Stream2=panel, Stream3=panel, Stream4=panel, Stream5=panel, Stream6=_6)
filter_2 = StreamFilter(
    Gate=G_2,
    Stream0=panel_2,
    Stream1=panel_2,
    Stream2=panel_2,
    Stream3=panel_2,
    Stream4=panel_2,
    Stream5=panel_2,
    Stream6=_6_2)
s_0 = ClusterOutput(filter)
s_0_2 = ClusterOutput(filter_2)
